# Dynamo graph 분수찾기.dyn (Dynamo 2.13.1.3887)

code_block = CodeBlock { "1/2"; }
code_block_2 = CodeBlock { ["A","B"]; }
code_block_3 = CodeBlock { 1; }
code_block_4 = CodeBlock { 15; }
range = Range(start=code_block_3, end=code_block_4)
code_block_5 = CodeBlock(x=range) { x%2 == 1? true:false; }
filterByBoolMask = List.FilterByBoolMask(list=range, mask=code_block_5)
code_block_6 = CodeBlock { 0; }
count = List.Count(list=filterByBoolMask.in)
code_block_7 = CodeBlock(i=count) { i-1; }
range_2 = Range(start=code_block_6, end=code_block_7)
code_block_8 = CodeBlock(x=range_2) { x%2 == 1? true:false; }
filterByBoolMask_2 = List.FilterByBoolMask(list=range_2, mask=code_block_8)
getItemAtIndex = List.GetItemAtIndex(list=filterByBoolMask.in, index=filterByBoolMask_2.in)
getItemAtIndex_2 = List.GetItemAtIndex(list=filterByBoolMask.in, index=filterByBoolMask_2.out)
