# Dynamo graph 색종이.dyn (Dynamo 2.13.1.3887)

code_block = CodeBlock { "3"; "3 7"; "15 7"; "5 2"; }
join = List.Join(list0=code_block.out0, list1=code_block.out1, list2=code_block.out2, list3=code_block.out3)
code_block_2 = CodeBlock(i=join) { i; }
code_block_3 = CodeBlock { " "; }
split = String.Split(string=code_block_2, separator0=code_block_3)
toNumber = String.ToNumber(string=split)
deconstruct = List.Deconstruct(list=toNumber)
# note: LB
code_block_4 = CodeBlock(i=deconstruct.rest) { i; }
deconstruct_2 = List.Deconstruct(list=deconstruct.rest@L2)
deconstruct_3 = List.Deconstruct(list=deconstruct_2.rest@L2)
code_block_5 = CodeBlock { 10; }
add = deconstruct_3.first + code_block_5
list_create = List.Create(item0=deconstruct_2.first, item1=add)
# note: LU
transpose = List.Transpose(lists=list_create)
code_block_6 = CodeBlock { 10; }
add_2 = deconstruct_2.first + code_block_6
list_create_2 = List.Create(item0=add_2, item1=deconstruct_3.first)
# note: RB
transpose_2 = List.Transpose(lists=list_create_2)
code_block_7 = CodeBlock { 10; }
# note: RU
add_3 = deconstruct.rest + code_block_7
list_create_3 = List.Create(item0=code_block_4, item1=transpose, item2=transpose_2, item3=add_3)
transpose_3 = List.Transpose(lists=list_create_3)

# group: 색종이별 4 귀퉁이 좌표
code_block_8 = CodeBlock()
# ---------- code_block_8.designscript (6 lines) ----------
[
"LB",
"LU",
"RB",
"RU"
];
# ----------------------------------------
byKeysValues = DesignScript.Builtin.Dictionary.ByKeysValues(keys=code_block_8, values=transpose_3@L3)

components = DesignScript.Builtin.Dictionary.Components(dictionary=byKeysValues)
code_block_9 = CodeBlock(i=components.values) { i[0]; }
code_block_10 = CodeBlock(i=components.values) { i[2]; }
sub = code_block_9 - code_block_10
