# Dynamo graph 설탕 배달.dyn (Dynamo 2.13.1.3887)

code_block = CodeBlock { 3; 5; }
code_block_2 = CodeBlock { 18; 4; 6; 9; 11; }
code_block_3 = CodeBlock(i=code_block_2.out1) { i; }
div = code_block_3 / code_block.out0
range = Range(end=div)
mul = code_block.out0 * range
list_create = List.Create(item0=mul, item1=range)
transpose = List.Transpose(lists=list_create)
firstItem = List.FirstItem(list=transpose@L2)
mul_2 = code_block.out1 * range
list_create_2 = List.Create(item0=mul_2, item1=range)
transpose_2 = List.Transpose(lists=list_create_2)
firstItem_2 = List.FirstItem(list=transpose_2@L2)
add = firstItem + firstItem_2  # lacing=CrossProduct
eq = add == code_block_3
anyTrue = List.AnyTrue(list=eq@L2)
boolean = BoolSelector(true)
allIndicesOf = List.AllIndicesOf(list=anyTrue, item=boolean)
getItemAtIndex = List.GetItemAtIndex(list=add, index=allIndicesOf)
getItemAtIndex_2 = List.GetItemAtIndex(list=eq, index=allIndicesOf)
anyTrue_2 = List.AnyTrue(list=getItemAtIndex_2@L1)
allFalse = List.AllFalse(list=anyTrue_2)
firstItem_3 = List.FirstItem(list=allIndicesOf)
boolean_2 = BoolSelector(true)
allIndicesOf_2 = List.AllIndicesOf(list=anyTrue_2, item=boolean_2)
firstItem_4 = List.FirstItem(list=allIndicesOf_2)
add_2 = firstItem_3 + firstItem_4
isEmpty = List.IsEmpty(list=add_2)
code_block_4 = CodeBlock { -1; }
if_ = RefactoredIf(test=isEmpty, true=code_block_4, false=add_2)
watch = Watch(if_)
