# Dynamo graph 시험 성적.dyn (Dynamo 2.13.1.3887)

test_case = CodeBlock { 95; 89; 71; 69; 40; }
code_block = CodeBlock()
# ---------- code_block.designscript (7 lines) ----------
[
4,
3,
2,
1,
0
];
# ----------------------------------------
string_from_object = FromObject(object=code_block)
code_block_2 = CodeBlock()
# ---------- code_block_2.designscript (7 lines) ----------
[
"A",
"B",
"C",
"D",
"F"
];
# ----------------------------------------
byKeysValues = DesignScript.Builtin.Dictionary.ByKeysValues(keys=string_from_object, values=code_block_2)
code_block_3 = CodeBlock { 100; }
code_block_4 = CodeBlock()
# ---------- code_block_4.designscript (6 lines) ----------
[
90,
80,
70,
60
];
# ----------------------------------------
lt = code_block_3 < code_block_4
countFalse = List.CountFalse(list=lt)
string_from_object_2 = FromObject(object=countFalse)
valueAtKey = DesignScript.Builtin.Dictionary.ValueAtKey(dictionary=byKeysValues, key=string_from_object_2)
watch = Watch(valueAtKey)
