# Dynamo graph 영화감독 숌.dyn (Dynamo 2.16.1.2727)

code_block = CodeBlock { 0..10000; }
string_from_object = FromObject(object=code_block)
code_block_2 = CodeBlock { "666"; }
contains = String.Contains(string=string_from_object, searchFor=code_block_2)
filterByBoolMask = List.FilterByBoolMask(list=code_block, mask=contains)
