# Dynamo graph 재귀의 귀재.dyn (Dynamo 2.16.1.2727)

code_block = CodeBlock()
# ---------- code_block.designscript (6 lines) ----------
[5,
"AAA",
"ABBA",
"ABABA",
"ABCA",
"PALINDROME"];
# ----------------------------------------
deconstruct = List.Deconstruct(list=code_block)
code_block_2 = CodeBlock(i=deconstruct.rest) { i[1]; }
python_script = Python(IN[0]=code_block_2)  # CPython3
# ---------- python_script.python (17 lines) ----------
# Load the Python Standard and DesignScript Libraries
import sys
import clr
clr.AddReference('ProtoGeometry')
from Autodesk.DesignScript.Geometry import *

# The inputs to this node will be stored as a list in the IN variables.
dataEnteringNode = IN
s = IN[0]
# Place your code below this line
def palindrome(s):
    res = "".join(reversed(s)) == s
    
    return res

# Assign your output to the OUT variable.
OUT = palindrome(s)
# ----------------------------------------
watch = Watch(python_script)
