# Dynamo graph 주사위 세개.dyn (Dynamo 2.16.1.2727)

code_block = CodeBlock { "2 2 2"; }
code_block_2 = CodeBlock { "6 2 5"; }
code_block_3 = CodeBlock { [3,2,1]; }
string_from_object = FromObject(object=code_block_3)
code_block_4 = CodeBlock { "3 3 6"; }
code_block_5 = CodeBlock(i=code_block_4) { i; }
code_block_6 = CodeBlock { " "; }
split = String.Split(string=code_block_5, separator0=code_block_6)
groupByKey = List.GroupByKey(list=split, keys=split)
count = List.Count(list=groupByKey.groups@L2)
string_from_object_2 = FromObject(object=count)
maximumItem = List.MaximumItem(list=count)
code_block_7 = CodeBlock(i=maximumItem) { i:int; }
string_from_object_3 = FromObject(object=code_block_7)
indexOf = List.IndexOf(list=string_from_object_2, element=string_from_object_3)
getItemAtIndex = List.GetItemAtIndex(list=groupByKey.groups, index=indexOf)
firstItem = List.FirstItem(list=getItemAtIndex)
toNumber = String.ToNumber(string=firstItem)
code_block_8 = CodeBlock(i=toNumber) { 10000 + (i * 1000); }
code_block_9 = CodeBlock(i=toNumber) { 1000 + (i * 100); }
toNumber_2 = String.ToNumber(string=split)
maximumItem_2 = List.MaximumItem(list=toNumber_2)
code_block_10 = CodeBlock(i=maximumItem_2) { i * 100; }
join = List.Join(list0=code_block_8, list1=code_block_9, list2=code_block_10)
byKeysValues = DesignScript.Builtin.Dictionary.ByKeysValues(keys=string_from_object, values=join)
code_block_11 = CodeBlock(k=maximumItem) { k:int; }
string_from_object_4 = FromObject(object=code_block_11)
valueAtKey = DesignScript.Builtin.Dictionary.ValueAtKey(dictionary=byKeysValues, key=string_from_object_4)
watch = Watch(valueAtKey)
