# Dynamo graph 큰 수 A+B.dyn "큰 수 A+B_" (Dynamo 2.13.1.3887)

code_block = CodeBlock { 0; }
code_block_2 = CodeBlock { "9223372036854775807 9223372036854775808"; "56 77889"; "77889 79"; }
code_block_3 = CodeBlock { " "; }
split = String.Split(string=code_block_2.out0, separator0=code_block_3)
code_block_4 = CodeBlock { ""; }
split_2 = String.Split(string=split, separator0=code_block_4)
toNumber = String.ToNumber(string=split_2)
reverse = List.Reverse(list=toNumber@L2)
transpose = List.Transpose(lists=reverse)
code_block_5 = CodeBlock { 0; }
isNull = Object.IsNull()  # unwired: object
replaceByCondition = Replace(item=transpose, replaceWith=code_block_5, condition=isNull)
sum = Math.Sum(values=replaceByCondition@L2)
string_from_object = FromObject(object=sum)
code_block_6 = CodeBlock { "."; }
split_3 = String.Split(string=string_from_object, separator0=code_block_6)
deconstruct = List.Deconstruct(list=split_3@L2)
length = String.Length(string=deconstruct.first@L1)
code_block_7 = CodeBlock(i=length) { i==2; }
code_block_8 = CodeBlock { "0"; }
add = code_block_8 + deconstruct.first
if_ = RefactoredIf(test=code_block_7@L1, true=deconstruct.first@L1, false=add@L1)
code_block_9 = CodeBlock { ""; }
split_4 = String.Split(string=if_, separator0=code_block_9)
toNumber_2 = String.ToNumber(string=split_4)
deconstruct_2 = List.Deconstruct(list=toNumber_2@L2)
addItemToFront = List.AddItemToFront(item=code_block, list=deconstruct_2.first)
code_block_10 = CodeBlock { [0]; }
addItemToEnd = List.AddItemToEnd(item=code_block_10, list=deconstruct_2.rest)
addItemToFront_2 = List.AddItemToFront(item=addItemToFront@L1, list=addItemToEnd@L1)
sum_2 = Math.Sum(values=addItemToFront_2@L2)
reverse_2 = List.Reverse(list=sum_2)
firstItem = List.FirstItem(list=reverse_2)
code_block_11 = CodeBlock(i=firstItem) { i!=0; }
deconstruct_3 = List.Deconstruct(list=reverse_2)
if_2 = RefactoredIf(test=code_block_11, true=reverse_2, false=deconstruct_3.rest)
string_from_object_2 = FromObject(object=if_2)
code_block_12 = CodeBlock { "."; }
split_5 = String.Split(string=string_from_object_2, separator0=code_block_12)
deconstruct_4 = List.Deconstruct(list=split_5@L2)
concat = String.Concat(string0=deconstruct_4.first)
watch = Watch(concat)
toNumber_3 = String.ToNumber(string=split)
sum_3 = Math.Sum(values=toNumber_3)
