# Dynamo graph 팩토리얼.dyn "팩토리얼1" (Dynamo 2.16.1.2727)

code_block = CodeBlock { 10; }
code_block_2 = CodeBlock { 0; }
python_script = Python(IN[0]=code_block_2)  # CPython3
# ---------- python_script.python (20 lines) ----------
# Load the Python Standard and DesignScript Libraries
import sys
import clr
clr.AddReference('ProtoGeometry')
from Autodesk.DesignScript.Geometry import *

# The inputs to this node will be stored as a list in the IN variables.
dataEnteringNode = IN
n = IN[0]
# Place your code below this line

def facto(n):
    if n > 1:
        return n * facto(n - 1)
    else:
        return 1


# Assign your output to the OUT variable.
OUT = facto(n)
# ----------------------------------------
watch = Watch(python_script)
