# Dynamo graph 한수.dyn (Dynamo 2.13.1.3887)

code_block = CodeBlock { 1; }
code_block_2 = CodeBlock { 110; }
range = Range(start=code_block, end=code_block_2)
string_from_object = FromObject(object=range)
code_block_3 = CodeBlock { ""; }
split = String.Split(string=string_from_object, separator0=code_block_3)
count = List.Count(list=split@L2)
groupByKey = List.GroupByKey(list=split, keys=count)
code_block_4 = CodeBlock { 1; }
range_2 = Range(start=code_block_4, end=count)
code_block_5 = CodeBlock { 2; }
combinations = List.Combinations(list=range_2@L2, length=code_block_5)
count_2 = List.Count(list=combinations)
code_block_6 = CodeBlock(i=count_2) { i-1; }
range_3 = Range(end=code_block_6)
string_from_object_2 = FromObject(object=range_3)
byKeysValues = DesignScript.Builtin.Dictionary.ByKeysValues(keys=string_from_object_2)  # unwired: values
