# Dynamo graph Earth_CT.dyn (Dynamo 2.16.1.2727)

select_edge = DSEdgeSelection()  # 1 picked in the model
python_script = Python(IN[0]=select_edge)  # CPython3
# ---------- python_script.python (63 lines) ----------
import clr
clr.AddReference('RevitServices')
from RevitServices.Persistence import DocumentManager
from RevitServices.Transactions import TransactionManager

clr.AddReference('RevitAPI')
from Autodesk.Revit.DB import *

# 현재 Revit 문서 가져오기
doc = DocumentManager.Instance.CurrentDBDocument

# 입력값: 기준 축 (선 형태의 Reference Curve)과 간격
reference_curve = IN[0]  # 다이나모에서 선을 입력받음
spacing = 500  # 500mm 간격
section_depth = 2000  # 단면 깊이 (예제 값)

# 기준 축의 시작 및 끝점 좌표 가져오기
#start_point = reference_curve.GetEndPoint(0)
#end_point = reference_curve.GetEndPoint(1)

start_point = reference_curve.StartPoint
end_point = reference_curve.EndPoint

# 기준 축의 길이 계산
curve_length = reference_curve.Length
num_sections = int(curve_length / spacing)  # 생성할 단면 개수

# 단면 뷰 생성
TransactionManager.Instance.EnsureInTransaction(doc)

sections = []
for i in range(num_sections):
    # 단면의 기준이 될 중심점 계산
    param = float(i) / num_sections
    section_origin = reference_curve.Evaluate(param, True)
    
    # 단면 뷰 방향 설정 (Y축 기준)
    view_direction = XYZ(0, 1, 0)  # Y축을 따라 단면이 생성됨
    
    # 단면의 Bounding Box 설정
    min_point = XYZ(section_origin.X - section_depth / 2, 
                    section_origin.Y - section_depth / 2, 
                    start_point.Z)
    max_point = XYZ(section_origin.X + section_depth / 2, 
                    section_origin.Y + section_depth / 2, 
                    end_point.Z)
    
    section_box = BoundingBoxXYZ()
    section_box.Min = min_point
    section_box.Max = max_point

    # 단면 생성
    section = ViewSection.CreateSection(doc, doc.GetDefaultElementTypeId(ElementTypeGroup.ViewTypeSection), section_box)
    
    # 단면 이름 설정
    section.Name = f"Section_{i+1}"
    
    sections.append(section)

TransactionManager.Instance.TransactionTaskDone()

# 다이나모 출력
OUT = sections
# ----------------------------------------
startPoint = Curve.StartPoint()  # unwired: curve
