# Dynamo graph dictionary 활용_거푸집_rC.dyn (Dynamo 2.13.1.3887)

categories = Categories("OST_Walls")
all_elements_of_category = ElementsOfCategory(Category=categories)
parameters = Element.Parameters(element=all_elements_of_category)
add = _ + _  # unwired: x, y
code_block = CodeBlock { 0; }
code_block_2 = CodeBlock { "Length"; }
getParameterValueByName = Element.GetParameterValueByName(element=all_elements_of_category, parameterName=code_block_2)
code_block_3 = CodeBlock { "Area"; }
getParameterValueByName_2 = Element.GetParameterValueByName(element=all_elements_of_category, parameterName=code_block_3)
list_create = List.Create(item0=getParameterValueByName, item1=getParameterValueByName_2)
transpose = List.Transpose(lists=list_create)
code_block_4 = CodeBlock()
# ---------- code_block_4.designscript (4 lines) ----------
[
"length",
"area"
];
# ----------------------------------------
byKeysValues = DesignScript.Builtin.Dictionary.ByKeysValues(keys=code_block_4)  # unwired: values
map = List.Map(list=transpose, function=byKeysValues)
code_block_5 = CodeBlock { "length"; }
valueAtKey = DesignScript.Builtin.Dictionary.ValueAtKey(dictionary=map, key=code_block_5)
reduce = List.Reduce(reduceFunction=add, seed=code_block, list0=valueAtKey)
code_block_6 = CodeBlock { 1; }
add_2 = _ + code_block_6  # unwired: x
code_block_7 = CodeBlock { "Type"; }
getParameterValueByName_3 = Element.GetParameterValueByName(element=all_elements_of_category, parameterName=code_block_7)
code_block_8 = CodeBlock { "Type Name"; }
getParameterValueByName_4 = Element.GetParameterValueByName(element=getParameterValueByName_3, parameterName=code_block_8)
groupByKey = List.GroupByKey(list=all_elements_of_category, keys=getParameterValueByName_4)
byKeysValues_2 = DesignScript.Builtin.Dictionary.ByKeysValues(keys=groupByKey.uniqueKeys, values=groupByKey.groups)
code_block_9 = CodeBlock(i=groupByKey.uniqueKeys) { i[7]; }
valueAtKey_2 = DesignScript.Builtin.Dictionary.ValueAtKey(dictionary=byKeysValues_2, key=code_block_9)
parameters_2 = Element.Parameters(element=valueAtKey_2)

# group: 합성 함수 for side faces_boolmask
code_block_10 = CodeBlock { 0.5; }
normalAtParameter = Surface.NormalAtParameter(u=code_block_10, v=code_block_10)  # unwired: surface
Z = Vector.Z()  # unwired: vector
abs = Math.Abs()  # unwired: number
code_block_11 = CodeBlock { 1; }
ne = _ != code_block_11  # unwired: x
function_compose = ComposeFunctions(function0=normalAtParameter, function1=Z, function2=abs, function3=ne)

code_block_12 = CodeBlock { "elem"; }

# group: dictionary 생성
byKeysValues_3 = DesignScript.Builtin.Dictionary.ByKeysValues(keys=code_block_12)  # unwired: values
map_2 = List.Map(list=valueAtKey_2, function=byKeysValues_3)

code_block_13 = CodeBlock { "area"; }
values = DesignScript.Builtin.Dictionary.Values(dictionary=map_2)
code_block_14 = CodeBlock { "Area"; }
getParameterValueByName_5 = Element.GetParameterValueByName(element=values, parameterName=code_block_14)

# group: dictionary 속성 추가
code_block_15 = CodeBlock(preDict=map_2) { preDict; }
count = List.Count(list=code_block_15)
ofRepeatedItem = List.OfRepeatedItem(item=code_block_13, amount=count)
setValueAtKeys = DesignScript.Builtin.Dictionary.SetValueAtKeys(dictionary=code_block_15, keys=ofRepeatedItem, values=getParameterValueByName_5, lacing=Shortest)

code_block_16 = CodeBlock { "srfs"; }
code_block_17 = CodeBlock { "elem"; }
valueAtKey_3 = DesignScript.Builtin.Dictionary.ValueAtKey(dictionary=setValueAtKeys, key=code_block_17)
faces = Element.Faces(element=valueAtKey_3)

# group: dictionary 속성 추가
code_block_18 = CodeBlock(preDict=setValueAtKeys) { preDict; }
count_2 = List.Count(list=code_block_18)
ofRepeatedItem_2 = List.OfRepeatedItem(item=code_block_16, amount=count_2)
setValueAtKeys_2 = DesignScript.Builtin.Dictionary.SetValueAtKeys(dictionary=code_block_18, keys=ofRepeatedItem_2@L1, values=faces@L2, lacing=Shortest)

map_3 = List.Map(function=setValueAtKeys_2)  # unwired: list
code_block_19 = CodeBlock { "srfs"; }
valueAtKey_4 = DesignScript.Builtin.Dictionary.ValueAtKey(dictionary=map_3, key=code_block_19)
byKeysValues_4 = DesignScript.Builtin.Dictionary.ByKeysValues()  # unwired: keys, values
byKeysValues_5 = DesignScript.Builtin.Dictionary.ByKeysValues(keys=code_block_16, values=faces)
code_block_20 = CodeBlock { "srfs"; }
setValueAtKeys_3 = DesignScript.Builtin.Dictionary.SetValueAtKeys(keys=code_block_20, lacing=Shortest)  # unwired: dictionary, values
map_4 = List.Map()  # unwired: list, function
function_compose_2 = ComposeFunctions(function0=setValueAtKeys_3, function1=map_4)
map_5 = List.Map(list=setValueAtKeys, function=function_compose_2)
code_block_21 = CodeBlock { "srfs"; }
byKeysValues_6 = DesignScript.Builtin.Dictionary.ByKeysValues(keys=code_block_21)  # unwired: values
map_6 = List.Map(list=faces, function=byKeysValues_6)
