# Dynamo graph dictionary 활용_거푸집_리팩토링후.dyn (Dynamo 2.13.1.3887)

code_block = CodeBlock { {}; }
code_block_2 = CodeBlock { "elem"; }  # frozen

# group: dictionary 속성 추가
mkNewDict = Python(IN[0]=code_block, IN[1]=code_block_2)  # CPython3; unwired: IN[2]
# ---------- mkNewDict.python (32 lines) ----------
# Load the Python Standard and DesignScript Libraries
import sys
import clr
clr.AddReference('ProtoGeometry')
from Autodesk.DesignScript.Geometry import *

# The inputs to this node will be stored as a list in the IN variables.
dataEnteringNode = IN

preDicts = IN[0]
newKey = IN[1]
newValues = IN[2]

# Place your code below this line

def mkNewDicts(preDicts, newKey, newValues):
    if preDicts == {}:
        preDicts = []
        list(map(lambda x: preDicts.append({}), newValues))
    else:
        pass

    dict_valuePairs = zip(preDicts, newValues)
    
    def mkNewDict(_dict, _key, _value):
        _dict[_key] = _value
        return _dict
    
    result = map(lambda x: mkNewDict(x[0], newKey, x[1]), dict_valuePairs)
    return result
# Assign your output to the OUT variable.
OUT = mkNewDicts(preDicts, newKey, newValues)
# ----------------------------------------

code_block_3 = CodeBlock { {}; }
code_block_4 = CodeBlock { "elem"; }
categories = Categories("OST_Walls")
all_elements_of_category = ElementsOfCategory(Category=categories)
code_block_5 = CodeBlock { "Type"; }
getParameterValueByName = Element.GetParameterValueByName(element=all_elements_of_category, parameterName=code_block_5)
code_block_6 = CodeBlock { "Type Name"; }
getParameterValueByName_2 = Element.GetParameterValueByName(element=getParameterValueByName, parameterName=code_block_6)
groupByKey = List.GroupByKey(list=all_elements_of_category, keys=getParameterValueByName_2)
code_block_7 = CodeBlock(i=groupByKey.groups) { i[7]; }

# group: dictionary 속성 추가
list_create = List.Create()  # unwired: item0
map = List.Map(list=code_block_7, function=list_create)
setValueAtKeys = DesignScript.Builtin.Dictionary.SetValueAtKeys(dictionary=code_block_3, keys=code_block_4, values=map, lacing=Longest)
flatten = List.Flatten(list=setValueAtKeys)

code_block_8 = CodeBlock(preDict=flatten) { preDict; }
code_block_9 = CodeBlock { "area"; }
values = DesignScript.Builtin.Dictionary.Values(dictionary=code_block_8)
code_block_10 = CodeBlock { "Area"; }
getParameterValueByName_3 = Element.GetParameterValueByName(element=values, parameterName=code_block_10)
flatten_2 = List.Flatten(list=getParameterValueByName_3)

# group: dictionary 속성 추가
list_create_2 = List.Create()  # unwired: item0
map_2 = List.Map(list=flatten_2, function=list_create_2)
setValueAtKeys_2 = DesignScript.Builtin.Dictionary.SetValueAtKeys(dictionary=code_block_8, keys=code_block_9, values=map_2, lacing=Longest)
flatten_3 = List.Flatten(list=setValueAtKeys_2)

code_block_11 = CodeBlock(preDict=flatten_3) { preDict; }
code_block_12 = CodeBlock { "srfs"; }
code_block_13 = CodeBlock { "elem"; }
valueAtKey = DesignScript.Builtin.Dictionary.ValueAtKey(dictionary=code_block_11, key=code_block_13)
faces = Element.Faces(element=valueAtKey)

# group: dictionary 속성 추가
list_create_3 = List.Create()  # unwired: item0
map_3 = List.Map(list=faces, function=list_create_3)
setValueAtKeys_3 = DesignScript.Builtin.Dictionary.SetValueAtKeys(dictionary=code_block_11, keys=code_block_12, values=map_3@L3, lacing=Longest)
flatten_4 = List.Flatten(list=setValueAtKeys_3)

code_block_14 = CodeBlock(preDict=flatten_4) { preDict; }
code_block_15 = CodeBlock { "side srfs"; }
code_block_16 = CodeBlock { "srfs"; }
valueAtKey_2 = DesignScript.Builtin.Dictionary.ValueAtKey(dictionary=code_block_14, key=code_block_16)

# group: 합성 함수 for side faces_boolmask
code_block_17 = CodeBlock { 0.5; }
normalAtParameter = Surface.NormalAtParameter(u=code_block_17, v=code_block_17)  # unwired: surface
Z = Vector.Z()  # unwired: vector
abs = Math.Abs()  # unwired: number
code_block_18 = CodeBlock { 1; }
ne = _ != code_block_18  # unwired: x
function_compose = ComposeFunctions(function0=normalAtParameter, function1=Z, function2=abs, function3=ne)

map_4 = List.Map(list=valueAtKey_2, function=function_compose)
filterByBoolMask = List.FilterByBoolMask(list=valueAtKey_2, mask=map_4)

# group: dictionary 속성 추가
list_create_4 = List.Create()  # unwired: item0
map_5 = List.Map(list=filterByBoolMask.in, function=list_create_4)
setValueAtKeys_4 = DesignScript.Builtin.Dictionary.SetValueAtKeys(dictionary=code_block_14, keys=code_block_15, values=map_5@L3, lacing=Longest)

code_block_19 = CodeBlock(preDict=setValueAtKeys_4) { preDict; }
code_block_20 = CodeBlock { "form panel"; }
code_block_21 = CodeBlock { "side srfs"; }
valueAtKey_3 = DesignScript.Builtin.Dictionary.ValueAtKey(dictionary=code_block_19, key=code_block_21)
code_block_22 = CodeBlock { 50; }
code_block_23 = CodeBlock { false; }
thicken = Surface.Thicken(surface=valueAtKey_3, thickness=code_block_22, both_sides=code_block_23)

# group: dictionary 속성 추가
mkNewDict_2 = Python(IN[0]=code_block_19, IN[1]=code_block_20, IN[2]=thicken)  # CPython3; same code as mkNewDict

code_block_24 = CodeBlock(preDict=mkNewDict_2) { preDict; }
code_block_25 = CodeBlock { "form panel outface"; }
code_block_26 = CodeBlock { "side srfs"; }
valueAtKey_4 = DesignScript.Builtin.Dictionary.ValueAtKey(dictionary=code_block_24, key=code_block_26)
code_block_27 = CodeBlock { 0.5; }
normalAtParameter_2 = Surface.NormalAtParameter(surface=valueAtKey_4, u=code_block_27, v=code_block_27)
code_block_28 = CodeBlock { 100; }
translate = Geometry.Translate(geometry=valueAtKey_4, direction=normalAtParameter_2, distance=code_block_28)

# group: dictionary 속성 추가
mkNewDict_3 = Python(IN[0]=code_block_24, IN[1]=code_block_25, IN[2]=translate)  # CPython3; same code as mkNewDict

code_block_29 = CodeBlock(preDict=mkNewDict_3) { preDict; }
code_block_30 = CodeBlock { "pipe_h"; }
code_block_31 = CodeBlock { "form panel outface"; }
valueAtKey_5 = DesignScript.Builtin.Dictionary.ValueAtKey(dictionary=code_block_29, key=code_block_31)
code_block_32 = CodeBlock { 0.1..0.9..0.2; }
code_block_33 = CodeBlock { 0..1; }
pointAtParameter = Surface.PointAtParameter(surface=valueAtKey_5, u=code_block_32, v=code_block_33, lacing=CrossProduct)
transpose = List.Transpose(lists=pointAtParameter@@L3)
firstItem = List.FirstItem(list=transpose@@L2)
lastItem = List.LastItem(list=transpose@@L2)
byStartPointEndPoint = Line.ByStartPointEndPoint(startPoint=firstItem, endPoint=lastItem)
startPoint = Curve.StartPoint(curve=byStartPointEndPoint)
direction = Line.Direction(line=byStartPointEndPoint)
byOriginNormal = Plane.ByOriginNormal(origin=startPoint, normal=direction)
code_block_34 = CodeBlock { 50; }
byPlaneRadius = Circle.ByPlaneRadius(plane=byOriginNormal, radius=code_block_34)
bySweep = Solid.BySweep(profile=byPlaneRadius, path=byStartPointEndPoint)

# group: dictionary 속성 추가
mkNewDict_4 = Python(IN[0]=code_block_29, IN[1]=code_block_30, IN[2]=bySweep)  # CPython3; same code as mkNewDict

code_block_35 = CodeBlock(preDict=mkNewDict_4) { preDict; }
code_block_36 = CodeBlock { "pipe_v"; }
code_block_37 = CodeBlock { "form panel outface"; }
valueAtKey_6 = DesignScript.Builtin.Dictionary.ValueAtKey(dictionary=code_block_35, key=code_block_37)
normalAtParameter_3 = Surface.NormalAtParameter(surface=valueAtKey_6)
code_block_38 = CodeBlock { 100; }
translate_2 = Geometry.Translate(geometry=valueAtKey_6, direction=normalAtParameter_3, distance=code_block_38)
code_block_39 = CodeBlock { 0..1; }
code_block_40 = CodeBlock { 0.1..0.9..0.4; }
pointAtParameter_2 = Surface.PointAtParameter(surface=translate_2, u=code_block_39, v=code_block_40, lacing=CrossProduct)
transpose_2 = List.Transpose(lists=pointAtParameter_2@@L4)
firstItem_2 = List.FirstItem(list=transpose_2@@L3)
lastItem_2 = List.LastItem(list=transpose_2@@L3)
byStartPointEndPoint_2 = Line.ByStartPointEndPoint(startPoint=firstItem_2, endPoint=lastItem_2)
startPoint_2 = Curve.StartPoint(curve=byStartPointEndPoint_2)
direction_2 = Line.Direction(line=byStartPointEndPoint_2)
byOriginNormal_2 = Plane.ByOriginNormal(origin=startPoint_2, normal=direction_2)
code_block_41 = CodeBlock { 50; }
byPlaneRadius_2 = Circle.ByPlaneRadius(plane=byOriginNormal_2, radius=code_block_41)
bySweep_2 = Solid.BySweep(profile=byPlaneRadius_2, path=byStartPointEndPoint_2)

# group: dictionary 속성 추가
mkNewDict_5 = Python(IN[0]=code_block_35, IN[1]=code_block_36, IN[2]=bySweep_2)  # CPython3; same code as mkNewDict

code_block_42 = CodeBlock(preDict=mkNewDict_5) { preDict; }
integer_slider = IntegerSlider(4, range=0..9 step 1)
code_block_43 = CodeBlock(i=code_block_42, j=integer_slider) { i[j]; }
code_block_44 = CodeBlock { "pipe_h"; }
valueAtKey_7 = DesignScript.Builtin.Dictionary.ValueAtKey(dictionary=code_block_43, key=code_block_44)
code_block_45 = CodeBlock { "pipe_v"; }
valueAtKey_8 = DesignScript.Builtin.Dictionary.ValueAtKey(dictionary=code_block_43, key=code_block_45)
code_block_46 = CodeBlock { "form panel"; }
valueAtKey_9 = DesignScript.Builtin.Dictionary.ValueAtKey(dictionary=code_block_43, key=code_block_46)
code_block_47 = CodeBlock { 120; }
byARGB = Color.ByARGB(alpha=code_block_47, red=code_block_47, blue=code_block_47)
byGeometryColor = Modifiers.GeometryColor.ByGeometryColor(geometry=valueAtKey_9, color=byARGB)

# group: dictionary 속성 추가
list_create_5 = List.Create()  # unwired: item0
map_6 = List.Map(function=list_create_5)  # unwired: list
setValueAtKeys_5 = DesignScript.Builtin.Dictionary.SetValueAtKeys(values=map_6@L3, lacing=Longest)  # unwired: dictionary, keys
flatten_5 = List.Flatten(list=setValueAtKeys_5)
