# Dynamo graph dictionaryNode.dyn (Dynamo 2.13.1.3887)

code_block = CodeBlock()
# ---------- code_block.designscript (3 lines) ----------
["key1",
"key2",
"key3"];
# ----------------------------------------
code_block_2 = CodeBlock()
# ---------- code_block_2.designscript (3 lines) ----------
["value1",
"value2",
"value3"];
# ----------------------------------------
byKeysValues = DesignScript.Builtin.Dictionary.ByKeysValues(keys=code_block, values=code_block_2)
code_block_3 = CodeBlock { "key1"; }
removeKeys = DesignScript.Builtin.Dictionary.RemoveKeys(dictionary=byKeysValues, keys=code_block_3)
code_block_4 = CodeBlock { "key4"; }
code_block_5 = CodeBlock { "value4"; }
setValueAtKeys = DesignScript.Builtin.Dictionary.SetValueAtKeys(dictionary=byKeysValues, keys=code_block_4, values=code_block_5)
