# Dynamo graph 20211201_webrequest test.dyn (Dynamo 2.10.1.3976)

string = StringInput("https://raw.githubusercontent.com/HNANmal/mQ/master/Laboratory/20211123_%EC%9E%85%EC%B0%B0%EC%9E%90%EB%8F%99%ED%99%94%ED%88%B4Test%20Sample/test.py")
web_request = WebRequest(url=string)
file_path = Filename("D:\mk\mQ\Laboratory\20211123_입찰자동화툴Test Sample\01_Building List_Pilot Project_2021_1124.xlsx")
code_block = CodeBlock { "Building List"; }
python_script_from_string = PythonStringNode(script=web_request, IN[0]=file_path, IN[1]=code_block)  # CPython3
