# Dynamo graph importExcel.dyn (Dynamo 2.12.0.5650)

file_path = Filename(".\02_팀 표준 Family List_Rev.0_2022_0215.xlsx")
code_block = CodeBlock { "1.Floor"; "2.Roof"; "3.Wall"; }
full_data = Python(IN[0]=file_path, IN[1]=code_block.out2)  # CPython3
# ---------- full_data.python (88 lines) ----------
# Load the Python Standard and DesignScript Libraries
import os
python_rootpath = os.getenv('LOCALAPPDATA')+'\Programs\Python'
file_list = os.listdir(python_rootpath)
python_version = file_list[-1]
import sys
sys.path.append(os.getenv('LOCALAPPDATA').replace('\\','\\\\') + f'\Programs\Python\{python_version}\Lib\site-packages')
import clr


clr.AddReference('ProtoGeometry')
from Autodesk.DesignScript.Geometry import *

import random

from collections import Iterable
import datetime
import openpyxl

from itertools import chain
from functools import reduce

curry = lambda f: lambda a,*args: f(a, *args) if (len(args)) else lambda *args: f(a, *args)

add = curry(lambda a,b: a + b)

filter = curry(filter)
map = curry(map)

def _take(length, iter):
    res = []
    for a in iter:
        res.append(a)
        if len(res) == length:
            return res
take = curry(_take)
reduce = curry(reduce)
go = lambda *args: reduce(lambda a,f: f(a), args)

# The inputs to this node will be stored as a list in the IN variables.
dataEnteringNode = IN
inputFilePath = IN[0]
inputSheetName = IN[1]

def importExcel(path, SheetNameIn):
    wb_obj = openpyxl.load_workbook(str(path), data_only=True)
    sheet_obj = wb_obj.get_sheet_by_name(str(SheetNameIn))

    m_row = sheet_obj.max_row
    m_col = sheet_obj.max_column

    listOut = []

    for i in range(1, m_row +1):
        listTemp = []
        for j in range(1, m_col + 1):
            cell_obj = sheet_obj.cell(row=i, column=j)
            listTemp.append(cell_obj.value)
            if len(listTemp) == m_col:
                listOut.append(listTemp)
    return listOut

def checkAllElement(list, target):
    tmp=[]
    for i in list:
        if i == target:
            tmp.append(True)
        else:
            tmp.append(False)
    return all(tmp)

# Place your code below this line
rm_Null = lambda list: go(list,
    filter(lambda a: not checkAllElement(a, None)),
    )
    
s1 = importExcel(inputFilePath, inputSheetName)

s2 = rm_Null(s1)  ## null만 있는 Excel Row 제거

s2_tr = list(zip(*s2))

s3 = rm_Null(s2_tr) ## null만 있는 Excel Column 제거

result = list(zip(*s3))

# Assign your output to the OUT variable.
OUT = result
# ----------------------------------------
outside_cuttng = Python(IN[0]=full_data)  # CPython3
# ---------- outside_cuttng.python (62 lines) ----------
# Python 표준 및 DesignScript 라이브러리 로드
import sys
import clr
clr.AddReference('ProtoGeometry')
from Autodesk.DesignScript.Geometry import *

from itertools import chain
from functools import reduce

curry = lambda f: lambda a,*args: f(a, *args) if (len(args)) else lambda *args: f(a, *args)

add = curry(lambda a,b: a + b)

filter = curry(filter)
map = curry(map)

def _take(length, iter):
    res = []
    for a in iter:
        res.append(a)
        if len(res) == length:
            return res
take = curry(_take)
reduce = curry(reduce)
go = lambda *args: reduce(lambda a,f: f(a), args)
# 이 노드에 대한 입력값은 IN 변수에 리스트로 저장됩니다.
dataEnteringNode = IN

datas = IN[0]

# 코드를 이 선 아래에 배치
def vld(a):
    try: return a
    except: return ""
        
def findstartpt(datas):
    res = []    
    for i in enumerate(datas):
        for j in enumerate(i[1]):
            cell = vld(j[1])
            try:
                if "[" in cell or "]" in cell: ### 동작하려면 엑셀의 시트 제목이 []를 포함해야함
                    res.append((i[0],j[0]))
            except: pass

    return res[0]

startpt = findstartpt(datas)

def outcut(datas):
    s1 = datas[startpt[0]+1:]
    s2 = list(map(lambda a: a[startpt[1]:], s1))
    
    return s2

#head = lambda list: go(list,
#    filter(lambda a: chck_heads(a)),
#    )
    
result = outcut(datas)
# 출력을 OUT 변수에 지정합니다.
OUT = result
# ----------------------------------------
inside_slicing = Python(IN[0]=outside_cuttng)  # CPython3
# ---------- inside_slicing.python (127 lines) ----------
# Python 표준 및 DesignScript 라이브러리 로드
import sys
import clr
clr.AddReference('ProtoGeometry')
from Autodesk.DesignScript.Geometry import *

from itertools import chain
from functools import reduce
import re


curry = lambda f: lambda a,*args: f(a, *args) if (len(args)) else lambda *args: f(a, *args)

add = curry(lambda a,b: a + b)

filter = curry(filter)
map = curry(map)

def _take(length, iter):
    res = []
    for a in iter:
        res.append(a)
        if len(res) == length:
            return res
take = curry(_take)
reduce = curry(reduce)
go = lambda *args: reduce(lambda a,f: f(a), args)

# 이 노드에 대한 입력값은 IN 변수에 리스트로 저장됩니다.
dataEnteringNode = IN

datas = IN[0]
headers = datas[0]
# 코드를 이 선 아래에 배치
def vld(a):
    try: return a
    except: return ""

def findlv(regex, a):
    p = re.match(regex, str(a))
    return p
        
def idxByTitle(headers, title):
    chk = lambda list: go(list,
        filter(lambda a: title in a),
        map(lambda a: list.index(a)),
        )
    colidx = list(chk(headers))[0]
    
    return colidx

chk_regex = lambda regex: lambda a: re.match(regex, str(a))

def inslice(datas, n, lv):
    std = {
        "lv1": "\d{0,5}$",
        "lv2": "\d{0,5}[.]\d$",
        "lv3": "\d{0,5}[.]\d[.]\d$",
        "lv4": "\d{0,5}[.]\d[.]\d[.]\d$",
        "Ftype": "^\w{2,3}\d\d[^0]"
    }
    
    idx = idxByTitle(datas, "NO")
    df = datas[1:]
    df_0 = list(map(lambda a: a[0], df))
    df_1 = list(map(lambda a: a[1], df))
    df_n = list(map(lambda a: a[n], df))
    df_n_1 = list(map(lambda a: a[n+1], df))
    
    #chk = lambda regex: lambda a: re.match(regex, str(a))
    
    def sliceRowByLevel(df, n, lv):
        df_n = list(map(lambda a: a[n], df))
        df_n_1 = list(map(lambda a: a[n+1], df))
        RowIdx = []
        res = []
        for a in enumerate(df_n):
            if chk_regex(std[lv])(a[1]):
                RowIdx.append(a[0])
        if len(RowIdx) > 1:
            for i,v in enumerate(RowIdx):
                if i < len(RowIdx)-1:
                    res.append((v, RowIdx[i+1]-1))
                elif i == len(RowIdx)-1:
                    res.append((RowIdx[i], len(df_n)))
        elif len(RowIdx) == 1:
            res.append((RowIdx[0],len(df_n)))
        return res
    slcIdx = sliceRowByLevel(df, n, lv)
    
    result = {}
    
    for a in slcIdx:
        lv_Name = str(df_n[a[0]])
        if a[0] != a[1]:
            result[lv_Name] = df[a[0]:a[1]+1]
        else:
            result[lv_Name] = df[a[0]:a[1]+1]
    
    return result
    
byLv1 = inslice(datas, 0, "lv1")
_byFamilyType = inslice(datas, 2, "Ftype")

byFamilyType = {}
for a in _byFamilyType:
    if len(_byFamilyType[a]) > 1:
        tmp = [_byFamilyType[a][0]]
        for b in range(1, len(_byFamilyType[a])):
            if _byFamilyType[a][b][3] != None:
                tmp.append(_byFamilyType[a][b])
    else: tmp = [_byFamilyType[a][0]]
    
    byFamilyType[a] = tmp

wmidx = idxByTitle(datas, "Work Master Code")



#head = lambda list: go(list,
#    filter(lambda a: chck_heads(a)),
#    )


result = byFamilyType
# 출력을 OUT 변수에 지정합니다.
OUT = (headers,result)
# ----------------------------------------
dict_forming = Python(IN[0]=inside_slicing)  # CPython3
# ---------- dict_forming.python (85 lines) ----------
# Python 표준 및 DesignScript 라이브러리 로드
import sys
import clr
clr.AddReference('ProtoGeometry')
from Autodesk.DesignScript.Geometry import *

from itertools import chain
from functools import reduce
import re


curry = lambda f: lambda a,*args: f(a, *args) if (len(args)) else lambda *args: f(a, *args)

add = curry(lambda a,b: a + b)

filter = curry(filter)
map = curry(map)

def _take(length, iter):
    res = []
    for a in iter:
        res.append(a)
        if len(res) == length:
            return res
take = curry(_take)
reduce = curry(reduce)
go = lambda *args: reduce(lambda a,f: f(a), args)

# 이 노드에 대한 입력값은 IN 변수에 리스트로 저장됩니다.
dataEnteringNode = IN

dicts = IN[0][1]
headers = IN[0][0]
# 코드를 이 선 아래에 배치
def vld(a):
    try: return a
    except: return ""

def findlv(regex, a):
    p = re.match(regex, str(a))
    return p
        
def idxByTitle(headers, title):
    chk = lambda list: go(list,
        filter(lambda a: title in a),
        map(lambda a: list.index(a)),
        )
    colidx = list(chk(headers))[0]
    
    return colidx

chk_regex = lambda regex: lambda a: re.match(regex, str(a))


## 패밀리 타입 하나당 종속된 워크마스터 짝짓는 코드
def findWM(nlist, headers):
    wmidx = idxByTitle(headers, "Work Master Code")
    L1idx = idxByTitle(headers, "Work Category-L1")
    Spec9idx = idxByTitle(headers, "BOQ Spec9")
    
    res =[]
    for a in nlist:
        if chk_regex("^\w\d{2}")(a[wmidx]):
            wmCode = a[wmidx]
            _wmDesc = list(filter(lambda y: y != '0', map(lambda x: str(x), a[L1idx:Spec9idx])))
            wmDesc = '(' +a[wmidx+1]+ ')_' + " ".join(_wmDesc)
            wm = wmCode +": "+ wmDesc
            res.append(wm)
    return res

def mkDict(dicts):
    res = {}
    for k,v in dicts.items():
        wms = findWM(v, headers)
        res[k] = wms
    return res

#head = lambda list: go(list,
#    filter(lambda a: chck_heads(a)),
#    )


result = mkDict(dicts)
# 출력을 OUT 변수에 지정합니다.
OUT = result
# ----------------------------------------
watch = Watch(dict_forming)
python_script = Python(IN[0]=full_data)  # CPython3
# ---------- python_script.python (50 lines) ----------
# Python 표준 및 DesignScript 라이브러리 로드
import sys
import clr
clr.AddReference('ProtoGeometry')
from Autodesk.DesignScript.Geometry import *

from itertools import chain
from functools import reduce

curry = lambda f: lambda a,*args: f(a, *args) if (len(args)) else lambda *args: f(a, *args)

add = curry(lambda a,b: a + b)

filter = curry(filter)
map = curry(map)

def _take(length, iter):
    res = []
    for a in iter:
        res.append(a)
        if len(res) == length:
            return res
take = curry(_take)
reduce = curry(reduce)
go = lambda *args: reduce(lambda a,f: f(a), args)
# 이 노드에 대한 입력값은 IN 변수에 리스트로 저장됩니다.
dataEnteringNode = IN

datas = IN[0]

# 코드를 이 선 아래에 배치
def chck_heads(row):
    def chck(a):
        try: 
            if "NO" in a: return True
            else: return False
        except: return False

    blns = lambda list: go(list,
        map(lambda a: chck(a)))
    return any(blns(row))
    

head = lambda list: go(list,
    filter(lambda a: chck_heads(a)),
    )
    
res = list(head(datas))[0]
# 출력을 OUT 변수에 지정합니다.
OUT = res
# ----------------------------------------
code_block_2 = CodeBlock()
# ---------- code_block_2.designscript (7 lines) ----------
//Out Cutting

//데이터 시작점 파악

//불필요 칼럼 제외

//[Family List] 식별
# ----------------------------------------
code_block_3 = CodeBlock()  # //전체가 Null 인것 제외
