# Dynamo graph midasSample_mxt_parsing_0523.dyn (Dynamo 2.12.0.5650)

# group: case2: csv format import
midasgen_excel_mxt_file_path = Filename(".\Midas_Sample.xlsx")
sheet_name = StringInput("Sample_Structure_Report")
initial_data_import = Python(IN[0]=midasgen_excel_mxt_file_path, IN[1]=sheet_name)  # CPython3; frozen
# ---------- initial_data_import.python (95 lines) ----------
# Load the Python Standard and DesignScript Libraries
import os
import sys
import re
import clr

python_rootpath = os.getenv('LOCALAPPDATA')+'\Programs\Python'
python_dir_list = os.listdir(python_rootpath)

p = re.compile('Python\d{2,5}')
version_list = list(filter(lambda x: p.match(x), python_dir_list))
version_num = list(map(lambda x: int(x[7:]), version_list))
latest_idx= version_num.index(max(version_num))

python_version = version_list[latest_idx]

sys.path.append(os.getenv('LOCALAPPDATA').replace('\\','\\\\') + f'\Programs\Python\{python_version}\Lib\site-packages')

clr.AddReference('ProtoGeometry')
from Autodesk.DesignScript.Geometry import *

from collections import Iterable
import datetime
import openpyxl

from itertools import chain
from functools import reduce

curry = lambda f: lambda a,*args: f(a, *args) if (len(args)) else lambda *args: f(a, *args)

add = curry(lambda a,b: a + b)

filter = curry(filter)
map = curry(map)

def _take(length, iter):
    res = []
    for a in iter:
        res.append(a)
        if len(res) == length:
            return res
take = curry(_take)
reduce = curry(reduce)
go = lambda *args: reduce(lambda a,f: f(a), args)

# The inputs to this node will be stored as a list in the IN variables.
dataEnteringNode = IN
inputFilePath = IN[0]
inputSheetName = IN[1]

# Place your code below this line

def importExcel(path, SheetNameIn):
    wb_obj = openpyxl.load_workbook(str(path), data_only=True)
    sheet_obj = wb_obj.get_sheet_by_name(str(SheetNameIn))

    m_row = sheet_obj.max_row
    m_col = sheet_obj.max_column

    listOut = []

    for i in range(1, m_row +1):
        listTemp = []
        for j in range(1, m_col + 1):
            cell_obj = sheet_obj.cell(row=i, column=j)
            listTemp.append(cell_obj.value)
            if len(listTemp) == m_col:
                listOut.append(listTemp)
    return listOut

def checkAllElement(list, target):
    tmp=[]
    for i in list:
        if i == target:
            tmp.append(True)
        else:
            tmp.append(False)
    return all(tmp)

rm_Null = lambda list: go(list,
    filter(lambda a: not checkAllElement(a, None)),
    )

s1 = importExcel(inputFilePath, inputSheetName)

s2 = rm_Null(s1)  ## null만 있는 Excel Row 제거

result_tr = list(zip(*s2))

s3 = rm_Null(result_tr) ## null만 있는 Excel Column 제거

result = list(zip(*s3))

# Assign your output to the OUT variable.
OUT = result
# ----------------------------------------

# group: case1: mxt format import
midasgen_mxt_file_path = Filename(".\Ulsan_STB_Steel_New_BOQ.mxt")  # graph input
boolean = BoolSelector(true)
importCSV = Data.ImportCSV(filePath=midasgen_mxt_file_path, transpose=boolean)
remove_null_row_column = Python(IN[0]=importCSV)  # CPython3
# ---------- remove_null_row_column.python (73 lines) ----------
# Load the Python Standard and DesignScript Libraries
import os
import sys
import re
import clr

#python_rootpath = os.getenv('LOCALAPPDATA')+'\Programs\Python'
#python_dir_list = os.listdir(python_rootpath)
#
#p = re.compile('Python\d{2,5}')
#version_list = list(filter(lambda x: p.match(x), python_dir_list))
#version_num = list(map(lambda x: int(x[7:]), version_list))
#latest_idx= version_num.index(max(version_num))
#
#python_version = version_list[latest_idx]
#
#sys.path.append(os.getenv('LOCALAPPDATA').replace('\\','\\\\') + f'\Programs\Python\{python_version}\Lib\site-packages')

clr.AddReference('ProtoGeometry')
from Autodesk.DesignScript.Geometry import *

from collections import Iterable
import datetime
#import openpyxl

from itertools import chain
from functools import reduce

curry = lambda f: lambda a,*args: f(a, *args) if (len(args)) else lambda *args: f(a, *args)

add = curry(lambda a,b: a + b)

filter = curry(filter)
map = curry(map)

def _take(length, iter):
    res = []
    for a in iter:
        res.append(a)
        if len(res) == length:
            return res
take = curry(_take)
reduce = curry(reduce)
go = lambda *args: reduce(lambda a,f: f(a), args)

# The inputs to this node will be stored as a list in the IN variables.
dataEnteringNode = IN
inputData = IN[0]
# Place your code below this line
def checkAllElement(list, target):
    tmp=[]
    for i in list:
        if i == target:
            tmp.append(True)
        else:
            tmp.append(False)
    return all(tmp)

rm_Null = lambda list: go(list,
    filter(lambda a: not checkAllElement(a, None)),
    )

s1 = inputData

s2 = rm_Null(s1)  ## null만 있는 Excel Row 제거

result_tr = list(zip(*s2))

s3 = rm_Null(result_tr) ## null만 있는 Excel Column 제거

result = list(zip(*s3))
# Assign your output to the OUT variable.
OUT = result
# ----------------------------------------

code_block = CodeBlock { "*"; }
find_identifier_row_idx = Python(IN[0]=remove_null_row_column, IN[1]=code_block)  # CPython3
# ---------- find_identifier_row_idx.python (37 lines) ----------
# Load the Python Standard and DesignScript Libraries
import sys
import clr
clr.AddReference('ProtoGeometry')
from Autodesk.DesignScript.Geometry import *
from functools import reduce

# The inputs to this node will be stored as a list in the IN variables.
dataEnteringNode = IN

input = IN[0]
idf = IN[1]
# Place your code below this line

def find_tgrow_idx(tglst, idf, mode):
    if mode == "sttwith":
        def chck_identifier(x, idf):
            eres = str(x).startswith("['" + idf)
            return eres
            
    elif mode == "incld":
        def chck_identifier(x, idf):
            eres = str(x).find(idf)
            if eres >= 0:
                return True
            else:
                return False
        
    
    bln_res = list(map(lambda x: chck_identifier(x,idf), tglst))
    result = [i for i, x in enumerate(bln_res) if x]
    return result


result = find_tgrow_idx(input, idf, "sttwith")
# Assign your output to the OUT variable.
OUT = result
# ----------------------------------------
code_block_2 = CodeBlock { -1; }
dropItems = List.DropItems(list=find_identifier_row_idx, amount=code_block_2)
code_block_3 = CodeBlock { 0; }
splitdataasdict_불필요null_제거 = Python(IN[0]=remove_null_row_column, IN[1]=dropItems, IN[2]=code_block_3)  # CPython3
# ---------- splitdataasdict_불필요null_제거.python (72 lines) ----------
# Load the Python Standard and DesignScript Libraries
import sys
import clr
clr.AddReference('ProtoGeometry')
from Autodesk.DesignScript.Geometry import *
from functools import reduce

curry = lambda f: lambda a,*args: f(a, *args) if (len(args)) else lambda *args: f(a, *args)

add = curry(lambda a,b: a + b)

filter = curry(filter)
map = curry(map)

def _take(length, iter):
    res = []
    for a in iter:
        res.append(a)
        if len(res) == length:
            return res
take = curry(_take)
reduce = curry(reduce)
go = lambda *args: reduce(lambda a,f: f(a), args)

def checkAllElement(list, target):
    tmp=[]
    for i in list:
        if i == target:
            tmp.append(True)
        else:
            tmp.append(False)
    return all(tmp)

rm_Null = lambda list: go(list,
    filter(lambda a: not checkAllElement(a, None)),
    )

# The inputs to this node will be stored as a list in the IN variables.
dataEnteringNode = IN

input = IN[0]
split_idx = IN[1]
key_idx = IN[2]

# Place your code below this line
def splitDataAsDict(split_idx, data, key_idx):

    def calc_range(split_idx):
        res = []
        for i,x in enumerate(split_idx):
            if i < len(split_idx)-1:
                res.append((x, split_idx[i+1]))
            else:
                res.append((x, len(input)))
        return res
    
    range = calc_range(split_idx)

    result = []
    dic = {}
    for x in range:
        key = str(data[x[0]][key_idx]).split('    ;')[0]
        val1 = data[x[0]+1:x[1]]
        val_tr = list(zip(*val1))
        val = list(zip(*rm_Null(val_tr)))
        dic[str(key)] = val
    return dic

result = splitDataAsDict(split_idx, input, key_idx)

# Assign your output to the OUT variable.
OUT = result
# ----------------------------------------
keys = DesignScript.Builtin.Dictionary.Keys(dictionary=splitdataasdict_불필요null_제거)

# group: NODE inform select
code_block_4 = CodeBlock { "NODE"; }
inform_select = Python(IN[0]=splitdataasdict_불필요null_제거, IN[1]=code_block_4)  # CPython3
# ---------- inform_select.python (22 lines) ----------
# Load the Python Standard and DesignScript Libraries
import sys
import clr
clr.AddReference('ProtoGeometry')
from Autodesk.DesignScript.Geometry import *

# The inputs to this node will be stored as a list in the IN variables.
dataEnteringNode = IN
inputDic = IN[0]
keyStr = IN[1]

# Place your code below this line

def informSelect(inputDic, keyStr):
    titles = inputDic.keys()
    res = filter(lambda x: keyStr in x, titles)
    targetKey = list(res)[0]
    return inputDic[targetKey]

result = informSelect(inputDic, keyStr)
# Assign your output to the OUT variable.
OUT = result
# ----------------------------------------

removeHeadFromDict = Python(IN[0]=inform_select)  # CPython3
# ---------- removeHeadFromDict.python (39 lines) ----------
# Load the Python Standard and DesignScript Libraries
import sys
import clr
clr.AddReference('ProtoGeometry')
from Autodesk.DesignScript.Geometry import *
from functools import reduce

# The inputs to this node will be stored as a list in the IN variables.
dataEnteringNode = IN

input = IN[0]

# Place your code below this line

def find_tgrow_idx(tglst, idf):

    def chck_identifier(tglst, idf):
        eres = list(map(lambda x: str(x).find(idf), tglst)) 
        res = reduce(lambda a,b: a*b, eres)
        if res == 0:
            return True
    
    bln_res = list(map(lambda x: chck_identifier(x,idf), tglst))
    result = [i for i, x in enumerate(bln_res) if x == True]
    return result

def removeHeadFromDict(tglst, idf):
    result = []
    del_idx = find_tgrow_idx(tglst,idf)
    for i,x in enumerate(tglst):
        if i in del_idx:
            pass
        else:
            result.append(x)
    return result

result = removeHeadFromDict(input,';')
# Assign your output to the OUT variable.
OUT = result
# ----------------------------------------
원점정하고_좌표계변환_단위_m_mm = Python(IN[0]=removeHeadFromDict)  # CPython3
# ---------- 원점정하고_좌표계변환_단위_m_mm.python (34 lines) ----------
# Load the Python Standard and DesignScript Libraries
import sys
import clr
clr.AddReference('ProtoGeometry')
from Autodesk.DesignScript.Geometry import *

# The inputs to this node will be stored as a list in the IN variables.
dataEnteringNode = IN
input = IN[0]

# Place your code below this line
def findOrigin(pts):
    origin = pts[0]
    
    ori_ptX = origin[1]
    ori_ptY = origin[2]
    ori_pyZ = origin[3]
    origin = (ori_ptX, ori_ptY, ori_pyZ)
    
    return origin

def trnslt_pt(pts, origin):
    def set_trPt(pt):
        res = (pt[0], pt[1]-origin[0], pt[2]-origin[1], pt[3]-origin[2])
        return res
        
    result = list(map(lambda x: set_trPt(x), pts))
    return result

origin = findOrigin(input)
result = trnslt_pt(input, origin)

# Assign your output to the OUT variable.
OUT = result
# ----------------------------------------
다이나모_포인트로_변환_및_딕셔너리화 = Python(IN[0]=원점정하고_좌표계변환_단위_m_mm)  # CPython3
# ---------- 다이나모_포인트로_변환_및_딕셔너리화.python (26 lines) ----------
# Load the Python Standard and DesignScript Libraries
import sys
import clr
clr.AddReference('ProtoGeometry')
from Autodesk.DesignScript.Geometry import *

# The inputs to this node will be stored as a list in the IN variables.
dataEnteringNode = IN
input = IN[0]
# Place your code below this line
def mkPoints(pts):
    dic={}
    def mkPoint(pt):
        ptX = pt[1]*1000
        ptY = pt[2]*1000
        ptZ = pt[3]*1000
        gpt = Point.ByCoordinates(ptX, ptY, ptZ)
        return gpt
    
    for x in pts:
        dic[str(x[0])] = mkPoint(x)
    return dic

result = mkPoints(input)
# Assign your output to the OUT variable.
OUT = result
# ----------------------------------------
values = DesignScript.Builtin.Dictionary.Values(dictionary=다이나모_포인트로_변환_및_딕셔너리화)

# group: SECTION inform select
# note: iPRO: 부재단면속성
# iN1: 시작점
# iN2: 끝점
code_block_5 = CodeBlock { "SECTION"; }
inform_select_2 = Python(IN[0]=splitdataasdict_불필요null_제거, IN[1]=code_block_5)  # CPython3; same code as inform_select

removeHeadFromDict_2 = Python(IN[0]=inform_select_2)  # CPython3; same code as removeHeadFromDict
code_block_6 = CodeBlock { " --"; }
find_identifier_row_idx_2 = Python(IN[0]=removeHeadFromDict_2, IN[1]=code_block_6)  # CPython3
# ---------- find_identifier_row_idx_2.python (37 lines) ----------
# Load the Python Standard and DesignScript Libraries
import sys
import clr
clr.AddReference('ProtoGeometry')
from Autodesk.DesignScript.Geometry import *
from functools import reduce

# The inputs to this node will be stored as a list in the IN variables.
dataEnteringNode = IN

input = IN[0]
idf = IN[1]
# Place your code below this line

def find_tgrow_idx(tglst, idf, mode):
    if mode == "sttwith":
        def chck_identifier(x, idf):
            eres = str(x).startswith("['" + idf)
            return eres
            
    elif mode == "incld":
        def chck_identifier(x, idf):
            eres = str(x).find(idf)
            if eres >= 0:
                return True
            else:
                return False
        
    
    bln_res = list(map(lambda x: chck_identifier(x,idf), tglst))
    result = [i for i, x in enumerate(bln_res) if x]
    return result


result = find_tgrow_idx(input, idf, "incld")
# Assign your output to the OUT variable.
OUT = result
# ----------------------------------------
code_block_7 = CodeBlock { 2; }
splitdataasdict_불필요null_제거_2 = Python(IN[0]=removeHeadFromDict_2, IN[1]=find_identifier_row_idx_2, IN[2]=code_block_7)  # CPython3; same code as splitdataasdict_불필요null_제거

# group: Column inform select
# note: 13번 인덱스 가로
# 14번 인덱스 세로
code_block_8 = CodeBlock(i=splitdataasdict_불필요null_제거_2) { i; }
keys_2 = DesignScript.Builtin.Dictionary.Keys(dictionary=code_block_8)
code_block_9 = CodeBlock(i=keys_2) { i[3]; }
code_block_10 = CodeBlock(i=code_block_8, j=code_block_9) { i[j]; }

# group: defineFamilytypeName
unitFactor = CodeBlock { 1000; }
column_type_prefix = StringInput("CL111_RC COL")  # graph input
defineFamilytypeName = Python(IN[0]=code_block_10, IN[1]=unitFactor, IN[2]=column_type_prefix)  # CPython3; frozen
# ---------- defineFamilytypeName.python (29 lines) ----------
# Load the Python Standard and DesignScript Libraries
import sys
import clr
clr.AddReference('ProtoGeometry')
from Autodesk.DesignScript.Geometry import *

# The inputs to this node will be stored as a list in the IN variables.
dataEnteringNode = IN
input = IN[0]
unitFactor = IN[1]
typePrefix = IN[2]
# Place your code below this line

def defineFamilytypeName(memDatas, unitFactor, typePrefix):
    
    def findSize(memData):
        shrtSide = round(memData[13]*unitFactor)
        longSide = round(memData[14]*unitFactor)
        typeSuffix = memData[2].split()[0]
        secType = memData[0]
        return (shrtSide, longSide, typeSuffix, secType)
    
    tmp = map(lambda x: findSize(x) ,memDatas)
    res = map(lambda x: [typePrefix+"_" + 'x'.join([str(x[0]), str(x[1])]) + "_" + x[2], x[0], x[1], x[3]], tmp)
    return res

result = defineFamilytypeName(input, unitFactor, typePrefix)
# Assign your output to the OUT variable.
OUT = result
# ----------------------------------------

# group: 사용단면에 따른 패밀리 타입 생성
string = StringInput("Concrete-Rectangular-Column_R1")
paramNames = CodeBlock()
# ---------- paramNames.designscript (2 lines) ----------
["Length",
"Width"];
# ----------------------------------------
사용단면에_따른_패밀리_타입_생성 = Python(IN[0]=defineFamilytypeName, IN[1]=string, IN[2]=paramNames)  # CPython3
# ---------- 사용단면에_따른_패밀리_타입_생성.python (69 lines) ----------
# Load the Python Standard and DesignScript Libraries
import sys
import clr
clr.AddReference('ProtoGeometry')
from Autodesk.DesignScript.Geometry import *
from Revit.Elements import *

clr.AddReference('RevitAPI')
from Autodesk.Revit.DB import *
import Autodesk

clr.AddReference("RevitNodes")
import Revit
clr.ImportExtensions(Revit.Elements)
clr.ImportExtensions(Revit.GeometryConversion)

import RevitServices
from RevitServices.Persistence import DocumentManager
from RevitServices.Transactions import TransactionManager
doc = DocumentManager.Instance.CurrentDBDocument

# The inputs to this node will be stored as a list in the IN variables.
dataEnteringNode = IN
symbolDatas = IN[0]
symbolnames = map(lambda x: x[0], symbolDatas)
family = UnwrapElement(Revit.Elements.Family.ByName(IN[1]))
paramNames = IN[2]

# Place your code below this line
typeList = []

for s in symbolnames:
    chk = False
    
    fsCollector = FilteredElementCollector(doc)
    fsf = FamilySymbolFilter(family.Id)
    fsCollection = fsCollector.WherePasses(fsf).ToElements()
    
    for symbol in fsCollection:
        
        symbolname = symbol.get_Parameter(BuiltInParameter.SYMBOL_ID_PARAM).AsString()
        
        if symbolname == s:
            typeList.append(symbol.ToDSType(True))
            chk = True
            break
            
    if chk == False:
        TransactionManager.Instance.EnsureInTransaction(doc)
        
        newsymbol = fsCollection[0].Duplicate(s)
        typeList.append(newsymbol.ToDSType(True))
        
        TransactionManager.Instance.TransactionTaskDone()



TransactionManager.Instance.EnsureInTransaction(doc)
result = {}
for i,x in enumerate(typeList):
    for j,y in enumerate(paramNames):
        x.SetParameterByName(y, symbolDatas[i][j+1])
    
    res = x.SetParameterByName("Type Comments", "for placing")
    result[str(symbolDatas[i][3])] = res
TransactionManager.Instance.TransactionTaskDone()

# Assign your output to the OUT variable.
OUT = result
# ----------------------------------------

# group: Beam inform select
code_block_11 = CodeBlock(i=splitdataasdict_불필요null_제거_2) { i; }
keys_3 = DesignScript.Builtin.Dictionary.Keys(dictionary=code_block_11)
code_block_12 = CodeBlock(i=keys_3) { i[2]; }
code_block_13 = CodeBlock(i=code_block_11, j=code_block_12) { i[j]; }

# group: defineFamilytypeName
unitFactor_2 = CodeBlock { 1000; }
beam_typeprefix = StringInput("BMS111_RC BEAM")  # graph input
defineFamilytypeName_2 = Python(IN[0]=code_block_13, IN[1]=unitFactor_2, IN[2]=beam_typeprefix)  # CPython3; frozen; same code as defineFamilytypeName

# group: 사용단면에 따른 패밀리 타입 생성
string_2 = StringInput("Concrete-Rectangular-Beam")
paramNames_2 = CodeBlock()
# ---------- paramNames_2.designscript (2 lines) ----------
["Height",
"Width"];
# ----------------------------------------
사용단면에_따른_패밀리_타입_생성_2 = Python(IN[0]=defineFamilytypeName_2, IN[1]=string_2, IN[2]=paramNames_2)  # CPython3; same code as 사용단면에_따른_패밀리_타입_생성

# group: Girder inform select
code_block_14 = CodeBlock(i=splitdataasdict_불필요null_제거_2) { i; }
keys_4 = DesignScript.Builtin.Dictionary.Keys(dictionary=code_block_14)
code_block_15 = CodeBlock(i=keys_4) { i[1]; }
code_block_16 = CodeBlock(i=code_block_14, j=code_block_15) { i[j]; }

# group: defineFamilytypeName
unitFactor_3 = CodeBlock { 1000; }
girder_typeprefix = StringInput("BMS112_RC GIRDER")  # graph input
defineFamilytypeName_3 = Python(IN[0]=code_block_16, IN[1]=unitFactor_3, IN[2]=girder_typeprefix)  # CPython3; frozen; same code as defineFamilytypeName

# group: 사용단면에 따른 패밀리 타입 생성
string_3 = StringInput("Concrete-Rectangular-Beam")
paramNames_3 = CodeBlock()  # same code as paramNames_2
사용단면에_따른_패밀리_타입_생성_3 = Python(IN[0]=defineFamilytypeName_3, IN[1]=string_3, IN[2]=paramNames_3)  # CPython3; same code as 사용단면에_따른_패밀리_타입_생성

# group: Dummy inform select
code_block_17 = CodeBlock(i=splitdataasdict_불필요null_제거_2) { i; }
keys_5 = DesignScript.Builtin.Dictionary.Keys(dictionary=code_block_17)
code_block_18 = CodeBlock(i=keys_5) { i[0]; }
code_block_19 = CodeBlock(i=code_block_17, j=code_block_18) { i[j]; }

code_block_20 = CodeBlock { "Dummy"; }
elementTypeFiltering = Python(IN[0]=code_block_19, IN[1]=code_block_20)  # CPython3
# ---------- elementTypeFiltering.python (24 lines) ----------
# Load the Python Standard and DesignScript Libraries
import sys
import clr
clr.AddReference('ProtoGeometry')
from Autodesk.DesignScript.Geometry import *

# The inputs to this node will be stored as a list in the IN variables.
dataEnteringNode = IN
input = IN[0]
inStr = IN[1]

# Place your code below this line

def filtering(data, instr, mode):
    if mode == "neg":
        res = list(filter(lambda x: instr not in str(x), data))
    else:
        res = list(filter(lambda x: instr in str(x), data))
    return res


result = filtering(input, inStr, "neg")
# Assign your output to the OUT variable.
OUT = result
# ----------------------------------------

# group: defineFamilytypeName
unitFactor_4 = CodeBlock { 1000; }
other_typeprefix = StringInput("BMS112_RC GIRDER")  # graph input
defineFamilytypeName_4 = Python(IN[0]=elementTypeFiltering, IN[1]=unitFactor_4, IN[2]=other_typeprefix)  # CPython3; frozen; same code as defineFamilytypeName

# group: 사용단면에 따른 패밀리 타입 생성
string_4 = StringInput("Concrete-Rectangular-Beam")
paramNames_4 = CodeBlock()  # same code as paramNames_2
사용단면에_따른_패밀리_타입_생성_4 = Python(IN[0]=defineFamilytypeName_4, IN[1]=string_4, IN[2]=paramNames_4)  # CPython3; same code as 사용단면에_따른_패밀리_타입_생성

dictionary_병합 = Python(IN[0]=사용단면에_따른_패밀리_타입_생성, IN[1]=사용단면에_따른_패밀리_타입_생성_2, IN[2]=사용단면에_따른_패밀리_타입_생성_3, IN[3]=사용단면에_따른_패밀리_타입_생성_4)  # CPython3
# ---------- dictionary_병합.python (19 lines) ----------
# Load the Python Standard and DesignScript Libraries
import sys
import clr
clr.AddReference('ProtoGeometry')
from Autodesk.DesignScript.Geometry import *
from functools import reduce

# The inputs to this node will be stored as a list in the IN variables.
dataEnteringNode = IN


# Place your code below this line
def mergeDict(dict1, dict2):
    res = dict(dict2, **dict1)
    return res

result = reduce(mergeDict, IN)
# Assign your output to the OUT variable.
OUT = result
# ----------------------------------------

# group: ELEMENT inform select
code_block_21 = CodeBlock { "ELEMENT"; }
inform_select_3 = Python(IN[0]=splitdataasdict_불필요null_제거, IN[1]=code_block_21)  # CPython3; same code as inform_select

removeHeadFromDict_3 = Python(IN[0]=inform_select_3)  # CPython3; same code as removeHeadFromDict
plate요소_제외 = CodeBlock { "PLATE"; }
elementTypeFiltering_2 = Python(IN[0]=removeHeadFromDict_3, IN[1]=plate요소_제외)  # CPython3; same code as elementTypeFiltering
mkCrvForMember = Python(IN[0]=다이나모_포인트로_변환_및_딕셔너리화, IN[1]=elementTypeFiltering_2)  # CPython3
# ---------- mkCrvForMember.python (33 lines) ----------
# Load the Python Standard and DesignScript Libraries
import sys
import clr
clr.AddReference('ProtoGeometry')
from Autodesk.DesignScript.Geometry import *

# The inputs to this node will be stored as a list in the IN variables.
dataEnteringNode = IN
inDic = IN[0]
input = IN[1]

# Place your code below this line

def mkCrvsForMember(pts_dic, elem_datas):
    dic = {}
    def mkCrv(pts_dic, x):
        sttPtName = str(x[4])
        endPtName = str(x[5])
        sttPt = inDic[sttPtName]
        endPt = inDic[endPtName]
        rs = Line.ByStartPointEndPoint(sttPt, endPt)
        return rs
    
#    for x in elem_datas:
#        dic[str(x[0])] = (x[3] ,mkCrv(pts_dic, x))
    res = list(map(lambda x: (x[3], mkCrv(pts_dic, x)), elem_datas))
    
    return res

result = mkCrvsForMember(inDic, input)

# Assign your output to the OUT variable.
OUT = result
# ----------------------------------------

# group: 배치 레벨 선택(디버깅용)
categories = Categories("OST_Levels")
all_elements_of_category = ElementsOfCategory(Category=categories)
python_script = Python(IN[0]=all_elements_of_category)  # CPython3
# ---------- python_script.python (17 lines) ----------
# Load the Python Standard and DesignScript Libraries
import sys
import clr
clr.AddReference('ProtoGeometry')
from Autodesk.DesignScript.Geometry import *

# The inputs to this node will be stored as a list in the IN variables.
dataEnteringNode = IN

input = IN[0]

# Place your code below this line

result = filter(lambda x: x.GetParameterValueByName("S04) Level") == "for placing", input)

# Assign your output to the OUT variable.
OUT = result
# ----------------------------------------

# group: 배치 레벨 생성
level_생성_코드_실행여부 = BoolSelector(true)
엘리베이션_unique_추출 = Python(IN[0]=mkCrvForMember)  # CPython3
# ---------- 엘리베이션_unique_추출.python (20 lines) ----------
# Load the Python Standard and DesignScript Libraries
import sys
import clr
clr.AddReference('ProtoGeometry')
from Autodesk.DesignScript.Geometry import *

# The inputs to this node will be stored as a list in the IN variables.
dataEnteringNode = IN
input = IN[0]

# Place your code below this line
def find_unqElev(memberLines):
    tmp = map(lambda x: x[1].StartPoint.Z, memberLines)
    res = sorted(set(tmp))
    
    return res

result = find_unqElev(input)
# Assign your output to the OUT variable.
OUT = result
# ----------------------------------------
fl_offset = DoubleInput(300)  # graph input
배치기준레벨_자동생성 = Python(IN[0]=level_생성_코드_실행여부, IN[1]=엘리베이션_unique_추출, IN[2]=fl_offset)  # CPython3; frozen
# ---------- 배치기준레벨_자동생성.python (33 lines) ----------
# Load the Python Standard and DesignScript Libraries
import sys
import clr
clr.AddReference('ProtoGeometry')
from Autodesk.DesignScript.Geometry import *
import Revit
from RevitServices.Persistence import DocumentManager
from RevitServices.Transactions import TransactionManager
doc = DocumentManager.Instance.CurrentDBDocument

# The inputs to this node will be stored as a list in the IN variables.
dataEnteringNode = IN
exe_bln = IN[0]
input = IN[1]
fl = IN[2]
# Place your code below this line

def mkLevelsForMembers(elevs, fl, exe_bln):
    if exe_bln:
        flElevs = map(lambda x: x+fl*2, input)
        res = map(lambda x: Revit.Elements.Level.ByElevation(x), flElevs)
        return list(map(lambda x: x.SetParameterByName("S04) Level", "for placing"), res))
    else:
        pass
    

TransactionManager.Instance.EnsureInTransaction(doc)
result = mkLevelsForMembers(input, fl, exe_bln)
#result = list(map(lambda x: x.Elevation, mkLevelsForMembers(input, fl)))
TransactionManager.Instance.TransactionTaskDone()

# Assign your output to the OUT variable.
OUT = result
# ----------------------------------------

code_block_22 = CodeBlock(i=python_script, j=배치기준레벨_자동생성) { i; j; }
mkCrvAndLevelDatas = Python(IN[0]=mkCrvForMember, IN[1]=code_block_22.j, IN[2]=fl_offset)  # CPython3
# ---------- mkCrvAndLevelDatas.python (52 lines) ----------
# Load the Python Standard and DesignScript Libraries
import sys
import clr
clr.AddReference('ProtoGeometry')
from Autodesk.DesignScript.Geometry import *

clr.AddReference('RevitAPI')
from Autodesk.Revit.DB import *
import Autodesk

clr.AddReference("RevitNodes")
import Revit
clr.ImportExtensions(Revit.Elements)
clr.ImportExtensions(Revit.GeometryConversion)

clr.AddReference('RevitServices')
import RevitServices
from RevitServices.Persistence import DocumentManager
doc = DocumentManager.Instance.CurrentDBDocument
collector = FilteredElementCollector(doc)

from DSCore import *


# The inputs to this node will be stored as a list in the IN variables.
dataEnteringNode = IN
input = IN[0]
levels = IN[1]
fl = IN[2]

# Place your code below this line

def mkCrvAndLevelDatas(memberDatas, levels):
    def mkElevAndLevelObjDic(levels):
        dic = {}
        for i,x in enumerate(levels):
            dic[str(int(round(x.Elevation)))] = x
        return dic
    
    def find_Elev(memberData):
        stt_res = memberData[1].StartPoint.Z + fl
        end_res = memberData[1].EndPoint.Z + fl
        return (str(int(round(stt_res))), str(int(round(end_res))))
    
    LvObjDic = mkElevAndLevelObjDic(levels)
    res = map(lambda x: List.AddItemToEnd((LvObjDic[find_Elev(x)[0]], LvObjDic[find_Elev(x)[1]]), x), memberDatas)
    
    return list(res)
    
result = mkCrvAndLevelDatas(input, levels)
# Assign your output to the OUT variable.
OUT = result
# ----------------------------------------
mkSet_CrvLvType = Python(IN[0]=dictionary_병합, IN[1]=mkCrvAndLevelDatas)  # CPython3
# ---------- mkSet_CrvLvType.python (39 lines) ----------
# Load the Python Standard and DesignScript Libraries
import sys
import clr
clr.AddReference('ProtoGeometry')
from Autodesk.DesignScript.Geometry import *

clr.AddReference('RevitAPI')
from Autodesk.Revit.DB import *
import Autodesk

clr.AddReference("RevitNodes")
import Revit
clr.ImportExtensions(Revit.Elements)
clr.ImportExtensions(Revit.GeometryConversion)

clr.AddReference('RevitServices')
import RevitServices
from RevitServices.Persistence import DocumentManager
doc = DocumentManager.Instance.CurrentDBDocument
collector = FilteredElementCollector(doc)

from DSCore import *


# The inputs to this node will be stored as a list in the IN variables.
dataEnteringNode = IN
typeDic = IN[0]
CrvAndLevelDatas = IN[1]


# Place your code below this line

def mkSet_CrvLvType(typeDic, CrvAndLevelDatas):
    res = map(lambda x: List.AddItemToEnd(typeDic[str(x[0])], x),CrvAndLevelDatas)
    return res
    
result = mkSet_CrvLvType(typeDic, CrvAndLevelDatas)
# Assign your output to the OUT variable.
OUT = result
# ----------------------------------------
# note: 단면 회전 매개변수
# : Cross-Section Rotation
createRvtElem = Python(IN[0]=mkSet_CrvLvType)  # CPython3; graph output
# ---------- createRvtElem.python (64 lines) ----------
# Load the Python Standard and DesignScript Libraries
import sys
import clr
clr.AddReference('ProtoGeometry')
from Autodesk.DesignScript.Geometry import *

clr.AddReference('RevitAPI')
from Autodesk.Revit.DB import *
import Autodesk

clr.AddReference("RevitNodes")
import Revit
clr.ImportExtensions(Revit.Elements)
clr.ImportExtensions(Revit.GeometryConversion)

clr.AddReference('RevitServices')
import RevitServices
from RevitServices.Persistence import DocumentManager
doc = DocumentManager.Instance.CurrentDBDocument
collector = FilteredElementCollector(doc)

import RevitServices
from RevitServices.Persistence import DocumentManager
from RevitServices.Transactions import TransactionManager
doc = DocumentManager.Instance.CurrentDBDocument

from DSCore import *

# The inputs to this node will be stored as a list in the IN variables.
dataEnteringNode = IN
input = IN[0]

# Place your code below this line
def crtRvtElems(CrvLvTypes):
    def crtElem(CrvLvType):
        _crv = CrvLvType[1]
        _lv1 = CrvLvType[2][0]
        _lv2 = CrvLvType[2][1]
        _type = CrvLvType[3]
        _cat = CrvLvType[3].GetParameterValueByName("Category")
        
        if str(_cat) == "Structural Columns":
            res = Revit.Elements.StructuralFraming.ColumnByCurve(_crv, _lv1, _type)
            res.SetParameterByName("Top Level", _lv2)
            res.SetParameterByName("Base Offset", 0)
            res.SetParameterByName("Top Offset", 0)
        elif str(_cat) == "Structural Framing":
            res = Revit.Elements.StructuralFraming.BeamByCurve(_crv, _lv1, _type)
            res.SetParameterByName("Reference Level", _lv1)
            res.SetParameterByName("Start Level Offset", 0)
            res.SetParameterByName("End Level Offset", 0)
        else:
            pass
        
        return res
    res = map(lambda x: crtElem(x), CrvLvTypes)
    
    return res

TransactionManager.Instance.EnsureInTransaction(doc)
result = crtRvtElems(input)
TransactionManager.Instance.TransactionTaskDone()
# Assign your output to the OUT variable.
OUT = result
# ----------------------------------------
mkcrvformember_rotation_추가 = Python(IN[0]=다이나모_포인트로_변환_및_딕셔너리화, IN[1]=elementTypeFiltering_2)  # CPython3
# ---------- mkcrvformember_rotation_추가.python (33 lines) ----------
# Load the Python Standard and DesignScript Libraries
import sys
import clr
clr.AddReference('ProtoGeometry')
from Autodesk.DesignScript.Geometry import *

# The inputs to this node will be stored as a list in the IN variables.
dataEnteringNode = IN
inDic = IN[0]
input = IN[1]

# Place your code below this line

def mkCrvsForMember(pts_dic, elem_datas):
    dic = {}
    def mkCrv(pts_dic, x):
        sttPtName = str(x[4])
        endPtName = str(x[5])
        sttPt = inDic[sttPtName]
        endPt = inDic[endPtName]
        rs = Line.ByStartPointEndPoint(sttPt, endPt)
        return rs
    
#    for x in elem_datas:
#        dic[str(x[0])] = (x[3] ,mkCrv(pts_dic, x))
    res = list(map(lambda x: (x[3], mkCrv(pts_dic, x), x[6]), elem_datas))
    
    return res

result = mkCrvsForMember(inDic, input)

# Assign your output to the OUT variable.
OUT = result
# ----------------------------------------
code_block_23 = CodeBlock(i=splitdataasdict_불필요null_제거_2) { i; }
python_script_2 = Python(IN[0]=code_block_23)  # CPython3
# ---------- python_script_2.python (22 lines) ----------
# Load the Python Standard and DesignScript Libraries
import sys
import clr
clr.AddReference('ProtoGeometry')
from Autodesk.DesignScript.Geometry import *

# The inputs to this node will be stored as a list in the IN variables.
dataEnteringNode = IN
input = IN[0]

# Place your code below this line
def main(_input):
    memberTypes = _input.keys()
    
    res = []
    for k,v in _input.items():
        res.append([k,*v])
    
    return res

# Assign your output to the OUT variable.
OUT = main(input)
# ----------------------------------------
all_framing_types = Python()  # CPython3; unwired: IN[0]
# ---------- all_framing_types.python (28 lines) ----------
# Load the Python Standard and DesignScript Libraries
import sys
import clr
clr.AddReference('ProtoGeometry')
from Autodesk.DesignScript.Geometry import *

clr.AddReference('RevitAPI')
from Autodesk.Revit.DB import *
import Autodesk

clr.AddReference('RevitServices')
import RevitServices
from RevitServices.Persistence import DocumentManager
doc = DocumentManager.Instance.CurrentDBDocument
collector = FilteredElementCollector(doc)

# The inputs to this node will be stored as a list in the IN variables.
dataEnteringNode = IN

# Place your code below this line
allTypes = collector.OfCategory(BuiltInCategory.OST_StructuralFraming).WhereElementIsElementType().ToElements()


allFamilyNames = map(lambda x: x.get_FamilyName(), allTypes)
allTypeNames = list(map(lambda x: x, allTypes))

# Assign your output to the OUT variable.
OUT = dir(allTypeNames[0])
# ----------------------------------------
parameters = Element.Parameters(element=all_framing_types)
code_block_24 = CodeBlock { "Type Name"; }
getParameterValueByName = Element.GetParameterValueByName(element=all_framing_types, parameterName=code_block_24)
name = Element.Name(element=all_framing_types)
