# Dynamo graph Qsurfacedivider.dyn (Dynamo 2.10.1.3976)

convexhull_class = Python()  # CPython3; unwired: IN[0], IN[1]
# ---------- convexhull_class.python (58 lines) ----------
# Load the Python Standard and DesignScript Libraries
import sys
import clr
clr.AddReference('ProtoGeometry')
from Autodesk.DesignScript.Geometry import *
from functools import reduce

# The inputs to this node will be stored as a list in the IN variables.
dataEnteringNode = IN

# Place your code below this line
class ConvexHull_Maker:
    def __init__(self, points):
        def convex_hull_graham(points):
            def ToVals(pt):
	            return [pt.X,pt.Y,pt.Z]
            def ToPts(ptVals):
	            return Point.ByCoordinates(ptVals[0],ptVals[1],ptVals[2])
	           
            def CreateOutline(pts):
                crvs = []
                i = 0
                while i < len(pts):
                    if i == len(pts)-1:
                        crvs.append(Line.ByStartPointEndPoint(pts[i],pts[0]))
                    else:
                        crvs.append(Line.ByStartPointEndPoint(pts[i],pts[i+1]))
                    i = i+1
                return PolyCurve.ByJoinedCurves(crvs)
	
            TURN_LEFT, TURN_RIGHT, TURN_NONE = (1, -1, 0)

            def cmp(a, b):
                return (a > b) - (a < b)
	
            def turn(p, q, r):
                return cmp((q[0] - p[0])*(r[1] - p[1]) - (r[0] - p[0])*(q[1] - p[1]), 0)
	
            def _keep_left(hull, r):
                while len(hull) > 1 and turn(hull[-2], hull[-1], r) != TURN_LEFT:
                    hull.pop()
                if not len(hull) or hull[-1] != r:
                    hull.append(r)
                return hull

            points = [ToVals(p) for p in points]	
            points = sorted(points)
            l = reduce(_keep_left, points, [])
            u = reduce(_keep_left, reversed(points), [])
            points = l.extend(u[i] for i in range(1, len(u) - 1)) or l
            points = [ToPts(p) for p in points]
            return CreateOutline(points)
            
        self.points = points
        result = convex_hull_graham(points)
        self.result = result
# Assign your output to the OUT variable.
OUT = ConvexHull_Maker
# ----------------------------------------
code_block = CodeBlock { 1000; 2000; }
byWidthLength = Rectangle.ByWidthLength(width=code_block.out1, length=code_block.out0)  # frozen
byPatch = Surface.ByPatch(closedCurve=byWidthLength)
code_block_2 = CodeBlock { 0..1..#100; }
pointAtParameter = Surface.PointAtParameter(surface=byPatch, u=code_block_2, v=code_block_2, lacing=CrossProduct)
flatten = List.Flatten(list=pointAtParameter)
code_block_3 = CodeBlock { 10; }
code_block_4 = CodeBlock(i=flatten) { 0; List.Count(i); }
number_slider = DoubleSlider(147, range=0..999 step 1)
randomList = Math.RandomList(amount=code_block_3, value1=code_block_4.out0, value2=code_block_4.out1, seed=number_slider)
round = Math.Round(number=randomList)
getItemAtIndex = List.GetItemAtIndex(list=flatten, index=round)
python_script = Python(IN[0]=convexhull_class, IN[1]=getItemAtIndex)  # CPython3
# ---------- python_script.python (21 lines) ----------
# Load the Python Standard and DesignScript Libraries
import sys
import clr
clr.AddReference('ProtoGeometry')
from Autodesk.DesignScript.Geometry import *
from functools import reduce

# The inputs to this node will be stored as a list in the IN variables.
dataEnteringNode = IN

ConvexHull_Maker = IN[0]
inputPts = IN[1]
# Place your code below this line

cvxCrv = ConvexHull_Maker(inputPts).result
cvxSrf = Surface.ByPatch(cvxCrv)
cvxSolid = cvxSrf.Thicken(100, False)
result = cvxSolid

# Assign your output to the OUT variable.
OUT = result
# ----------------------------------------
code_block_5 = CodeBlock { 5; }
takeItems = List.TakeItems(list=pointAtParameter@L2, amount=code_block_5)
code_block_6 = CodeBlock { 10; }
takeItems_2 = List.TakeItems(list=takeItems, amount=code_block_6)
doesIntersect = Geometry.DoesIntersect()  # unwired: geometry, other
code_block_7 = CodeBlock { 1500; 1500; }
byWidthLength_2 = Rectangle.ByWidthLength(width=code_block_7.out1, length=code_block_7.out0)

# group: QgridPointsMaker & Random Polygon 생성기
함수_라이브러리_함수_임포트_용 = Python()  # CPython3; unwired: IN[0]
# ---------- 함수_라이브러리_함수_임포트_용.python (129 lines) ----------
# Load the Python Standard and DesignScript Libraries
import os
import sys
sys.path.append(os.getenv('LOCALAPPDATA').replace('\\','\\\\') + r'\Programs\Python\Python39\Lib\site-packages')
import clr
clr.AddReference('RevitAPI')
import Autodesk

clr.AddReference('ProtoGeometry')
from Autodesk.DesignScript.Geometry import *

clr.AddReference('RevitNodes')
import Revit
clr.ImportExtensions(Revit.Elements)

clr.ImportExtensions(Revit.GeometryConversion)
clr.ImportExtensions(Revit.GeometryReferences)

clr.AddReference('RevitServices')
import RevitServices
from RevitServices.Persistence import DocumentManager
from RevitServices.Transactions import TransactionManager

doc = DocumentManager.Instance.CurrentDBDocument

import random
import itertools
from functools import reduce

# The inputs to this node will be stored as a list in the IN variables.
dataEnteringNode = IN

# Place your code below this line
class ConvexHull_Maker:
    def __init__(self, points):
        def convex_hull_graham(points):
            def ToVals(pt):
	            return [pt.X,pt.Y,pt.Z]
            def ToPts(ptVals):
	            return Point.ByCoordinates(ptVals[0],ptVals[1],ptVals[2])
	           
            def CreateOutline(pts):
                crvs = []
                i = 0
                while i < len(pts):
                    if i == len(pts)-1:
                        crvs.append(Line.ByStartPointEndPoint(pts[i],pts[0]))
                    else:
                        crvs.append(Line.ByStartPointEndPoint(pts[i],pts[i+1]))
                    i = i+1
                return PolyCurve.ByJoinedCurves(crvs)
	
            TURN_LEFT, TURN_RIGHT, TURN_NONE = (1, -1, 0)

            def cmp(a, b):
                return (a > b) - (a < b)
	
            def turn(p, q, r):
                return cmp((q[0] - p[0])*(r[1] - p[1]) - (r[0] - p[0])*(q[1] - p[1]), 0)
	
            def _keep_left(hull, r):
                while len(hull) > 1 and turn(hull[-2], hull[-1], r) != TURN_LEFT:
                    hull.pop()
                if not len(hull) or hull[-1] != r:
                    hull.append(r)
                return hull

            points = [ToVals(p) for p in points]	
            points = sorted(points)
            l = reduce(_keep_left, points, [])
            u = reduce(_keep_left, reversed(points), [])
            points = l.extend(u[i] for i in range(1, len(u) - 1)) or l
            points = [ToPts(p) for p in points]
            return CreateOutline(points)
            
        self.points = points
        result = convex_hull_graham(points)
        self.result = result

def repeatFuncApply(func, repeat, data_input):
    result = []
    input_forFunc = data_input
    while repeat != 0:
        result.append(func(input_forFunc))
        input_forFunc = func(input_forFunc)
        repeat = repeat - 1
    return result

def create_horizonLine(endpt):
    sttpt = Point.ByCoordinates(0,0,0)
    line_prime = Line.ByStartPointEndPoint(sttpt, endpt)
    return line_prime
    
def create_verticalLine(endpt):
    sttpt = Point.ByCoordinates(0,0,0)
    line_prime = Line.ByStartPointEndPoint(sttpt, endpt)
    return line_prime
    
def curveOffset(elem, dist):
    result = Curve.Offset(elem, dist)
    return result
    
def range_q(start, end, num):
    result = [start]
    between = num - 1
    gap = end - start
    step = gap / between
    for i in range(num):
        if i == 0:
            pass
        else:
            target = start + step * i
            result.append(target)
    return result



##########################################################
result = [
ConvexHull_Maker,
repeatFuncApply,
create_horizonLine,
create_verticalLine,
curveOffset,
range_q
]	

# Assign your output to the OUT variable.
OUT = result
# ----------------------------------------
seed = DoubleSlider(4627, range=0..10000 step 1)
샘플링_크기 = CodeBlock { 100; }
qgridpointsmaker_random_polygon = CodeBlock(다각형생성범위_커브=byWidthLength_2, 랜덤_시드=seed, 샘플링_크기=샘플링_크기) { 다각형생성범위_커브; 랜덤_시드; 샘플링_크기; }  # "QgridPointsMaker & Random Polygon 생성기 Input"
qgridpointsmaker_random_polygon_2 = Python(IN[0]=함수_라이브러리_함수_임포트_용, IN[1]=qgridpointsmaker_random_polygon.다각형생성범위_커브, IN[2]=qgridpointsmaker_random_polygon.랜덤_시드, IN[3]=qgridpointsmaker_random_polygon.샘플링_크기)  # "QgridPointsMaker & Random Polygon 생성기"; CPython3
# ---------- qgridpointsmaker_random_polygon_2.python (64 lines) ----------
# Load the Python Standard and DesignScript Libraries
import os
import sys
sys.path.append(os.getenv('LOCALAPPDATA').replace('\\','\\\\') + r'\Programs\Python\Python39\Lib\site-packages')
import clr
clr.AddReference('RevitAPI')
import Autodesk

clr.AddReference('ProtoGeometry')
from Autodesk.DesignScript.Geometry import *

clr.AddReference('RevitNodes')
import Revit
clr.ImportExtensions(Revit.Elements)

clr.ImportExtensions(Revit.GeometryConversion)
clr.ImportExtensions(Revit.GeometryReferences)

clr.AddReference('RevitServices')
import RevitServices
from RevitServices.Persistence import DocumentManager
from RevitServices.Transactions import TransactionManager

doc = DocumentManager.Instance.CurrentDBDocument

import random
import itertools
from functools import reduce

############################################################
############### Function Import part - start ###############
ConvexHull_Maker = IN[0][0]
repeatFuncApply = IN[0][1]
create_horizonLine = IN[0][2]
create_verticalLine = IN[0][3]
curveOffset = IN[0][4]
range_q = IN[0][5]
############### Function Import part - end #################
############################################################

# The inputs to this node will be stored as a list in the IN variables.
dataEnteringNode = IN
inputCrv = IN[1]
randomSeed = IN[2]
sampling = IN[3]

# Place your code below this line
SrfByInputCrv = Surface.ByPatch(inputCrv)
gridParam = range_q(0,1,100)

gridPts = list(
            map(lambda x: 
                map(lambda y: SrfByInputCrv.PointAtParameter(x, y), gridParam), gridParam))
gridPts_flatten = list(itertools.chain(*gridPts))
gridPts_filtered = list(filter(lambda x: x.DoesIntersect(SrfByInputCrv), gridPts_flatten))
random.seed(randomSeed)
gridPts_Sampled = random.sample(gridPts_filtered, sampling)
cvxCrv = ConvexHull_Maker(gridPts_Sampled).result
cvxSrf = Surface.ByPatch(cvxCrv)
cvxSolid = cvxSrf.Thicken(30, False)

result = cvxSolid
# Assign your output to the OUT variable.
OUT = result
# ----------------------------------------

explode = Geometry.Explode(geometry=qgridpointsmaker_random_polygon_2)
code_block_8 = CodeBlock(i=explode) { i[0]; }
perimeterCurves = Surface.PerimeterCurves(surface=code_block_8)
byJoinedCurves = PolyCurve.ByJoinedCurves(curves=perimeterCurves)

# group: QgridPointsMaker & Random Polygon 생성기
함수_라이브러리_함수_임포트_용_2 = Python()  # CPython3; unwired: IN[0]; same code as 함수_라이브러리_함수_임포트_용
seed_2 = DoubleSlider(5014, range=0..10000 step 1)
샘플링_크기_2 = CodeBlock { 30; }
qgridpointsmaker_random_polygon_3 = CodeBlock(다각형생성범위_커브=byJoinedCurves, 랜덤_시드=seed_2, 샘플링_크기=샘플링_크기_2) { 다각형생성범위_커브; 랜덤_시드; 샘플링_크기; }  # "QgridPointsMaker & Random Polygon 생성기 Input"
qgridpointsmaker_random_polygon_4 = Python(IN[0]=함수_라이브러리_함수_임포트_용_2, IN[1]=qgridpointsmaker_random_polygon_3.다각형생성범위_커브, IN[2]=qgridpointsmaker_random_polygon_3.랜덤_시드, IN[3]=qgridpointsmaker_random_polygon_3.샘플링_크기)  # "QgridPointsMaker & Random Polygon 생성기"; CPython3; same code as qgridpointsmaker_random_polygon_2

explode_2 = Geometry.Explode(geometry=qgridpointsmaker_random_polygon_4)
code_block_9 = CodeBlock(i=explode_2) { i[0]; }
perimeterCurves_2 = Surface.PerimeterCurves(surface=code_block_9)
byJoinedCurves_2 = PolyCurve.ByJoinedCurves(curves=perimeterCurves_2)

# group: QgridPointsMaker & Random Polygon 생성기
함수_라이브러리_함수_임포트_용_3 = Python()  # CPython3; unwired: IN[0]; same code as 함수_라이브러리_함수_임포트_용
seed_3 = DoubleSlider(4303, range=0..10000 step 1)
샘플링_크기_3 = CodeBlock { 20; }
qgridpointsmaker_random_polygon_5 = CodeBlock(다각형생성범위_커브=byJoinedCurves_2, 랜덤_시드=seed_3, 샘플링_크기=샘플링_크기_3) { 다각형생성범위_커브; 랜덤_시드; 샘플링_크기; }  # "QgridPointsMaker & Random Polygon 생성기 Input"
qgridpointsmaker_random_polygon_6 = Python(IN[0]=함수_라이브러리_함수_임포트_용_3, IN[1]=qgridpointsmaker_random_polygon_5.다각형생성범위_커브, IN[2]=qgridpointsmaker_random_polygon_5.랜덤_시드, IN[3]=qgridpointsmaker_random_polygon_5.샘플링_크기)  # "QgridPointsMaker & Random Polygon 생성기"; CPython3; same code as qgridpointsmaker_random_polygon_2

join = List.Join(list0=qgridpointsmaker_random_polygon_2, list1=qgridpointsmaker_random_polygon_4, list2=qgridpointsmaker_random_polygon_6)
categories = Categories("OST_GenericModel")
code_block_10 = CodeBlock { "Test1"; }
byGeometry = DirectShape.ByGeometry(geometry=join, category=categories, name=code_block_10)  # frozen
