# Dynamo graph RandomPlacing.dyn (Dynamo 2.10.1.3976)

code_block = CodeBlock { 3; -999; 999; }
code_block_2 = CodeBlock { 0..999..1; }
randomList = Math.RandomList(amount=code_block.out0, value1=code_block.out1, value2=code_block.out2, seed=code_block_2)
code_block_3 = CodeBlock { 0; }
getItemAtIndex = List.GetItemAtIndex(list=randomList@L2, index=code_block_3)
code_block_4 = CodeBlock { 1; }
getItemAtIndex_2 = List.GetItemAtIndex(list=randomList@L2, index=code_block_4)
byCoordinates = Point.ByCoordinates(x=getItemAtIndex, y=getItemAtIndex_2)
code_block_5 = CodeBlock { 100; }
byCenterPointRadius = Sphere.ByCenterPointRadius(centerPoint=byCoordinates, radius=code_block_5)
number_slider = DoubleSlider(0, range=0..999 step 0.1)
code_block_6 = CodeBlock(i=randomList) { i[0]; i[1]; i[2]; }
