# Dynamo graph family doc parameter.dyn (Dynamo 2.12.0.5650)
# packages: Orchid 212.1.0.8171

current = Document.Current()
byDocument = FamilyDocument.ByDocument(document=current)
code_block = CodeBlock { "C"; }
code_block_2 = CodeBlock { "(A * B)/ 1mm"; }
setFormula = FamilyDocument.SetFormula(familyDocument=byDocument, parameterName=code_block, formula=code_block_2)  # frozen

# group: Orchid Package
o_document_current = Orchid.RevitProject.Common.Document.Current()
o_formula_set = Orchid.RevitFamily.Formula.Set(familyDocument=o_document_current, parameterName=code_block, value=code_block_2)
o_about_update = Orchid.About.Update()
