# Dynamo graph python scripting 실습용_3주차.dyn (Dynamo 2.16.1.2727)

categories = Categories("OST_StructuralFoundation")
categories_2 = Categories("OST_StructuralColumns")
categories_3 = Categories("OST_StructuralFraming")
join = List.Join(list0=categories, list1=categories_2, list2=categories_3)
all_elements_of_category = ElementsOfCategory(Category=join)
geometry = Element.Geometry(element=all_elements_of_category)

# group: 토공 산출 관련 부재 필터링 - A part
인스턴스_데이터들 = CodeBlock(allElements=all_elements_of_category) { allElements; }
code_block = CodeBlock { "Family and Type"; }
getParameterValueByName = Element.GetParameterValueByName(element=인스턴스_데이터들, parameterName=code_block)
code_block_2 = CodeBlock { "Type Name"; }
getParameterValueByName_2 = Element.GetParameterValueByName(element=getParameterValueByName, parameterName=code_block_2)
code_block_3 = CodeBlock()
# ---------- code_block_3.designscript (4 lines) ----------
[
"UG",
"SF"
];
# ----------------------------------------
contains = String.Contains(string=getParameterValueByName_2@@L1, searchFor=code_block_3)
anyTrue = List.AnyTrue(list=contains@@L2)
filterByBoolMask = List.FilterByBoolMask(list=인스턴스_데이터들, mask=anyTrue)
# note: from 부재 타입
parameters = Element.Parameters(element=getParameterValueByName)
# note: from 부재
parameters_2 = Element.Parameters(element=인스턴스_데이터들)

# group: 저면 추출 및 터파기 규칙 데이터에 의한 터파기 형상 생성 - B part
geometry_2 = Element.Geometry(element=filterByBoolMask.in)
code_block_4 = CodeBlock {  }

토공_산출_관련_부재_필터링_실습답안 = Python(IN[0]=all_elements_of_category)  # CPython3
# ---------- 토공_산출_관련_부재_필터링_실습답안.python (58 lines) ----------
# Load the Python Standard and DesignScript Libraries
import sys
import clr
clr.AddReference('ProtoGeometry')
from Autodesk.DesignScript.Geometry import *

# The inputs to this node will be stored as a list in the IN variables.
dataEnteringNode = IN
allElems = IN[0]
# Place your code below this line

allFdns, allCols, allFrames = allElems

# 함수 정의
def isUG_loopBase(elems, tgtStr):
    # 미리 빈 리스트 하나 만들고
    res = []
    # 모든 객체 각각에 대해
    for e in elems:
        # 패밀리 타입 이름도 찾아놓고
        familyTypeName = e.GetParameterValueByName("Family and Type").GetParameterValueByName("Type Name")
        # 패밀리 타입 이름이 타겟문자열을 포함하는 지 검사해서
        if tgtStr in familyTypeName:
            # 검사결과가 True 이면 아까 만든 빈리스트에 넣고
            res.append(e)
        else:
            # 검사결과가 False 이면 그냥 아무것도 하지 말아라 (이 경우에는 else 이하 생략가능)
            pass
            
    # 코드 전체에서 함수를 "호출"하여 연산을 하고, 함수가 종료될 때는 함수 내부에서 연산한 결과가 메모리에서 해제된다. 따라서 res 리스트를 함수호출이 끝난 이후, 다음 코드에서도 활용하려면 return으로 함수 외부로 값을 송출해야 한다.
    return res



def isUG_fpBase(elems, tgtStr):
    res = filter( lambda e: tgtStr in e.GetParameterValueByName("Family and Type").GetParameterValueByName("Type Name"), elems )
    return res



def getTypeName(e):
    return e.GetParameterValueByName("Family and Type").GetParameterValueByName("Type Name")

def isUG_fpBase_divFunc(elems, tgtStr):
    res = filter( lambda e: tgtStr in getTypeName(e), elems )
    return res


# 함수 호출
#result = isUG_loopBase(allCols, "UG"), isUG_fpBase(allCols, "UG"), isUG_fpBase_divFunc(allCols, "UG")
result = [
    map(lambda e: e.Geometry(), isUG_loopBase(allCols, "UG")),
    map(lambda e: e.Geometry(), isUG_loopBase(allFrames, "UG")),
    map(lambda e: e.Geometry(), isUG_loopBase(allFdns, "")),
    ]

# Assign your output to the OUT variable.
OUT = result
# ----------------------------------------
토공실습_a_part = Python(IN[0]=all_elements_of_category)  # CPython3
# ---------- 토공실습_a_part.python (31 lines) ----------
# Load the Python Standard and DesignScript Libraries
import sys
import clr
clr.AddReference('ProtoGeometry')
from Autodesk.DesignScript.Geometry import *

# The inputs to this node will be stored as a list in the IN variables.
dataEnteringNode = IN
allElems = IN[0]

#allFdns = allElems[0]
#allCols = allElems[1]
#allFrames = allElems[2]
#
#[ allFdns, allCols, allFrames ] = allElems

allFdns, allCols, allFrames = allElems
# Place your code below this line

def getTypeName(e):
    return e.GetParameterValueByName("Family and Type").GetParameterValueByName("Type Name")

def isUG_fpBase(elems, tgtStr):
    res = filter( lambda e: tgtStr in getTypeName(e), elems )
    return res

#filter(걸러낼 규칙, 대상리스트)

# Assign your output to the OUT variable.
# 함수 호출
OUT = isUG_fpBase(allCols, "UG"), isUG_fpBase(allFdns, "SF"), isUG_fpBase(allFrames, "UG")
# ----------------------------------------
parameters_3 = Element.Parameters(element=인스턴스_데이터들)
인스턴스_데이터들_2 = CodeBlock(allElements=all_elements_of_category) { allElements; }
parameters_4 = Element.Parameters(element=인스턴스_데이터들_2)
실습 = Python(IN[0]=all_elements_of_category)  # CPython3
# ---------- 실습.python (40 lines) ----------
# Load the Python Standard and DesignScript Libraries
import sys
import clr
clr.AddReference('ProtoGeometry')
from Autodesk.DesignScript.Geometry import *

# The inputs to this node will be stored as a list in the IN variables.
dataEnteringNode = IN
allElems = IN[0]
# Place your code below this line
allFdns, allCols, allFrames = allElems



# 함수 정의 
def isUG(elems, tgtStr):
    res = []
    for x in elems:
        typeName = x.GetParameterValueByName("Family and Type").GetParameterValueByName("Type Name")
        
        if tgtStr in typeName:
            res.append(x)
        else:
            pass    
    return res

#filter(필터링규칙, 필터대상리스트)

def getTypeName(x):
    return x.GetParameterValueByName("Family and Type").GetParameterValueByName("Type Name")

def isUG_fpBase(elems, tgtStr):
    res = filter( lambda x: tgtStr in getTypeName(x) , elems)
    return res
    


# Assign your output to the OUT variable.
# 함수 호출
OUT = isUG_fpBase(allFdns, "SF"), isUG_fpBase(allCols, "UG"), isUG_fpBase(allFrames, "UG")
# ----------------------------------------
geometry_3 = Element.Geometry(element=filterByBoolMask.in)
flatten = List.Flatten(list=geometry_3@L3)
code_block_5 = CodeBlock(i=flatten) { i[0]; }
byGeometry = BoundingBox.ByGeometry(geom=code_block_5)
toCuboid = BoundingBox.ToCuboid(boundingBox=byGeometry)
explode = Geometry.Explode(geometry=toCuboid)
code_block_6 = CodeBlock(i=explode) { List.FilterByBoolMask(i, i.NormalAtParameter(0.5,0.5).Z == 1); }
code_block_7 = CodeBlock(i=code_block_6) { i["in"]; }
code_block_8 = CodeBlock(i=explode) { i.NormalAtParameter(0.5,0.5).Z == -1; }
filterByBoolMask_2 = List.FilterByBoolMask(list=explode, mask=code_block_8)
code_block_9 = CodeBlock(btmSrf=filterByBoolMask_2.in) { btmSrf; }
perimeterCurves = Surface.PerimeterCurves(surface=code_block_9)
boolean = BoolSelector(true)
byJoinedCurves = PolyCurve.ByJoinedCurves(curves=perimeterCurves, trimCurves=boolean)
pointAtParameter = Surface.PointAtParameter(surface=code_block_9)
Z = Point.Z(point=pointAtParameter)
code_block_10 = CodeBlock(i=Z) { -i; }
translate = Geometry.Translate(geometry=byJoinedCurves, zTranslation=code_block_10)
code_block_11 = CodeBlock(H=code_block_10) { G = 1; G * H-100; }
code_block_12 = CodeBlock { false; }
offsetMany = PolyCurve.OffsetMany(polyCurve=translate, signedDistance=code_block_11.out1, extendCircular=code_block_12)
lean_두께_base_subbase_두께 = CodeBlock { downThk = (0.1+0.15+0.15)*1000; downThk * -1; }
translate_2 = Geometry.Translate(geometry=byJoinedCurves, zTranslation=lean_두께_base_subbase_두께.out1)
lean_돌출길이_터파기_여유폭 = CodeBlock { offset = (0.1 + 0.2)*1000; offset * -1; false; }
offsetMany_2 = PolyCurve.OffsetMany(polyCurve=translate_2, signedDistance=lean_돌출길이_터파기_여유폭.offset, extendCircular=lean_돌출길이_터파기_여유폭.out2)
join_2 = List.Join(list0=offsetMany, list1=offsetMany_2)
byLoft = Solid.ByLoft(crossSections=join_2)
flatten_2 = List.Flatten(list=geometry_3@L3)
byUnion = Solid.ByUnion(solids=flatten_2)
code_block_13 = CodeBlock(i=byUnion) { i[0]; }
split = Geometry.Split(geometry=byLoft, other=code_block_13)
code_block_14 = CodeBlock(i=split) { i[0]; }
code_block_15 = CodeBlock(i=byUnion) { i[2]; }
split_2 = Geometry.Split(geometry=code_block_14, other=code_block_15)
code_block_16 = CodeBlock(i=split_2) { i[0]; }
volume = Solid.Volume(solid=code_block_16)
volume_2 = Solid.Volume(solid=byLoft)
