# Dynamo graph Bidding_Elements Join Order Organizer_1.0.0.dyn (Dynamo 2.16.1.2727)

setGeometryJoinOrder = Element.SetGeometryJoinOrder()  # unwired: cuttingElement, otherElement
categories = Categories("OST_StructuralFoundation")
all_elements_of_category = ElementsOfCategory(Category=categories)
categories_2 = Categories("OST_StructuralColumns")
all_elements_of_category_2 = ElementsOfCategory(Category=categories_2)
categories_3 = Categories("OST_StructuralFraming")
all_elements_of_category_3 = ElementsOfCategory(Category=categories_3)
categories_4 = Categories("OST_Floors")
all_elements_of_category_4 = ElementsOfCategory(Category=categories_4)
categories_5 = Categories("OST_Roofs")
all_elements_of_category_5 = ElementsOfCategory(Category=categories_5)
join = List.Join(list0=all_elements_of_category, list1=all_elements_of_category_2, list2=all_elements_of_category_3, list3=all_elements_of_category_4, list4=all_elements_of_category_5)  # frozen
unjoinAllGeometry = Element.UnjoinAllGeometry(elements=join)
join_2 = List.Join(list0=all_elements_of_category_2, list1=all_elements_of_category_3, list2=all_elements_of_category_4, list3=all_elements_of_category_5)
joinGeometry = Element.JoinGeometry()  # unwired: element, otherElement
areJoined = Element.AreJoined()  # unwired: element, otherElement
python_script = Python(IN[0]=all_elements_of_category, IN[1]=all_elements_of_category_2, IN[2]=all_elements_of_category_3, IN[3]=all_elements_of_category_4, IN[4]=all_elements_of_category_5)  # CPython3
# ---------- python_script.python (70 lines) ----------
# Load the Python Standard and DesignScript Libraries
import sys
import clr
clr.AddReference('ProtoGeometry')
from Autodesk.DesignScript.Geometry import *

clr.AddReference('RevitNodes')
import Revit
clr.ImportExtensions(Revit.Elements)
from Revit import Elements

#################################Module For Functional Programing#############################################
from functools import reduce
curry = lambda f: lambda a,*args: f(a, *args) if (len(args)) else lambda *args: f(a, *args)

filter = curry(filter)
map = curry(map)

def _take(length, iter):
    res = []
    for a in iter:
        res.append(a)
        if len(res) == length:
            return res
        
take = curry(_take)
reduce = curry(reduce)

go = lambda *args: reduce(lambda a,f: f(a), args) ## 함수도 축약 가능 ##
##############################################################################################################
# The inputs to this node will be stored as a list in the IN variables.
dataEnteringNode = IN
fdns = IN[0]
columns = IN[1]
ag_columns = list(filter(lambda x: "UG" not in str(x.GetParameterValueByName("Type")), columns))
ug_columns = list(filter(lambda x: "UG" in str(x.GetParameterValueByName("Type")), columns))
beams = IN[2]
floors = IN[3]
roofs = IN[4]
# Place your code below this line

def chk_setOrder(cat1,cat2):
    res = []
    for i in cat1:
        for j in cat2:
            if i.AreJoined(j):
                Elements.Element.SetGeometryJoinOrder(i,j)
                res.append(f"[{i},{j}] - join order complete!")
            else:
                try:
                    i.JoinGeometry(j)
                    #Elements.Element.SetGeometryJoinOrder(i,j)
                    res.append(f"[{i},{j}] - newely joined and order complete!")
                except:
                    res.append(f"[{i},{j}] - nothing happened!")
            #res.append([i,j])
    return res

def organize_setOrder(fdns, columns, beams, floors, roofs):
#    res = map(lambda y: map(lambda x: x.AreJoined(y),fdns), columns)
    pass
    
#chk_setOrder(fdns,columns)


result = [chk_setOrder(ag_columns,ug_columns)]


# Assign your output to the OUT variable.
OUT = result
# ----------------------------------------
anyTrue = List.AnyTrue(list=python_script@L2)
