# Dynamo graph Bidding_Room Size_Injector.dyn (Dynamo 2.16.1.2727)

categories = Categories("OST_Rooms")
all_elements_of_category = ElementsOfCategory(Category=categories)
parameters = Element.Parameters(element=all_elements_of_category)
code_block = CodeBlock { "Name"; }
getParameterValueByName = Element.GetParameterValueByName(element=all_elements_of_category, parameterName=code_block)
code_block_2 = CodeBlock { "RACK ROOM"; }
contains = String.Contains(string=getParameterValueByName, searchFor=code_block_2)
filterByBoolMask = List.FilterByBoolMask(list=all_elements_of_category, mask=contains)
code_block_3 = CodeBlock(i=all_elements_of_category) { i; }
code_block_4 = CodeBlock()
# ---------- code_block_4.designscript (5 lines) ----------
[
"H_Room W",
"H_Room L",
"H_Room H or CH"
];
# ----------------------------------------
geometry = Element.Geometry(element=all_elements_of_category)
flatten = List.Flatten(list=geometry)
boundingBox = Geometry.BoundingBox(geometry=flatten)
toCuboid = BoundingBox.ToCuboid(boundingBox=boundingBox)
width = Cuboid.Width(cuboid=toCuboid)
length = Cuboid.Length(cuboid=toCuboid)
height = Cuboid.Height(cuboid=toCuboid)

# group: int wall thickness
categories_2 = Categories("OST_Walls")
all_elements_of_category_2 = ElementsOfCategory(Category=categories_2)
code_block_5 = CodeBlock { "Family and Type"; }
getParameterValueByName_2 = Element.GetParameterValueByName(element=all_elements_of_category_2, parameterName=code_block_5)
code_block_6 = CodeBlock { "Type Name"; }
getParameterValueByName_3 = Element.GetParameterValueByName(element=getParameterValueByName_2, parameterName=code_block_6)
code_block_7 = CodeBlock { "Int"; }
contains_2 = String.Contains(string=getParameterValueByName_3, searchFor=code_block_7)
filterByBoolMask_2 = List.FilterByBoolMask(list=all_elements_of_category_2, mask=contains_2)
code_block_8 = CodeBlock { "Family and Type"; }
getParameterValueByName_4 = Element.GetParameterValueByName(element=filterByBoolMask_2.in, parameterName=code_block_8)
code_block_9 = CodeBlock { "Width"; }
getParameterValueByName_5 = Element.GetParameterValueByName(element=getParameterValueByName_4, parameterName=code_block_9)
uniqueItems = List.UniqueItems(list=getParameterValueByName_5)
maximumItem = List.MaximumItem(list=uniqueItems)
parameters_2 = Element.Parameters(element=all_elements_of_category_2)
parameters_3 = Element.Parameters(element=getParameterValueByName_4)

python_script = Python(IN[0]=width, IN[1]=length, IN[2]=height, IN[3]=maximumItem)  # CPython3
# ---------- python_script.python (19 lines) ----------
# Load the Python Standard and DesignScript Libraries
import sys
import clr
clr.AddReference('ProtoGeometry')
from Autodesk.DesignScript.Geometry import *

import math

# The inputs to this node will be stored as a list in the IN variables.
dataEnteringNode = IN
[ws, ls, hs] = [IN[0], IN[1], IN[2]]
wallThk = IN[3]
# Place your code below this line

chk_size = lambda y: map(lambda x: round((x+wallThk)/100)*100, y)
chk_height = lambda y: map(lambda x: round(x/100)*100, y)
res = [chk_size(ws), chk_size(ls), chk_height(hs)]
# Assign your output to the OUT variable.
OUT = list(zip(*res))
# ----------------------------------------
setParameterByName = Element.SetParameterByName(element=code_block_3@@L1, parameterName=code_block_4, value=python_script@L2)
