# Dynamo graph 04 Str Foundation_mk(220112).dyn (Dynamo 2.12.0.5650)

# note: 되메우기기

# group: Primary Input : Excel & Revit Elements
categories = Categories("OST_StructuralFoundation")
all_elements_of_category = ElementsOfCategory(Category=categories)
string_from_web = Python()  # CPython3; unwired: IN[0]
# ---------- string_from_web.python (19 lines) ----------
# Load the Python Standard and DesignScript Libraries
import sys
import clr
clr.AddReference('ProtoGeometry')
from Autodesk.DesignScript.Geometry import *
import urllib.request

# The inputs to this node will be stored as a list in the IN variables.
dataEnteringNode = IN
inputURL = "https://raw.githubusercontent.com/HNANmal/mQ/master/Hdynlib/General/ImportExcel.py"

# Place your code below this line
req = urllib.request
data = req.urlopen(inputURL)

result = data.read().decode("utf-8")

# Assign your output to the OUT variable.
OUT = result
# ----------------------------------------
file_path = Filename("상상진화\20220110\DMS(Data Matching Schedule)_R0(Seq2)_220110.xlsx")  # graph input
sheet_name = CodeBlock { "Str Foundations"; }
github_python_import_excel_by = PythonStringNode(script=string_from_web, IN[0]=file_path, IN[1]=sheet_name)  # "Github_Python@Import Excel(By OpenpyXl)"; CPython3

code_block = CodeBlock { 15; }
removeItemAtIndex = List.RemoveItemAtIndex(list=all_elements_of_category, indices=code_block)

# group (continued): Primary Input : Excel & Revit Elements
code_block_2 = CodeBlock(InputElement=removeItemAtIndex, InputData=github_python_import_excel_by) { _InputElement; _InputData; }

# group: GetFull WMCodeDescription PerElement
excelDataManagerNode = Python(IN[0]=code_block_2._InputElement, IN[1]=code_block_2._InputData)  # CPython3
# ---------- excelDataManagerNode.python (279 lines) ----------
# Load the Python Standard and DesignScript Libraries
import os
import sys
sys.path.append(os.getenv('LOCALAPPDATA').replace('\\','\\\\') + r'\Programs\Python\Python39\Lib\site-packages')
import clr
clr.AddReference('RevitAPI')
import Autodesk

clr.AddReference('ProtoGeometry')
from Autodesk.DesignScript.Geometry import *

clr.AddReference('RevitNodes')
import Revit
clr.ImportExtensions(Revit.Elements)

clr.ImportExtensions(Revit.GeometryConversion)
clr.ImportExtensions(Revit.GeometryReferences)

clr.AddReference('RevitServices')
import RevitServices
from RevitServices.Persistence import DocumentManager
from RevitServices.Transactions import TransactionManager

doc = DocumentManager.Instance.CurrentDBDocument

import random
import itertools
from functools import reduce
from collections import Iterable
import datetime
import openpyxl

def iterable(obj):
    return isinstance(obj, Iterable)

def findUnique(inputs):
    result = []
    for i in inputs:
        if i in result:
            pass
        else:
            result.append(i)
    return result

# The inputs to this node will be stored as a list in the IN variables.
dataEnteringNode = IN
inputElements = IN[0]
inputData = IN[1]
#inputSheetName = IN[2]

def importExcel(path, SheetNameIn):
    wb_obj = openpyxl.load_workbook(str(path), data_only=True)
    sheet_obj = wb_obj.get_sheet_by_name(str(SheetNameIn))

    m_row = sheet_obj.max_row
    m_col = sheet_obj.max_column

    listOut = []

    for i in range(1, m_row +1):
        listTemp = []
        for j in range(1, m_col + 1):
            cell_obj = sheet_obj.cell(row=i, column=j)
            listTemp.append(cell_obj.value)
            if len(listTemp) == m_col:
                listOut.append(listTemp)
    return listOut

def getUsedFamilyTypeOfModeling(elements):
    familyCode = list(map(lambda x: x.Name.split('_')[0], elements))
    unq_familyCode = findUnique(familyCode)
    return unq_familyCode
    
def createExcelDataDictionary(values):
    result = {}
    for i in range(len(values)):
        result[str(i)] = values[i]
    return result

def findTargetIndex(targets, list):
    result = []
    for target in targets:
        for i in range(len(list)):
            if target in str(list[i]):
                result.append(i)
            else:
                pass
    result.sort()
    return result
    
def GetValueAtKeys(keys, dictionary):
    result = [] 
    for i in keys:
        result.append(dictionary[str(i)])
    return result


# Place your code below this line
usedFamilyTypeOfModeling = getUsedFamilyTypeOfModeling(inputElements)
excelWholeDataSet = inputData#importExcel(inputFilePath, inputSheetName)
trExcelWholeDataSet = list(zip(*excelWholeDataSet))
excelColumnDataSet = createExcelDataDictionary(trExcelWholeDataSet)
excelRowDataSet = createExcelDataDictionary(excelWholeDataSet)
ColumnIndexOfUsedFamilyType = findTargetIndex(usedFamilyTypeOfModeling, trExcelWholeDataSet)
ColDataSetOfUsedFamilyType = GetValueAtKeys(ColumnIndexOfUsedFamilyType, excelColumnDataSet)
materialPerElementFromModeling = []
for i in inputElements:
    materialPerElementFromModeling.append(i.GetMaterials())
#list(map(lambda x: x.GetMaterials, inputElements)) "맵함수로 처리하면 리스트화 할 때 타입 변환 오류 남"

targetWMRowIndex = []
for i in ColDataSetOfUsedFamilyType:
    targetWMRowIndex.append(findTargetIndex(['000'], i))

rowDataSetOfUsedWM = []
for i in targetWMRowIndex:
    rowDataSetOfUsedWM.append(GetValueAtKeys(i, excelRowDataSet))

workGroup = []
for i in rowDataSetOfUsedWM:
    tmp = []
    for j in i:
        tmp.append(j[0])
    workGroup.append(tmp)
    
workMaster = []
for i in range(len(ColDataSetOfUsedFamilyType)):
    tmp=[]
    for k in targetWMRowIndex[i]:
        tmp.append(ColDataSetOfUsedFamilyType[i][k])
    workMaster.append(tmp)

matchedWM = []
for i in range(len(workGroup)):
    tmp = []
    for j in range(len(workGroup[i])):
        fullWM = workGroup[i][j] +"-"+ workMaster[i][j]
        tmp.append(fullWM)
    matchedWM.append(tmp)

matchedWorkGruopAndMasterCode = []
for i in matchedWM:
    if len(i) > 0:
        matchedWorkGruopAndMasterCode.append(i)
    else:
        pass

matchedWMDescription = []
for i in rowDataSetOfUsedWM:
    tmp=[]
    for j in i:
        tmp.append(j[1] +" "+ j[2] +" "+ j[3] +" "+ "("+ j[4] +")")
    if len(tmp) > 0:
        matchedWMDescription.append(tmp)
    else:
        pass

matchedWMUnit = []
for i in rowDataSetOfUsedWM:
    tmp=[]
    for j in i:
        tmp.append(j[4])
    if len(tmp) > 0:
        matchedWMUnit.append(tmp)
    else:
        pass

matchedWorkGruopAndMasterCode_flat = list(itertools.chain(*matchedWorkGruopAndMasterCode))
matchedWMDescription_flat = list(itertools.chain(*matchedWMDescription))

dic_WMandDescription_Excel = {}
for i in range(len(matchedWorkGruopAndMasterCode_flat)):
    dic_WMandDescription_Excel[matchedWorkGruopAndMasterCode_flat[i]] = matchedWMDescription_flat[i]

usedFamilyTypeInExcelOrder = list(map(lambda x: x[3], ColDataSetOfUsedFamilyType))
usedFamilyCodeInExcelOrder = findUnique(list(map(lambda x: x.split('_')[0], usedFamilyTypeInExcelOrder)))

dic_FamilyCodeandWM = {}
for i in range(len(usedFamilyCodeInExcelOrder)):
    dic_FamilyCodeandWM[usedFamilyCodeInExcelOrder[i]] = matchedWorkGruopAndMasterCode[i]

workMasterCodePerElement = []
familyCodePerElem = list(map(lambda x: x.Name.split('_')[0], inputElements))
for i in familyCodePerElem:
    workMasterCodePerElement.append(dic_FamilyCodeandWM[i])

materialNamePerElem = []
for i in materialPerElementFromModeling:
    tmp = []
    for j in i:
        tmp.append(j.Name)
    materialNamePerElem.append(tmp)

WMPerElementFromModeling = []
for i in materialNamePerElem:
    tmp = []
    for j in i:
        tmp.append(j.split('_')[0])
    WMPerElementFromModeling.append(tmp)

specPerElementFromModeling = []
for i in materialNamePerElem:
    tmp = []
    for j in i:
        a = j.split('_')
        del a[0]
        b = " ".join(a)
        tmp.append(b)
    specPerElementFromModeling.append(tmp)

WMPerElementFromModeling_flat = list(itertools.chain(*WMPerElementFromModeling))
specPerElementFromModeling_flat = list(itertools.chain(*specPerElementFromModeling))

dic_WMandDescription_Model = {}
for i in range(len(WMPerElementFromModeling_flat)):
    dic_WMandDescription_Model[WMPerElementFromModeling_flat[i]] = specPerElementFromModeling_flat[i]

def findAllKeys(dict):
    result = []
    for key in dict.keys():
        result.append(key)
    return result

def findAllValues(dict):
    result = []
    for key in dict.keys():
        result.append(dict[key])
    return result

keys_WMandDescription_Model = findAllKeys(dic_WMandDescription_Model)
keys_WMandDescription_Excel = findAllKeys(dic_WMandDescription_Excel)

keys_WMandDescription_Both = list(set(keys_WMandDescription_Model + keys_WMandDescription_Excel))
values_WMandDescription_Both = []
for i in keys_WMandDescription_Both:
    if i in keys_WMandDescription_Model:
        values_WMandDescription_Both.append(dic_WMandDescription_Model[i])
    else:
        values_WMandDescription_Both.append(dic_WMandDescription_Excel[i])

dic_WMandDescription_Both = {}
for i in range(len(keys_WMandDescription_Both)):
    dic_WMandDescription_Both[keys_WMandDescription_Both[i]] = values_WMandDescription_Both[i]

workMasterCodePerElementFromBoth = []
for i in range(len(workMasterCodePerElement)):
    #tmp = []
    a = WMPerElementFromModeling[i] + workMasterCodePerElement[i]
    b = findUnique(a)
    workMasterCodePerElementFromBoth.append(b)

specPerElement = []
for i in workMasterCodePerElementFromBoth:
    tmp = []
    for j in i:
        tmp.append(dic_WMandDescription_Both[j])
    specPerElement.append(tmp)

fullWMCodeDescriptionPerElement = []
for i in range(len(workMasterCodePerElementFromBoth)):
    tmp = []
    for j in range(len(workMasterCodePerElementFromBoth[i])):
        a = workMasterCodePerElementFromBoth[i][j] +": "+ specPerElement[i][j]
        tmp.append(a)
    fullWMCodeDescriptionPerElement.append(tmp)

fullWMinfo = {
"AllElement": inputElements,
"WorkMasterCodePerFamilyType": dic_FamilyCodeandWM,
"WorkMasterCodePerElementBoth": workMasterCodePerElementFromBoth,
"FullWMCodeDescriptionPerElement": fullWMCodeDescriptionPerElement
}



result = fullWMinfo

# Assign your output to the OUT variable.
OUT = result
# ----------------------------------------

# group: Organize AllElementInform AsDictionary
set_up_all_element_inform_as = Python(IN[0]=excelDataManagerNode)  # "Set Up All Element Inform as Dictionary"; CPython3
# ---------- set_up_all_element_inform_as.python (119 lines) ----------
# Load the Python Standard and DesignScript Libraries
import os
import sys
sys.path.append(os.getenv('LOCALAPPDATA').replace('\\','\\\\') + r'\Programs\Python\Python39\Lib\site-packages')
import clr
clr.AddReference('RevitAPI')
import Autodesk

clr.AddReference('ProtoGeometry')
from Autodesk.DesignScript.Geometry import *

clr.AddReference('RevitNodes')
import Revit
clr.ImportExtensions(Revit.Elements)

clr.ImportExtensions(Revit.GeometryConversion)
clr.ImportExtensions(Revit.GeometryReferences)

clr.AddReference('RevitServices')
import RevitServices
from RevitServices.Persistence import DocumentManager
from RevitServices.Transactions import TransactionManager

doc = DocumentManager.Instance.CurrentDBDocument

import random
import itertools
from functools import reduce
from collections import Iterable
import datetime
import openpyxl

def iterable(obj):
    return isinstance(obj, Iterable)

def findUnique(inputs):
    result = []
    for i in inputs:
        if i in result:
            pass
        else:
            result.append(i)
    return result

# The inputs to this node will be stored as a list in the IN variables.
dataEnteringNode = IN
inputDict = IN[0]


def importExcel(path, SheetNameIn):
    wb_obj = openpyxl.load_workbook(str(path), data_only=True)
    sheet_obj = wb_obj.get_sheet_by_name(str(SheetNameIn))

    m_row = sheet_obj.max_row
    m_col = sheet_obj.max_column

    listOut = []

    for i in range(1, m_row +1):
        listTemp = []
        for j in range(1, m_col + 1):
            cell_obj = sheet_obj.cell(row=i, column=j)
            listTemp.append(cell_obj.value)
            if len(listTemp) == m_col:
                listOut.append(listTemp)
    return listOut

def getUsedFamilyTypeOfModeling(elements):
    familyCode = list(map(lambda x: x.Name.split('_')[0], elements))
    unq_familyCode = findUnique(familyCode)
    return unq_familyCode
    
def createExcelDataDictionary(values):
    result = {}
    for i in range(len(values)):
        result[str(i)] = values[i]
    return result

def findTargetIndex(targets, list):
    result = []
    for target in targets:
        for i in range(len(list)):
            if target in str(list[i]):
                result.append(i)
            else:
                pass
    result.sort()
    return result
    
def GetValueAtKeys(keys, dictionary):
    result = [] 
    for i in keys:
        result.append(dictionary[str(i)])
    return result


# Place your code below this line
element = inputDict["AllElement"]
elementType = []
for i in element:
    elementType.append(i.Name)
familyCode = []
for i in elementType:
    familyCode.append(i.split("_")[0])
fullWMCodeDescriptionPerElement = inputDict["FullWMCodeDescriptionPerElement"]

resultDict = {
"Element": element,
"ElementType": elementType,
"FamilyCode": familyCode,
"FullWMCodeDescriptionPerElement": fullWMCodeDescriptionPerElement
}



result = resultDict

# Assign your output to the OUT variable.
OUT = result
# ----------------------------------------

# group: Select Target Family Element And Connected WorkMasters
code_block_3 = CodeBlock { 0; }
select_target_family_element_and = Python(IN[0]=set_up_all_element_inform_as, IN[1]=code_block_3)  # "Select Target Family Element And Connected WorkMasters"; CPython3
# ---------- select_target_family_element_and.python (138 lines) ----------
# Load the Python Standard and DesignScript Libraries
import os
import sys
sys.path.append(os.getenv('LOCALAPPDATA').replace('\\','\\\\') + r'\Programs\Python\Python39\Lib\site-packages')
import clr
clr.AddReference('RevitAPI')
import Autodesk

clr.AddReference('ProtoGeometry')
from Autodesk.DesignScript.Geometry import *

clr.AddReference('RevitNodes')
import Revit
clr.ImportExtensions(Revit.Elements)

clr.ImportExtensions(Revit.GeometryConversion)
clr.ImportExtensions(Revit.GeometryReferences)

clr.AddReference('RevitServices')
import RevitServices
from RevitServices.Persistence import DocumentManager
from RevitServices.Transactions import TransactionManager

doc = DocumentManager.Instance.CurrentDBDocument

import random
import itertools
from functools import reduce
from collections import Iterable
import datetime
import openpyxl

def iterable(obj):
    return isinstance(obj, Iterable)

def findUnique(inputs):
    result = []
    for i in inputs:
        if i in result:
            pass
        else:
            result.append(i)
    return result

# The inputs to this node will be stored as a list in the IN variables.
dataEnteringNode = IN
inputDict = IN[0]
inputIndex = IN[1]


def importExcel(path, SheetNameIn):
    wb_obj = openpyxl.load_workbook(str(path), data_only=True)
    sheet_obj = wb_obj.get_sheet_by_name(str(SheetNameIn))

    m_row = sheet_obj.max_row
    m_col = sheet_obj.max_column

    listOut = []

    for i in range(1, m_row +1):
        listTemp = []
        for j in range(1, m_col + 1):
            cell_obj = sheet_obj.cell(row=i, column=j)
            listTemp.append(cell_obj.value)
            if len(listTemp) == m_col:
                listOut.append(listTemp)
    return listOut

def getUsedFamilyTypeOfModeling(elements):
    familyCode = list(map(lambda x: x.Name.split('_')[0], elements))
    unq_familyCode = findUnique(familyCode)
    return unq_familyCode
    
def createExcelDataDictionary(values):
    result = {}
    for i in range(len(values)):
        result[str(i)] = values[i]
    return result

def findTargetIndex(targets, list):
    result = []
    for target in targets:
        for i in range(len(list)):
            if target in str(list[i]):
                result.append(i)
            else:
                pass
    result.sort()
    return result
    
def GetValueAtKeys(keys, dictionary):
    result = [] 
    for i in keys:
        result.append(dictionary[str(i)])
    return result


# Place your code below this line
fullWMCodeDescriptionPerElement = inputDict["FullWMCodeDescriptionPerElement"]
element = inputDict["Element"]
familyCode = inputDict["FamilyCode"]
familyCode_unique = findUnique(familyCode)
targetFamilyCode = familyCode_unique[inputIndex]
targetIndex = []
for i in range(len(familyCode)):
    if targetFamilyCode in familyCode[i]:
        targetIndex.append(i)
    else:
        pass

targetElements = []
for i in targetIndex:
    targetElements.append(element[i])

targetFamilyCode = []
for i in targetIndex:
    targetFamilyCode.append(element[i].Name)

WMforTargetElements = []
for i in targetIndex:
    WMforTargetElements.append(fullWMCodeDescriptionPerElement[i])

WMforTargetElements_flat = list(itertools.chain(*WMforTargetElements))
targetWMunique = findUnique(WMforTargetElements_flat)

resultDict = {
"TargetElements": targetElements,
"TargetFamilyCode": targetFamilyCode,
"WMforTargetElements": WMforTargetElements,
"TargetWMunique": targetWMunique
}



result = resultDict

# Assign your output to the OUT variable.
OUT = result
# ----------------------------------------

code_block_4 = CodeBlock(i=select_target_family_element_and) { i; }

# group: <Func 8> Input Manager
value_for_import_from_others = CodeBlock(MainInput=code_block_4) { MainInput; RefInput1; RefInput2; }  # unwired: RefInput1, RefInput2

# group: <Func 8> Sheet Memebrane
code_block_5 = CodeBlock { "TargetElements"; }
valueAtKey = DesignScript.Builtin.Dictionary.ValueAtKey(dictionary=value_for_import_from_others.MainInput, key=code_block_5)
# note: <Func>
createLeanConcrete = Custom[CreateLeanConcrete](Element=valueAtKey)
area = Surface.Area(surface=createLeanConcrete.Surface)
code_block_6 = CodeBlock(i=area) { Math.Round(List.Flatten(i)/1000000, 2); }
code_block_7 = CodeBlock { "M2"; }
count = List.Count(list=code_block_6)
ofRepeatedItem = List.OfRepeatedItem(item=code_block_7, amount=count)
code_block_8 = CodeBlock(FuncValues=code_block_6, FuncValuesUnit=ofRepeatedItem)
# ---------- code_block_8.designscript (4 lines) ----------
{
"FuncValues": _FuncValues,
"FuncValuesUnit": _FuncValuesUnit
};
# ----------------------------------------

# group: <Func 8> Output Manager
output = CodeBlock(MainOutput=code_block_8) { MainOutput; RefOutput_geoColor; }  # unwired: RefOutput_geoColor
reference_output = CodeBlock { ref; }  # unwired: ref

# group: <Func 9> Input Manager
value_for_import_from_others_2 = CodeBlock(MainInput=code_block_4) { MainInput; RefInput1; RefInput2; }  # unwired: RefInput1, RefInput2

# group: <Func 9> Membrane Protection Board (측면 + 상부면 중 pedestal 점유면적 제외)
code_block_9 = CodeBlock { "TargetElements"; }
# note: <Func>
valueAtKey_2 = DesignScript.Builtin.Dictionary.ValueAtKey(dictionary=value_for_import_from_others_2.MainInput, key=code_block_9)
code_block_10 = CodeBlock(Element=valueAtKey_2) { _Element; }
extractUpperFacesOfElement = Custom[ExtractUpperFacesOfElement](Element=code_block_10)
flatten = List.Flatten(list=extractUpperFacesOfElement.Surface)
getJoinedElements = Element.GetJoinedElements(element=code_block_10)
flatten_2 = List.Flatten(list=getJoinedElements)
extractBelowFacesOfElement = Custom[ExtractBelowFacesOfElement](Element=flatten_2)
flatten_3 = List.Flatten(list=extractBelowFacesOfElement.Surface)
doesIntersect = Geometry.DoesIntersect(geometry=flatten_3, other=flatten, lacing=CrossProduct)
code_block_11 = CodeBlock { true; }
allIndicesOf = List.AllIndicesOf(list=doesIntersect@L2, item=code_block_11)
flatten_4 = List.Flatten(list=allIndicesOf)
groupByKey = List.GroupByKey(list=flatten_3, keys=flatten_4)
difference = Surface.Difference(surface=flatten, others=groupByKey.groups)
extractSideFacesOfElement = Custom[ExtractSideFacesOfElement](Element=code_block_10)
addItemToFront = List.AddItemToFront(item=difference@L1, list=extractSideFacesOfElement.Surface@L2)
area_2 = Surface.Area(surface=addItemToFront)
sum = Math.Sum(values=area_2)
code_block_12 = CodeBlock(i=sum) { Math.Round(List.Flatten(i)/1000000, 2); }
code_block_13 = CodeBlock { "M2"; }
count_2 = List.Count(list=code_block_12)
ofRepeatedItem_2 = List.OfRepeatedItem(item=code_block_13, amount=count_2)
code_block_14 = CodeBlock(FuncValues=code_block_12, FuncValuesUnit=ofRepeatedItem_2)  # same code as code_block_8
color_palette = ColorPalette({R: 30, G: 144, B: 255, A: 129})
byGeometryColor = Modifiers.GeometryColor.ByGeometryColor(geometry=addItemToFront, color=color_palette)

# group: <Func 9> Output Manager
output_2 = CodeBlock(MainOutput=code_block_14, RefOutput_geoColor=byGeometryColor) { MainOutput; RefOutput_geoColor; }
reference_output_2 = CodeBlock { ref; }  # unwired: ref

join = List.Join(list8=output.MainOutput, list9=output_2.MainOutput)  # unwired: list0, list1, list2, list3, list4, list5, list6, list7

# group: TargetWMunique + Data Sending
code_block_15 = CodeBlock(InputDic2=join) { _InputDic2; }
count_3 = List.Count(list=code_block_15)
code_block_16 = CodeBlock(InputDic1=code_block_4) { _InputDic1; }
code_block_17 = CodeBlock { "TargetWMunique"; }
valueAtKey_3 = DesignScript.Builtin.Dictionary.ValueAtKey(dictionary=code_block_16, key=code_block_17)
watch = Watch(valueAtKey_3)
count_4 = List.Count(list=watch)
eq = count_3 == count_4
organizeFuncValuesAndWorkMasterAsDiction = Custom[OrganizeFuncValuesAndWorkMasterAsDictionary](InputDic1=code_block_16, InputDic2=code_block_15)
watch_2 = Watch()  # unwired: arg0
if_ = If(test=eq, true=organizeFuncValuesAndWorkMasterAsDiction, false=watch_2)

# group: 데이터 취합 및 Row 방향 정렬
code_block_18 = CodeBlock(InputDic=if_) { _InputDic; }
code_block_19 = CodeBlock { "TrTargetFamilyCode"; }
valueAtKey_4 = DesignScript.Builtin.Dictionary.ValueAtKey(dictionary=code_block_18, key=code_block_19)
watch_3 = Watch(valueAtKey_4)
flatten_5 = List.Flatten(list=watch_3)
code_block_20 = CodeBlock { "WMforTargetElements"; }
valueAtKey_5 = DesignScript.Builtin.Dictionary.ValueAtKey(dictionary=code_block_18, key=code_block_20)
watch_4 = Watch(valueAtKey_5)
flatten_6 = List.Flatten(list=watch_4)
code_block_21 = CodeBlock { "TargetFuncValues"; }
valueAtKey_6 = DesignScript.Builtin.Dictionary.ValueAtKey(dictionary=code_block_18, key=code_block_21)
watch_5 = Watch(valueAtKey_6)
flatten_7 = List.Flatten(list=watch_5)
code_block_22 = CodeBlock { "TargetFuncValuesUnit"; }
valueAtKey_7 = DesignScript.Builtin.Dictionary.ValueAtKey(dictionary=code_block_18, key=code_block_22)
watch_6 = Watch(valueAtKey_7)
flatten_8 = List.Flatten(list=watch_6)
list_create = List.Create(item0=flatten_5, item1=flatten_6, item2=flatten_7, item3=flatten_8)
transpose = List.Transpose(lists=list_create)

# group: <Func 6> Visual Manager
visual_켜기_끄기 = BoolSelector(true)
visual_manager = Python(IN[0]=output_2.RefOutput_geoColor, IN[1]=visual_켜기_끄기)  # CPython3
# ---------- visual_manager.python (18 lines) ----------
# Load the Python Standard and DesignScript Libraries
import sys
import clr
clr.AddReference('ProtoGeometry')
from Autodesk.DesignScript.Geometry import *

# The inputs to this node will be stored as a list in the IN variables.
dataEnteringNode = IN
geoColors = IN[0]
blnForVisual = IN[1]

# Place your code below this line
if blnForVisual == True:
    result = geoColors
else:
    result = 0
# Assign your output to the OUT variable.
OUT = result
# ----------------------------------------

# group: 사용된 패밀리 타입 종류 확인 구간
code_block_23 = CodeBlock { "ElementType"; }
valueAtKey_8 = DesignScript.Builtin.Dictionary.ValueAtKey(dictionary=set_up_all_element_inform_as, key=code_block_23)
uniqueItems = List.UniqueItems(list=valueAtKey_8)
watch_7 = Watch(uniqueItems)
code_block_24 = CodeBlock { "FamilyCode"; }
valueAtKey_9 = DesignScript.Builtin.Dictionary.ValueAtKey(dictionary=set_up_all_element_inform_as, key=code_block_24)
uniqueItems_2 = List.UniqueItems(list=valueAtKey_9)
watch_8 = Watch(uniqueItems_2)

# group: Input Manager
value_for_import_from_others_3 = CodeBlock(MainInput=code_block_4) { MainInput; RefInput1; RefInput2; }  # unwired: RefInput1, RefInput2

# group: <Func 00>Crushed Stone
code_block_25 = CodeBlock { "TargetElements"; }
valueAtKey_10 = DesignScript.Builtin.Dictionary.ValueAtKey(dictionary=value_for_import_from_others_3.MainInput, key=code_block_25)
# note: <Func>
code_block_26 = CodeBlock { 300; 100; }
createBaseCourseSurfaces = Custom[CreateBaseCourseSurfaces](Element=valueAtKey_10, BaseCourseOffsetBottom=code_block_26.out0, leanThick=code_block_26.out1)
boolean = BoolSelector(false)
thicken = Surface.Thicken(surface=createBaseCourseSurfaces.Surface, thickness=code_block_26.out0, both_sides=boolean)
volume = Solid.Volume(solid=thicken)
code_block_27 = CodeBlock(i=volume) { Math.Round(List.Flatten(i)/1000000000, 2); }
code_block_28 = CodeBlock { "M3"; }
count_5 = List.Count(list=code_block_27)
ofRepeatedItem_3 = List.OfRepeatedItem(item=code_block_28, amount=count_5)
code_block_29 = CodeBlock(FuncValues=code_block_27, FuncValuesUnit=ofRepeatedItem_3)  # same code as code_block_8

# group: Output Manager
output_3 = CodeBlock(MainOutput=code_block_29) { MainOutput; RefOutput_geoColor; }  # unwired: RefOutput_geoColor
reference_output_3 = CodeBlock { ref; }  # unwired: ref

code_block_30 = CodeBlock(i=set_up_all_element_inform_as) { i["ElementType"]; }
uniqueItems_3 = List.UniqueItems(list=code_block_30)

# group: 개념도
code_block_31 = CodeBlock { getTargetGeometry; }  # unwired: getTargetGeometry
code_block_32 = CodeBlock { calculate; }  # unwired: calculate
code_block_33 = CodeBlock { correctValue; }  # unwired: correctValue
assemble_function = Python(IN[0]=code_block_31, IN[1]=code_block_32, IN[2]=code_block_33)  # CPython3; frozen
# ---------- assemble_function.python (20 lines) ----------
# Load the Python Standard and DesignScript Libraries
import sys
import clr
clr.AddReference('ProtoGeometry')
from Autodesk.DesignScript.Geometry import *

# The inputs to this node will be stored as a list in the IN variables.
dataEnteringNode = IN

# Place your code below this line
def judgeWM(wm, elem):
    if elem.element
    pass

def assembleFunc(targetGeofunc, getvaluefunc, correctfunc):
    pass


# Assign your output to the OUT variable.
OUT = 0
# ----------------------------------------

create_calcds = Python(IN[0]=excelDataManagerNode)  # CPython3; frozen; unwired: IN[1], IN[2]
# ---------- create_calcds.python (64 lines) ----------
# Load the Python Standard and DesignScript Libraries
import sys
import clr
clr.AddReference('ProtoGeometry')
from Autodesk.DesignScript.Geometry import *

# The inputs to this node will be stored as a list in the IN variables.
dataEnteringNode = IN
allElem = IN[0]["AllElement"]
wmCodePerElem = IN[0]["WorkMasterCodePerElementBoth"]
wmDescPerElem = IN[0]["FullWMCodeDescriptionPerElement"]

def pairForDs(allElem, wmDescPerElem):
    result = []
    for i in range(len(allElem)):
        result.append((allElem[i], wmDescPerElem[i]))
    return result
    
allPair = pairForDs(allElem, wmDescPerElem)
# Place your code below this line

    
def create_CalcDS(pair):
    #init#
    elem = pair[0]
    wmDescPerElem = pair[1]
    name = elem.Name
    familyCode = name.split("_")[0]
    geometry = elem.Geometry()[0]
    familyClass = elem.ElementType.GetParameterValueByName("Family Name")
    def findLevel():
        if "Wall" in familyClass:
            level = elem.GetParameterValueByName("Base Constraint")
        elif "Column" in familyClass:
            level = elem.GetParameterValueByName("Base Level")
        elif "Stair" in familyClass:
            level = elem.GetParameterValueByName("Base Level")
        elif "Beam" in familyClass:
            level = elem.GetParameterValueByName("Reference Level")
        else:
            level = elem.GetParameterValueByName("Level")
        return level
    level = findLevel()
    
    result = {
        "name": name,
        "elem": elem,
        "familyCode": familyCode,
        "familyClass": familyClass,
        "level": level,
        "geometry": geometry,
        "wmDescPerElem": wmDescPerElem,
        #"": ,
        }
    return result

#result = list(
#                map(lambda i:
#                    map(lambda j: create_CalcDS(i, j), wmDescPerElem)
#                , allElem)
#              )
result = [create_CalcDS(i) for i in allPair]
# Assign your output to the OUT variable.
OUT = result
# ----------------------------------------
elementType = Element.ElementType(element=code_block_2._InputElement)
parameters = Element.Parameters(element=elementType)
code_block_34 = CodeBlock { "Family Name"; }
getParameterValueByName = Element.GetParameterValueByName(element=elementType, parameterName=code_block_34)
getParameterValueByName_2 = Element.GetParameterValueByName()  # unwired: element, parameterName
createElemDS = Python(IN[0]=set_up_all_element_inform_as)  # CPython3
# ---------- createElemDS.python (47 lines) ----------
# Load the Python Standard and DesignScript Libraries
import sys
import clr
clr.AddReference('ProtoGeometry')
from Autodesk.DesignScript.Geometry import *

# The inputs to this node will be stored as a list in the IN variables.
dataEnteringNode = IN
elemDics = IN[0]
elems = elemDics["Element"]
elemTypes = elemDics["ElementType"]
WMperElems = elemDics["FullWMCodeDescriptionPerElement"]
idx = range(len(elems))
# Place your code below this line
def ElemDS(i, elems, elemTypes, WMperElems):
    elem = elems[i]
    elemType = elemTypes[i]
    familyCode = elemType.split('_')[0]
    WMperElem = WMperElems[i]
    familyClass = elem.ElementType.GetParameterValueByName("Family Name")
    
    def findLevel():
        if "Wall" in familyClass:
            level = elem.GetParameterValueByName("Base Constraint")
        elif "Column" in familyClass:
            level = elem.GetParameterValueByName("Base Level")
        elif "Stair" in familyClass:
            level = elem.GetParameterValueByName("Base Level")
        elif "Beam" in familyClass:
            level = elem.GetParameterValueByName("Reference Level")
        else:
            level = elem.GetParameterValueByName("Level")
        return level
    level = findLevel()
    
    result = {
        "elem": elem,
        "elemType": elemType,
        "level": level,
        "familyCode": familyCode,
        "WMperElem": WMperElem,
    }
    
    return result

# Assign your output to the OUT variable.
OUT = [ElemDS(i, elems, elemTypes, WMperElems) for i in idx]
# ----------------------------------------
콘크리트물량산출함수 = Python()  # CPython3; unwired: IN[0]
# ---------- 콘크리트물량산출함수.python (64 lines) ----------
# Load the Python Standard and DesignScript Libraries
import sys
import clr
clr.AddReference('RevitAPI')
from Autodesk.Revit.DB import *
import Autodesk

clr.AddReference('RevitNodes')
import Revit
clr.ImportExtensions(Revit.Elements)

clr.AddReference('RevitServices')
import RevitServices
from RevitServices.Persistence import DocumentManager
doc = DocumentManager.Instance.CurrentDBDocument
collector1 = FilteredElementCollector(doc)
collector2 = FilteredElementCollector(doc)
collector3 = FilteredElementCollector(doc)
collector4 = FilteredElementCollector(doc)
collector5 = FilteredElementCollector(doc)

clr.AddReference('ProtoGeometry')
from Autodesk.DesignScript.Geometry import *

from itertools import chain

allFdns = collector1.OfCategory(BuiltInCategory.OST_StructuralFoundation).WhereElementIsNotElementType().ToElements()
allCols = collector2.OfCategory(BuiltInCategory.OST_StructuralColumns).WhereElementIsNotElementType().ToElements()
allBeams = collector3.OfCategory(BuiltInCategory.OST_StructuralFraming).WhereElementIsNotElementType().ToElements()
allFloors = collector4.OfCategory(BuiltInCategory.OST_Floors).WhereElementIsNotElementType().ToElements()
_allEdges = collector5.OfCategory(BuiltInCategory.OST_EdgeSlab).WhereElementIsNotElementType().ToElements()
allIsoFdns = [i.ToDSType(False) for i in allFdns if "Footing-" in i.Name]
allPeds = [i.ToDSType(False) for i in allCols if "UG" in i.Name]
allPedsGeo = [i.Geometry()[0] for i in allPeds]
allTGs = [i.ToDSType(False) for i in allBeams if "TG" in i.Name]
allTGsGeo = [i.Geometry()[0] for i in allTGs]
allSOGs = [i.ToDSType(False) for i in allFdns if "SOG" in i.Name and "GS" in i.Name]
allSOGsGeo = [i.Geometry()[0] for i in allSOGs]
allEdges = [i.ToDSType(False) for i in _allEdges]
allEdgesGeo = [i.Geometry()[0] for i in allEdges]
allFdnAndHaunch = [i.ToDSType(False) for i in allFdns+_allEdges]
allFdnAndHaunchGeo = [i.Geometry()[0] for i in allFdnAndHaunch]
# The inputs to this node will be stored as a list in the IN variables.
dataEnteringNode = IN
inputs = IN[0]
# Place your code below this line
def 콘크리트물량산출함수(input):
    if "Footing-Rectangular" in input.Name:
        target = input
        
        return (target.Geometry()[0], target.GetParameterValueByName("Volume"), "M3")
    
    elif "SOG" in input.Name:
        inputGeo = input.Geometry()[0]
        간섭판별선 = PolyCurve.ByJoinedCurves([i for i in inputGeo.Explode() if round(i.NormalAtParameter(0.5,0.5).Z)==-1][0].PerimeterCurves()).Offset(-1)
        간섭판별면 = 간섭판별선.Patch()
        overlaps = [i for i in allEdgesGeo if 간섭판별면.DoesIntersect(i)]+[inputGeo]
        unionSolid = Solid.ByUnion(overlaps)
        target = unionSolid
        
        return (target, target.Volume/1000000000, "M3")

# Assign your output to the OUT variable.
OUT = (콘크리트물량산출함수,["Footing-Rectangular","SOG"],[": Structural Concrete"],["M3"])
# ----------------------------------------
거푸집산출함수 = Python()  # CPython3; unwired: IN[0]
# ---------- 거푸집산출함수.python (35 lines) ----------
# Load the Python Standard and DesignScript Libraries
import sys
import clr
clr.AddReference('RevitAPI')
from Autodesk.Revit.DB import *
import Autodesk

clr.AddReference('RevitNodes')
import Revit
clr.ImportExtensions(Revit.Elements)

clr.AddReference('RevitServices')
import RevitServices
from RevitServices.Persistence import DocumentManager
doc = DocumentManager.Instance.CurrentDBDocument
collector = FilteredElementCollector(doc)#Autodesk.Revit.DB.FilteredElementCollector(doc)

clr.AddReference('ProtoGeometry')
from Autodesk.DesignScript.Geometry import *

from itertools import chain

# The inputs to this node will be stored as a list in the IN variables.
dataEnteringNode = IN
_inputs = IN[0]
# Place your code below this line
def 거푸집산출함수(input):
    geo = input.Geometry()[0]
    allSrf = geo.Explode()
    sideSrf = [i for i in allSrf if round(i.NormalAtParameter(0.5,0.5).Z)==0]
    
    return (sideSrf, sum([i.Area for i in sideSrf])/1000000, "M2")

# Assign your output to the OUT variable.
OUT = (거푸집산출함수,["Footing-Rectangular"],[": Form"],["M2"])
# ----------------------------------------
온통_터파기_여부 = BoolSelector(false)  # graph input
터파기_하부_offset = DoubleInput(300)  # graph input
버림thk = DoubleInput(50)  # graph input
경사_비율_입력_1_x_for_isofdn = DoubleInput(2)  # graph input
터파기산출함수 = Python(IN[1]=온통_터파기_여부, IN[3]=터파기_하부_offset, IN[4]=버림thk, IN[5]=경사_비율_입력_1_x_for_isofdn)  # CPython3; unwired: IN[0], IN[2]
# ---------- 터파기산출함수.python (107 lines) ----------
# Load the Python Standard and DesignScript Libraries
import sys
import clr

clr.AddReference('RevitAPI')
from Autodesk.Revit.DB import *
import Autodesk

clr.AddReference('RevitNodes')
import Revit
clr.ImportExtensions(Revit.Elements)

clr.AddReference('RevitServices')
import RevitServices
from RevitServices.Persistence import DocumentManager
doc = DocumentManager.Instance.CurrentDBDocument
collector1 = FilteredElementCollector(doc)#Autodesk.Revit.DB.FilteredElementCollector(doc)

clr.AddReference('ProtoGeometry')
from Autodesk.DesignScript.Geometry import *

allFdns = collector1.OfCategory(BuiltInCategory.OST_StructuralFoundation).WhereElementIsNotElementType().ToElements()
allIsoFdns = [i.ToDSType(False) for i in allFdns if "Footing-" in i.Name]

# The inputs to this node will be stored as a list in the IN variables.
dataEnteringNode = IN
refFunc = IN[0]
wholeExcavationBln = IN[1]
inputDS = IN[2]
bttmOffset = IN[3]
버림thk = IN[4]
slopeExcav = IN[5]



# Place your code below this line

def 터파기산출함수(input):
    targets = []
    
    if wholeExcavationBln:
        calcTargetNum = len(allIsoFdns)
        fdnsGeo = [i.Geometry()[0] for i in allIsoFdns]
        bdBox_fdn = BoundingBox.ByGeometry(fdnsGeo).ToCuboid()
        srfs = bdBox_fdn.Explode()
        belowSrf = [i for i in srfs if i.NormalAtParameter(0.5,0.5).Z == -1][0]
        def getSrfHeight(srf):
            _crvs = srf.PerimeterCurves()
            heights = [i.StartPoint.Z for i in _crvs]
            height = min(heights)
            return height
        belowSrf_height = getSrfHeight(belowSrf)
        
        def findLeanThk(leanobj):
            if leanobj:
                return leanobj.GetParameterValueByName("thk")
            else:
                return 버림thk
        leanobj = None
        leanthk = findLeanThk(leanobj)
        
        def offsetCrv(crv, offset=300):
            return crv.Offset(offset)
        def correctElev(crv, thk):
            return crv.Translate(0,0,thk)
        _exca_belowbdry = offsetCrv(PolyCurve.ByJoinedCurves(belowSrf.PerimeterCurves()), bttmOffset)
        exca_belowbdry = correctElev(_exca_belowbdry, -버림thk)
        _exca_upperbdry = correctElev(_exca_belowbdry, -belowSrf_height)
        exca_upperbdry = offsetCrv(_exca_upperbdry, -belowSrf_height/slopeExcav)
        target = Solid.ByLoft([exca_belowbdry,exca_upperbdry])#excavation_solid
        
        
    else:
        calcTargetNum = 1
        srfs = input.Geometry()[0].Explode()
        belowSrf = [i for i in srfs if i.NormalAtParameter(0.5,0.5).Z == -1][0]
        
        def getSrfHeight(srf):
            _crvs = srf.PerimeterCurves()
            heights = [i.StartPoint.Z for i in _crvs]
            height = min(heights)
            return height
        belowSrf_height = getSrfHeight(belowSrf)
        
        def findLeanThk(leanobj):
            if leanobj:
                return leanobj.GetParameterValueByName("thk")
            else:
                return 버림thk
        leanobj = None
        leanthk = findLeanThk(leanobj)
        
        def offsetCrv(crv, offset=300):
            return crv.Offset(offset)
        def correctElev(crv, thk):
            return crv.Translate(0,0,thk)
        _exca_belowbdry = offsetCrv(PolyCurve.ByJoinedCurves(belowSrf.PerimeterCurves()), bttmOffset)
        exca_belowbdry = correctElev(_exca_belowbdry, -버림thk)
        _exca_upperbdry = correctElev(_exca_belowbdry, -belowSrf_height)
        exca_upperbdry = offsetCrv(_exca_upperbdry, -belowSrf_height/slopeExcav)
        target = Solid.ByLoft([exca_belowbdry,exca_upperbdry])#excavation_solid

    return (target, sum([i.Volume for i in [target]])/calcTargetNum/1000000000, "M3")

# Assign your output to the OUT variable.
#OUT = fdnsGeo
OUT = (터파기산출함수,["Footing-Rectangular"],["Excavation"],["M3"])
# ----------------------------------------
독립기초철근비 = DoubleInput(0.1)  # graph input
슬라브철근비 = DoubleInput(0.15)  # graph input
패드철근비 = DoubleInput(0.1)  # graph input
철근물량산출함수 = Python(IN[0]=콘크리트물량산출함수, IN[2]=독립기초철근비, IN[3]=슬라브철근비, IN[4]=패드철근비)  # CPython3; unwired: IN[1]
# ---------- 철근물량산출함수.python (74 lines) ----------
# Load the Python Standard and DesignScript Libraries
import sys
import clr
clr.AddReference('RevitAPI')
from Autodesk.Revit.DB import *
import Autodesk

clr.AddReference('RevitNodes')
import Revit
clr.ImportExtensions(Revit.Elements)

clr.AddReference('RevitServices')
import RevitServices
from RevitServices.Persistence import DocumentManager
doc = DocumentManager.Instance.CurrentDBDocument
collector1 = FilteredElementCollector(doc)
collector2 = FilteredElementCollector(doc)
collector3 = FilteredElementCollector(doc)
collector4 = FilteredElementCollector(doc)
collector5 = FilteredElementCollector(doc)

clr.AddReference('ProtoGeometry')
from Autodesk.DesignScript.Geometry import *

from itertools import chain

allFdns = collector1.OfCategory(BuiltInCategory.OST_StructuralFoundation).WhereElementIsNotElementType().ToElements()
allCols = collector2.OfCategory(BuiltInCategory.OST_StructuralColumns).WhereElementIsNotElementType().ToElements()
allBeams = collector3.OfCategory(BuiltInCategory.OST_StructuralFraming).WhereElementIsNotElementType().ToElements()
allFloors = collector4.OfCategory(BuiltInCategory.OST_Floors).WhereElementIsNotElementType().ToElements()
_allEdges = collector5.OfCategory(BuiltInCategory.OST_EdgeSlab).WhereElementIsNotElementType().ToElements()
allIsoFdns = [i.ToDSType(False) for i in allFdns if "Footing-" in i.Name]
allPeds = [i.ToDSType(False) for i in allCols if "UG" in i.Name]
allPedsGeo = [i.Geometry()[0] for i in allPeds]
allTGs = [i.ToDSType(False) for i in allBeams if "TG" in i.Name]
allTGsGeo = [i.Geometry()[0] for i in allTGs]
allSOGs = [i.ToDSType(False) for i in allFdns if "SOG" in i.Name and "GS" in i.Name]
allSOGsGeo = [i.Geometry()[0] for i in allSOGs]
allEdges = [i.ToDSType(False) for i in _allEdges]
allEdgesGeo = [i.Geometry()[0] for i in allEdges]
allFdnAndHaunch = [i.ToDSType(False) for i in allFdns+_allEdges]
allFdnAndHaunchGeo = [i.Geometry()[0] for i in allFdnAndHaunch]
# The inputs to this node will be stored as a list in the IN variables.
dataEnteringNode = IN

refFunc = IN[0][0]
inputs = IN[1]
독립기초철근비 = IN[2]
슬라브철근비 = IN[3]
패드철근비 = IN[4]

# Place your code below this line
def 철근물량산출함수(input):
    콘크리트물량산출함수 = refFunc
    if "Footing-Rectangular" in input.Name:
        target = 콘크리트물량산출함수(input)[0]
        ratio = 독립기초철근비
        
        return ("형상정보 미제공", target.Volume*ratio/1000000000, "TON")
    
    elif "SOG" in input.Name:
        target = 콘크리트물량산출함수(input)[0]
        ratio = 슬라브철근비
        
        return ("형상정보 미제공", target.Volume*ratio/1000000000, "TON")
        
    elif "PAD" in input.Name:
        target = 콘크리트물량산출함수(input)[0]
        ratio = 패드철근비
        
        return ("형상정보 미제공", target.Volume*ratio/1000000000, "TON")

# Assign your output to the OUT variable.
OUT = (철근물량산출함수,["Footing-Rectangular","SOG"],["Rebar Work"],["TON"])
# ----------------------------------------
경사_비율_입력_1_x_for_sog = DoubleInput(4)  # graph input
터파기산출함수__sog = Python(IN[3]=터파기_하부_offset, IN[4]=버림thk, IN[5]=경사_비율_입력_1_x_for_sog)  # CPython3; unwired: IN[0], IN[1], IN[2]
# ---------- 터파기산출함수__sog.python (73 lines) ----------
# Load the Python Standard and DesignScript Libraries
import sys
import clr

clr.AddReference('RevitAPI')
from Autodesk.Revit.DB import *
import Autodesk

clr.AddReference('RevitNodes')
import Revit
clr.ImportExtensions(Revit.Elements)

clr.AddReference('RevitServices')
import RevitServices
from RevitServices.Persistence import DocumentManager
doc = DocumentManager.Instance.CurrentDBDocument
collector1 = FilteredElementCollector(doc)#Autodesk.Revit.DB.FilteredElementCollector(doc)

clr.AddReference('ProtoGeometry')
from Autodesk.DesignScript.Geometry import *

allFdns = collector1.OfCategory(BuiltInCategory.OST_StructuralFoundation).WhereElementIsNotElementType().ToElements()
allIsoFdns = [i.ToDSType(False) for i in allFdns if "Footing-" in i.Name]

# The inputs to this node will be stored as a list in the IN variables.
dataEnteringNode = IN
refFunc = IN[0]
#wholeExcavationBln = IN[1]
inputDS = IN[2]
bttmOffset = IN[3]
버림thk = IN[4]
slopeExcav = IN[5]



# Place your code below this line

def 터파기산출함수SOG(input):
    
    calcTargetNum = 1
    srfs = input.Geometry()[0].Explode()
    belowSrf = [i for i in srfs if i.NormalAtParameter(0.5,0.5).Z == -1][0]
    
    def getSrfHeight(srf):
        _crvs = srf.PerimeterCurves()
        heights = [i.StartPoint.Z for i in _crvs]
        height = min(heights)
        return height
    belowSrf_height = getSrfHeight(belowSrf)
    
    def findLeanThk(leanobj):
        if leanobj:
            return leanobj.GetParameterValueByName("thk")
        else:
            return 버림thk
    leanobj = None
    leanthk = findLeanThk(leanobj)
    
    def offsetCrv(crv, offset=300):
        return crv.Offset(offset)
    def correctElev(crv, thk):
        return crv.Translate(0,0,thk)
    _exca_belowbdry = offsetCrv(PolyCurve.ByJoinedCurves(belowSrf.PerimeterCurves()), bttmOffset)
    exca_belowbdry = correctElev(_exca_belowbdry, -버림thk)
    _exca_upperbdry = correctElev(_exca_belowbdry, -belowSrf_height)
    exca_upperbdry = offsetCrv(_exca_upperbdry, -belowSrf_height/slopeExcav)
    target = Solid.ByLoft([exca_belowbdry,exca_upperbdry])

    return (target, sum([i.Volume for i in [target]])/calcTargetNum/1000000000, "M3")

# Assign your output to the OUT variable.
#OUT = fdnsGeo
OUT = (터파기산출함수SOG,["SOG"],["Excavation"],["M3"])
# ----------------------------------------
되메우기산출함수 = Python(IN[0]=터파기산출함수, IN[1]=온통_터파기_여부)  # CPython3; unwired: IN[2], IN[3], IN[4], IN[5]
# ---------- 되메우기산출함수.python (96 lines) ----------
# Load the Python Standard and DesignScript Libraries
import sys
import clr

clr.AddReference('RevitAPI')
from Autodesk.Revit.DB import *
import Autodesk

clr.AddReference('RevitNodes')
import Revit
clr.ImportExtensions(Revit.Elements)

clr.AddReference('RevitServices')
import RevitServices
from RevitServices.Persistence import DocumentManager
doc = DocumentManager.Instance.CurrentDBDocument
collector1 = FilteredElementCollector(doc)
collector2 = FilteredElementCollector(doc)
collector3 = FilteredElementCollector(doc)
collector4 = FilteredElementCollector(doc)

clr.AddReference('ProtoGeometry')
from Autodesk.DesignScript.Geometry import *

allFdns = collector1.OfCategory(BuiltInCategory.OST_StructuralFoundation).WhereElementIsNotElementType().ToElements()
allCols = collector2.OfCategory(BuiltInCategory.OST_StructuralColumns).WhereElementIsNotElementType().ToElements()
allBeams = collector3.OfCategory(BuiltInCategory.OST_StructuralFraming).WhereElementIsNotElementType().ToElements()
allFloors = collector4.OfCategory(BuiltInCategory.OST_Floors).WhereElementIsNotElementType().ToElements()
allIsoFdns = [i.ToDSType(False) for i in allFdns if "Footing-" in i.Name]
allPeds = [i.ToDSType(False) for i in allCols if "UG" in i.Name]
allPedsGeo = [i.Geometry()[0] for i in allPeds]
allTGs = [i.ToDSType(False) for i in allBeams if "TG" in i.Name]
allTGsGeo = [i.Geometry()[0] for i in allTGs]
allSOGs = [i.ToDSType(False) for i in allFdns if "SOG" in i.Name and "GS" in i.Name]
allSOGsGeo = [i.Geometry()[0] for i in allSOGs]

# The inputs to this node will be stored as a list in the IN variables.
dataEnteringNode = IN
refFunc = IN[0][0]
wholeExcavationBln = IN[1]
input = IN[2]
bttmOffset = IN[3]
버림thk = IN[4]
slopeExcav = IN[5]


# Place your code below this line

def 되메우기산출함수(input):
    targets = []
    
    if wholeExcavationBln:
        calcTargetNum = len(allIsoFdns)
        exca_solid = refFunc(input)[0]
        fdn_solid = Solid.ByUnion([i.Geometry()[0] for i in allIsoFdns])
        peds_solid = Solid.ByUnion(allPedsGeo)
        TGs_solid = Solid.ByUnion(allTGsGeo)
        SOGs_solid = Solid.ByUnion(allSOGsGeo)
        _target1 = exca_solid.Difference(fdn_solid)
        _target2 = _target1.Difference(peds_solid)
        _target3 = _target2.Difference(TGs_solid)
        target = _target3.Difference(SOGs_solid)
        pass

    else:
        calcTargetNum = 1
        exca_solid = refFunc(input)[0]
        fdn_solid = input.Geometry()[0]
        _joinedPeds = [i for i in allPedsGeo if i.DoesIntersect(exca_solid)]
        joinedPeds = Solid.ByUnion(_joinedPeds)
        _joinedTGs = [i for i in allTGsGeo if i.DoesIntersect(exca_solid)]
        _joinedSOGs = [i for i in allSOGsGeo if i.DoesIntersect(exca_solid)]
        if len(_joinedTGs)>0:
            joinedTGs = Solid.ByUnion(_joinedTGs)
            _target1 = exca_solid.Difference(fdn_solid)#Backfill_Solid ##린 콘크리트 형상 미포함
            _target2 = _target1.Difference(joinedPeds)
            _target3 = _target2.Difference(joinedTGs)
            if len(_joinedSOGs):
                joinedSOGs = Solid.ByUnion(_joinedTGs)
                target = _target3.Difference(joinedSOGs)
            else:
                target = _target3
        else:
            _target1 = exca_solid.Difference(fdn_solid)
            _target2 = _target1.Difference(joinedPeds)
            if len(_joinedSOGs):
                joinedSOGs = Solid.ByUnion(_joinedTGs)
                target = _target2.Difference(joinedSOGs)
            else:
                target = _target2

    return (target, sum([i.Volume for i in [target]])/calcTargetNum/1000000000, "M3")

# Assign your output to the OUT variable.
#OUT = getBackfillTarget(input)
OUT = (되메우기산출함수,["Footing-Rectangular"],["Backfill"],["M3"])
# ----------------------------------------
토량_환산_계수 = DoubleInput(1.2)  # graph input
잔토처리산출함수 = Python(IN[0]=터파기산출함수, IN[1]=온통_터파기_여부, IN[2]=토량_환산_계수)  # CPython3; unwired: IN[3], IN[4], IN[5]
# ---------- 잔토처리산출함수.python (84 lines) ----------
# Load the Python Standard and DesignScript Libraries
import sys
import clr

clr.AddReference('RevitAPI')
from Autodesk.Revit.DB import *
import Autodesk

clr.AddReference('RevitNodes')
import Revit
clr.ImportExtensions(Revit.Elements)

clr.AddReference('RevitServices')
import RevitServices
from RevitServices.Persistence import DocumentManager
doc = DocumentManager.Instance.CurrentDBDocument
collector1 = FilteredElementCollector(doc)
collector2 = FilteredElementCollector(doc)
collector3 = FilteredElementCollector(doc)
collector4 = FilteredElementCollector(doc)

clr.AddReference('ProtoGeometry')
from Autodesk.DesignScript.Geometry import *

from itertools import chain

allFdns = collector1.OfCategory(BuiltInCategory.OST_StructuralFoundation).WhereElementIsNotElementType().ToElements()
allCols = collector2.OfCategory(BuiltInCategory.OST_StructuralColumns).WhereElementIsNotElementType().ToElements()
allBeams = collector3.OfCategory(BuiltInCategory.OST_StructuralFraming).WhereElementIsNotElementType().ToElements()
allFloors = collector4.OfCategory(BuiltInCategory.OST_Floors).WhereElementIsNotElementType().ToElements()
allIsoFdns = [i.ToDSType(False) for i in allFdns if "Footing-" in i.Name]
allPeds = [i.ToDSType(False) for i in allCols if "UG" in i.Name]
allPedsGeo = [i.Geometry()[0] for i in allPeds]
allTGs = [i.ToDSType(False) for i in allBeams if "TG" in i.Name]
allTGsGeo = [i.Geometry()[0] for i in allTGs]
allSOGs = [i.ToDSType(False) for i in allFdns if "SOG" in i.Name and "GS" in i.Name]
allSOGsGeo = [i.Geometry()[0] for i in allSOGs]

# The inputs to this node will be stored as a list in the IN variables.
dataEnteringNode = IN
refFunc = IN[0][0]
wholeExcavationBln = IN[1]
ratio = IN[2]
#bttmOffset = IN[3]
#leanThk = IN[4]
#slopeExcav = IN[5]


# Place your code below this line

def 잔토처리산출함수(input):
    targets = []
    
    if wholeExcavationBln:
        calcTargetNum = len(allIsoFdns)
        exca_solid = refFunc(input)[0]
        fdn_solid = Solid.ByUnion([i.Geometry()[0] for i in allIsoFdns])
        peds_solid = Solid.ByUnion(allPedsGeo)
        TGs_solid = Solid.ByUnion(allTGsGeo)
        SOGs_solid = Solid.ByUnion(allSOGsGeo)
        _target1 = Solid.ByUnion([fdn_solid,peds_solid,TGs_solid,SOGs_solid])
#        _target1 = exca_solid.Difference(fdn_solid)
#        _target2 = _target1.Difference(peds_solid)
#        _target3 = _target2.Difference(TGs_solid)
        target = _target1.Intersect(exca_solid)[0]
        pass

    else:
        calcTargetNum = 1
        exca_solid = refFunc(input)[0]
        fdn_solid = input.Geometry()[0]
        _joinedPeds = [i for i in allPedsGeo if i.DoesIntersect(exca_solid)]
        #joinedPeds = Solid.ByUnion(_joinedPeds)
        _joinedTGs = [i for i in allTGsGeo if i.DoesIntersect(exca_solid)]
        _joinedSOGs = [i for i in allSOGsGeo if i.DoesIntersect(exca_solid)]
        _target1 = Solid.ByUnion(list(chain(*[[fdn_solid] + _joinedPeds + _joinedTGs + _joinedSOGs])))
        target = _target1.Intersect(exca_solid)[0]


    return (target, sum([i.Volume for i in [target]])*ratio/calcTargetNum/1000000000, "M3")

# Assign your output to the OUT variable.
#OUT = getBackfillTarget(input)
OUT = (잔토처리산출함수,["Footing-Rectangular"],["Disposal"],["M3"])
# ----------------------------------------
기층_thk = DoubleInput(300)  # graph input
기층물량산출함수 = Python(IN[0]=터파기산출함수, IN[1]=온통_터파기_여부, IN[2]=기층_thk, IN[3]=터파기_하부_offset, IN[4]=버림thk)  # CPython3; unwired: IN[5]
# ---------- 기층물량산출함수.python (75 lines) ----------
# Load the Python Standard and DesignScript Libraries
import sys
import clr

clr.AddReference('RevitAPI')
from Autodesk.Revit.DB import *
import Autodesk

clr.AddReference('RevitNodes')
import Revit
clr.ImportExtensions(Revit.Elements)

clr.AddReference('RevitServices')
import RevitServices
from RevitServices.Persistence import DocumentManager
doc = DocumentManager.Instance.CurrentDBDocument
collector1 = FilteredElementCollector(doc)
collector2 = FilteredElementCollector(doc)
collector3 = FilteredElementCollector(doc)
collector4 = FilteredElementCollector(doc)

clr.AddReference('ProtoGeometry')
from Autodesk.DesignScript.Geometry import *

from itertools import chain

allFdns = collector1.OfCategory(BuiltInCategory.OST_StructuralFoundation).WhereElementIsNotElementType().ToElements()
allCols = collector2.OfCategory(BuiltInCategory.OST_StructuralColumns).WhereElementIsNotElementType().ToElements()
allBeams = collector3.OfCategory(BuiltInCategory.OST_StructuralFraming).WhereElementIsNotElementType().ToElements()
allFloors = collector4.OfCategory(BuiltInCategory.OST_Floors).WhereElementIsNotElementType().ToElements()
allIsoFdns = [i.ToDSType(False) for i in allFdns if "Footing-" in i.Name]
allPeds = [i.ToDSType(False) for i in allCols if "UG" in i.Name]
allPedsGeo = [i.Geometry()[0] for i in allPeds]
allTGs = [i.ToDSType(False) for i in allBeams if "TG" in i.Name]
allTGsGeo = [i.Geometry()[0] for i in allTGs]
allSOGs = [i.ToDSType(False) for i in allFdns if "SOG" in i.Name and "GS" in i.Name]
allSOGsGeo = [i.Geometry()[0] for i in allSOGs]

# The inputs to this node will be stored as a list in the IN variables.
dataEnteringNode = IN
refFunc = IN[0][0]
wholeExcavationBln = IN[1]
기층offset = IN[2]
bttmOffset = IN[3]
버림thk = IN[4]
#slopeExcav = IN[5]


# Place your code below this line

def 기층물량산출함수(input):
    targets = []
    
    if wholeExcavationBln:
        calcTargetNum = len(allIsoFdns)
        exca_solid = refFunc(input)[0]
        srfs_exca_blw = [i for i in exca_solid.Explode() if round(i.NormalAtParameter(0.5,0.5).Z)==-1]
        

        target = srfs_exca_blw[0]
        pass

    else:
        calcTargetNum = 1
        exca_solid = refFunc(input)[0]
        srfs_exca_blw = [i for i in exca_solid.Explode() if round(i.NormalAtParameter(0.5,0.5).Z)==-1]

        target = srfs_exca_blw[0]


    return (target, sum([i.Area for i in [target]])/calcTargetNum/1000000, "M2")

# Assign your output to the OUT variable.
#OUT = getBackfillTarget(input)
OUT = (기층물량산출함수,["Footing-Rectangular"],["Base Course"],["M2"])
# ----------------------------------------
버림offset = DoubleInput(100)  # graph input
버림콘크리트산출함수 = Python(IN[4]=버림thk, IN[5]=버림offset)  # CPython3; unwired: IN[0], IN[1], IN[2], IN[3]
# ---------- 버림콘크리트산출함수.python (142 lines) ----------
# Load the Python Standard and DesignScript Libraries
import sys
import clr

clr.AddReference('RevitAPI')
from Autodesk.Revit.DB import *
import Autodesk

clr.AddReference('RevitNodes')
import Revit
clr.ImportExtensions(Revit.Elements)

clr.AddReference('RevitServices')
import RevitServices
from RevitServices.Persistence import DocumentManager
doc = DocumentManager.Instance.CurrentDBDocument
collector1 = FilteredElementCollector(doc)
collector2 = FilteredElementCollector(doc)
collector3 = FilteredElementCollector(doc)
collector4 = FilteredElementCollector(doc)
collector5 = FilteredElementCollector(doc)

clr.AddReference('ProtoGeometry')
from Autodesk.DesignScript.Geometry import *

from itertools import chain

allFdns = collector1.OfCategory(BuiltInCategory.OST_StructuralFoundation).WhereElementIsNotElementType().ToElements()
allCols = collector2.OfCategory(BuiltInCategory.OST_StructuralColumns).WhereElementIsNotElementType().ToElements()
allBeams = collector3.OfCategory(BuiltInCategory.OST_StructuralFraming).WhereElementIsNotElementType().ToElements()
allFloors = collector4.OfCategory(BuiltInCategory.OST_Floors).WhereElementIsNotElementType().ToElements()
_allEdges = collector5.OfCategory(BuiltInCategory.OST_EdgeSlab).WhereElementIsNotElementType().ToElements()
allIsoFdns = [i.ToDSType(False) for i in allFdns if "Footing-" in i.Name]
allPeds = [i.ToDSType(False) for i in allCols if "UG" in i.Name]
allPedsGeo = [i.Geometry()[0] for i in allPeds]
allTGs = [i.ToDSType(False) for i in allBeams if "TG" in i.Name]
allTGsGeo = [i.Geometry()[0] for i in allTGs]
allSOGs = [i.ToDSType(False) for i in allFdns if "SOG" in i.Name and "GS" in i.Name]
allSOGsGeo = [i.Geometry()[0] for i in allSOGs]
allEdges = [i.ToDSType(False) for i in _allEdges]
allEdgesGeo = [i.Geometry()[0] for i in allEdges]
allFdnAndHaunch = [i.ToDSType(False) for i in allFdns+_allEdges]
allFdnAndHaunchGeo = [i.Geometry()[0] for i in allFdnAndHaunch]

# The inputs to this node will be stored as a list in the IN variables.
dataEnteringNode = IN
refFunc = IN[0]
input = IN[1]
기층offset = IN[2]
bttmOffset = IN[3]
버림thk = IN[4]
버림offset = IN[5]
#slopeExcav = IN[5]

def getIdxOfMaximum(list):
    result = []
    maxValue = max(list)
    for i in range(len(list)):
        if list[i]==maxValue:
            result.append(i)
    return result

# Place your code below this line

def 버림콘크리트산출함수(input):
    calcTargetNum = 1
    inputGeo = input.Geometry()[0]
    
    if "Footing-Rectangular" in input.Name:
        srf_fdn_lean = [i for i in inputGeo.Explode() if round(i.NormalAtParameter(0.5,0.5).Z)==-1][0]
        crvs_fdn_lean = srf_fdn_lean.PerimeterCurves()
        crv_fdn_lean = PolyCurve.ByJoinedCurves(crvs_fdn_lean)
        crv_offset = crv_fdn_lean.Offset(버림offset)
        leanSrf = Surface.ByPatch(crv_offset)
        vectorZ = leanSrf.NormalAtParameter(0.5,0.5).Z
        if vectorZ>0:
            target = leanSrf.Thicken(-버림thk, False)
        elif vectorZ<0:
            target = leanSrf.Thicken(버림thk, False)
        
    elif "TG" in input.Name:
        srf_TG_lean = [i for i in inputGeo.Explode() if round(i.NormalAtParameter(0.5,0.5).Z)==-1][0]
        crvs_TG_lean = srf_TG_lean.PerimeterCurves()
        len_crvs_TG = [i.Length for i in crvs_TG_lean]
        idx = getIdxOfMaximum(len_crvs_TG)
        crvs_long = []
        for i in idx:
            crvs_long.append(crvs_TG_lean[i])
        extdSrfs = []
        for i in crvs_long:
            vec = i.NormalAtParameter(0.5)
            i_tr = i.Translate(버림offset,vec)
            extdSrfs.append(Surface.ByLoft([i,i_tr]))
        leanSrf = PolyCurve.ByJoinedCurves([srf_TG_lean]+extdSrfs)
        vectorZ = leanSrf.NormalAtParameter(0.5,0.5).Z
        if vectorZ>0:
            target = leanSrf.Thicken(-버림thk, False)
        elif vectorZ<0:
            target = leanSrf.Thicken(버림thk, False)
        
    elif "SOG" in input.Name:
        inputGeo = input.Geometry()[0]
        간섭판별선 = PolyCurve.ByJoinedCurves([i for i in inputGeo.Explode() if round(i.NormalAtParameter(0.5,0.5).Z)==-1][0].PerimeterCurves()).Offset(-1)
        간섭판별면 = 간섭판별선.Patch()
        overlaps = [i for i in allEdgesGeo if 간섭판별면.DoesIntersect(i)]+[inputGeo]
        unionSolid = Solid.ByUnion(overlaps)
        def findBeneathSrf(srfGroup):
            result = []
            upperSrfs = [i for i in srfGroup if round(i.NormalAtParameter(0.5,0.5).Z) == 1]
            headCrvs = []
            for i in upperSrfs:
                headCrv = PolyCurve.ByJoinedCurves(i.PerimeterCurves())
                headCrvs.append(headCrv)
            for i in srfGroup:
                tmp=[]
                for j in headCrvs:
                    if i.DoesIntersect(j):
                        tmp.append(False)
                    else:
                        tmp.append(True)
                if all(tmp):
                    result.append(i)
            return result
        leanSrf = PolySurface.ByJoinedSurfaces(findBeneathSrf(unionSolid.Explode()))
        vectorZ = leanSrf.NormalAtParameter(0.5,0.5).Z
        if vectorZ>0:
            if len(leanSrf.Surfaces())>1:
                target = Solid.ByUnion([i.Thicken(-버림thk, False) for i in leanSrf.Surfaces()])
            else:
                target = leanSrf.Thicken(-버림thk, False)
        elif vectorZ<0:
            if len(leanSrf.Surfaces())>1:
                target = Solid.ByUnion([i.Thicken(버림thk, False) for i in leanSrf.Surfaces()])
            else:
                target = leanSrf.Thicken(버림thk, False)

    #return target
    return (target, sum([i.Volume for i in [target]])/calcTargetNum/1000000000, "M3")

# Assign your output to the OUT variable.
#OUT = 버림콘크리트산출함수(input)
OUT = (버림콘크리트산출함수,["Footing-Rectangular","TG","SOG"],["Lean Concrete"],["M3"])
# ----------------------------------------
pe시트산출함수 = Python(IN[0]=버림콘크리트산출함수, IN[4]=버림thk)  # CPython3; unwired: IN[1], IN[2], IN[3], IN[5]
# ---------- pe시트산출함수.python (79 lines) ----------
# Load the Python Standard and DesignScript Libraries
import sys
import clr

clr.AddReference('RevitAPI')
from Autodesk.Revit.DB import *
import Autodesk

clr.AddReference('RevitNodes')
import Revit
clr.ImportExtensions(Revit.Elements)

clr.AddReference('RevitServices')
import RevitServices
from RevitServices.Persistence import DocumentManager
doc = DocumentManager.Instance.CurrentDBDocument
collector1 = FilteredElementCollector(doc)
collector2 = FilteredElementCollector(doc)
collector3 = FilteredElementCollector(doc)
collector4 = FilteredElementCollector(doc)
collector5 = FilteredElementCollector(doc)

clr.AddReference('ProtoGeometry')
from Autodesk.DesignScript.Geometry import *

from itertools import chain

allFdns = collector1.OfCategory(BuiltInCategory.OST_StructuralFoundation).WhereElementIsNotElementType().ToElements()
allCols = collector2.OfCategory(BuiltInCategory.OST_StructuralColumns).WhereElementIsNotElementType().ToElements()
allBeams = collector3.OfCategory(BuiltInCategory.OST_StructuralFraming).WhereElementIsNotElementType().ToElements()
allFloors = collector4.OfCategory(BuiltInCategory.OST_Floors).WhereElementIsNotElementType().ToElements()
_allEdges = collector5.OfCategory(BuiltInCategory.OST_EdgeSlab).WhereElementIsNotElementType().ToElements()
allIsoFdns = [i.ToDSType(False) for i in allFdns if "Footing-" in i.Name]
allPeds = [i.ToDSType(False) for i in allCols if "UG" in i.Name]
allPedsGeo = [i.Geometry()[0] for i in allPeds]
allTGs = [i.ToDSType(False) for i in allBeams if "TG" in i.Name]
allTGsGeo = [i.Geometry()[0] for i in allTGs]
allSOGs = [i.ToDSType(False) for i in allFdns if "SOG" in i.Name and "GS" in i.Name]
allSOGsGeo = [i.Geometry()[0] for i in allSOGs]
allEdges = [i.ToDSType(False) for i in _allEdges]
allEdgesGeo = [i.Geometry()[0] for i in allEdges]
allFdnAndHaunch = [i.ToDSType(False) for i in allFdns+_allEdges]
allFdnAndHaunchGeo = [i.Geometry()[0] for i in allFdnAndHaunch]

# The inputs to this node will be stored as a list in the IN variables.
dataEnteringNode = IN
refFunc = IN[0][0]
input = IN[1]
기층offset = IN[2]
bttmOffset = IN[3]
버림thk = IN[4]
버림offset = IN[5]
#slopeExcav = IN[5]

def getIdxOfMaximum(list):
    result = []
    maxValue = max(list)
    for i in range(len(list)):
        if list[i]==maxValue:
            result.append(i)
    return result

# Place your code below this line

def PE시트산출함수(input):
    calcTargetNum = 1
    inputGeo = input.Geometry()[0]
    버림콘크리트산출함수 = refFunc
    버림형상 = 버림콘크리트산출함수(input)[0]
    #버림상부면 = [i for i in 버림형상.Explode() if round(i.NormalAtParameter(0.5,0.5).Z) == 1][0]
    target = 버림형상


    #return target
    return (target, sum([i.Volume/버림thk for i in [target]])/calcTargetNum/1000000, "M2")

# Assign your output to the OUT variable.
#OUT = PE시트산출함수(input)
OUT = (PE시트산출함수,["Footing-Rectangular","TG","SOG"],["PE Sheet (Vapor"],["M2"])
# ----------------------------------------
시트멤브레인산출함수 = Python(IN[0]=pe시트산출함수)  # CPython3; unwired: IN[1], IN[2], IN[3], IN[4], IN[5]
# ---------- 시트멤브레인산출함수.python (79 lines) ----------
# Load the Python Standard and DesignScript Libraries
import sys
import clr

clr.AddReference('RevitAPI')
from Autodesk.Revit.DB import *
import Autodesk

clr.AddReference('RevitNodes')
import Revit
clr.ImportExtensions(Revit.Elements)

clr.AddReference('RevitServices')
import RevitServices
from RevitServices.Persistence import DocumentManager
doc = DocumentManager.Instance.CurrentDBDocument
collector1 = FilteredElementCollector(doc)
collector2 = FilteredElementCollector(doc)
collector3 = FilteredElementCollector(doc)
collector4 = FilteredElementCollector(doc)
collector5 = FilteredElementCollector(doc)

clr.AddReference('ProtoGeometry')
from Autodesk.DesignScript.Geometry import *

from itertools import chain

allFdns = collector1.OfCategory(BuiltInCategory.OST_StructuralFoundation).WhereElementIsNotElementType().ToElements()
allCols = collector2.OfCategory(BuiltInCategory.OST_StructuralColumns).WhereElementIsNotElementType().ToElements()
allBeams = collector3.OfCategory(BuiltInCategory.OST_StructuralFraming).WhereElementIsNotElementType().ToElements()
allFloors = collector4.OfCategory(BuiltInCategory.OST_Floors).WhereElementIsNotElementType().ToElements()
_allEdges = collector5.OfCategory(BuiltInCategory.OST_EdgeSlab).WhereElementIsNotElementType().ToElements()
allIsoFdns = [i.ToDSType(False) for i in allFdns if "Footing-" in i.Name]
allPeds = [i.ToDSType(False) for i in allCols if "UG" in i.Name]
allPedsGeo = [i.Geometry()[0] for i in allPeds]
allTGs = [i.ToDSType(False) for i in allBeams if "TG" in i.Name]
allTGsGeo = [i.Geometry()[0] for i in allTGs]
allSOGs = [i.ToDSType(False) for i in allFdns if "SOG" in i.Name and "GS" in i.Name]
allSOGsGeo = [i.Geometry()[0] for i in allSOGs]
allEdges = [i.ToDSType(False) for i in _allEdges]
allEdgesGeo = [i.Geometry()[0] for i in allEdges]
allFdnAndHaunch = [i.ToDSType(False) for i in allFdns+_allEdges]
allFdnAndHaunchGeo = [i.Geometry()[0] for i in allFdnAndHaunch]

# The inputs to this node will be stored as a list in the IN variables.
dataEnteringNode = IN
refFunc = IN[0][0]
input = IN[1]
기층offset = IN[2]
bttmOffset = IN[3]
버림thk = IN[4]
버림offset = IN[5]
#slopeExcav = IN[5]

def getIdxOfMaximum(list):
    result = []
    maxValue = max(list)
    for i in range(len(list)):
        if list[i]==maxValue:
            result.append(i)
    return result

# Place your code below this line

def 시트멤브레인산출함수(input):
    PE시트산출함수 = refFunc
    calcTargetNum = 1
    타겟형상 = PE시트산출함수(input)[0]
    타겟값 = PE시트산출함수(input)[1]
    #버림상부면 = [i for i in 버림형상.Explode() if round(i.NormalAtParameter(0.5,0.5).Z) == 1][0]
    target = 타겟값


    #return target
    return ("형상정보 미제공", target, "M2")

# Assign your output to the OUT variable.
#OUT = PE시트산출함수(input)
OUT = (시트멤브레인산출함수,["Footing-Rectangular","SOG"],["Sheet Membrane"],["M2"])
# ----------------------------------------
funcSets = Python(IN[0]=콘크리트물량산출함수, IN[1]=거푸집산출함수, IN[2]=터파기산출함수, IN[3]=철근물량산출함수, IN[4]=터파기산출함수__sog, IN[5]=되메우기산출함수, IN[6]=잔토처리산출함수, IN[7]=기층물량산출함수, IN[8]=버림콘크리트산출함수, IN[9]=pe시트산출함수, IN[10]=시트멤브레인산출함수)  # CPython3
# ---------- funcSets.python (13 lines) ----------
# Load the Python Standard and DesignScript Libraries
import sys
import clr
clr.AddReference('ProtoGeometry')
from Autodesk.DesignScript.Geometry import *

# The inputs to this node will be stored as a list in the IN variables.
dataEnteringNode = IN

# Place your code below this line

# Assign your output to the OUT variable.
OUT = IN
# ----------------------------------------
getTargetAndValue = Python(IN[0]=createElemDS, IN[1]=funcSets)  # CPython3
# ---------- getTargetAndValue.python (83 lines) ----------
# Load the Python Standard and DesignScript Libraries
import sys
import clr
clr.AddReference('ProtoGeometry')
from Autodesk.DesignScript.Geometry import *

from itertools import chain

# The inputs to this node will be stored as a list in the IN variables.
dataEnteringNode = IN
elemDSs = IN[0]
funcSets = IN[1]
#func = IN[1][0]
#funcfamilyTag = IN[1][1]
#funcWmTag = IN[1][2]
#funcUnitTag = IN[1][3]
# Place your code below this line


def getTarget(elemDS, funcSets):
    elem = elemDS["elem"]
    etype = elemDS["elemType"]
    familyCode = elemDS["familyCode"]
    wms = elemDS["WMperElem"]
    result = []
    
#    def matchWM_func(wms, funcSet):
#        result = []
#        func = funcSet[0]
#        for wm in wms:
#            tmp1 = []
#            tmp2 = []
#            wmbln = []
#            for i in funcSet[1]:
#                if i in etype:#element type 비교
#                    tmp1.append(True)
#                else:
#                    tmp1.append(False)
#            for i in funcSet[2]:#work type 비교
#                if i in wm:
#                    tmp2.append(True)
#                else:
#                    tmp2.append(False)
#            if any(tmp1) and any(tmp2):
#                result.append([etype, wm, func, func(elem)])
#
#        return result
    
    def matchWM_func(wm, funcSets):
        result = []
        
        for funcSet in funcSets:
            func = funcSet[0]
            tmp1 = []
            tmp2 = []

            for i in funcSet[1]:
                if i in etype:#element type 비교
                    tmp1.append(True)
                else:
                    tmp1.append(False)
            for i in funcSet[2]:#work type 비교
                if i in wm:
                    tmp2.append(True)
                else:
                    tmp2.append(False)
            if any(tmp1) and any(tmp2):
                result.append([etype, wm, func, func(elem)])

        return result

#    result = [matchWM_func(wm, funcSets) for wm in wms]
    result = []
    for wm in wms:
        if matchWM_func(wm, funcSets):
            result.append(matchWM_func(wm, funcSets))
        else:
            result.append([[etype, wm, "-----!!funcSets내, 해당 부재와 해당 공정"+f'({wm.split(": ")[0]})'+"에 대응하는 함수 없음!!-----",["!산출타겟 미지정!","!산출결과 없음!","!산출단위 없음!"]]])

    return list(chain(*result))

# Assign your output to the OUT variable.
OUT = [getTarget(elemDS, funcSets) for elemDS in elemDSs]
# ----------------------------------------
code_block_35 = CodeBlock(i=getTargetAndValue) { i[0][4][3][0]; }
watch_9 = Watch(getTargetAndValue)
count_6 = List.Count(list=watch_9@L5)

# group: 산출타겟 검증
color_palette_2 = ColorPalette({R: 127, G: 255, B: 212, A: 79})
code_block_36 = CodeBlock(input=getTargetAndValue) { input; }
공종목록 = Python(IN[0]=code_block_36)  # CPython3
# ---------- 공종목록.python (34 lines) ----------
# Load the Python Standard and DesignScript Libraries
import sys
import clr
clr.AddReference('ProtoGeometry')
from Autodesk.DesignScript.Geometry import *

clr.AddReference('RevitNodes')
import Revit
clr.ImportExtensions(Revit.Elements)

from DSCore import Color
clr.AddReference('GeometryColor')
from Modifiers import GeometryColor

import random

# The inputs to this node will be stored as a list in the IN variables.
dataEnteringNode = IN
산출결과세트리스트 = IN[0]

def 공종종류(산출결과세트리스트):
    result = []
    for 산출결과세트 in 산출결과세트리스트:
        for i in 산출결과세트:
            공종 = i[1]
            if not 공종 in result:
                result.append(공종)
    return result
    
공종목록 = 공종종류(산출결과세트리스트)

result = 공종목록
# Assign your output to the OUT variable.
OUT = result
# ----------------------------------------
watch_10 = Watch(공종목록)
integer_slider = IntegerSlider(5, range=0..18 step 1)
code_block_37 = CodeBlock(i=watch_10, j=integer_slider) { i[j]; }
watch_11 = Watch(code_block_37)
산출타겟_검증 = Python(IN[0]=color_palette_2, IN[1]=code_block_36, IN[2]=watch_11)  # CPython3
# ---------- 산출타겟_검증.python (80 lines) ----------
# Load the Python Standard and DesignScript Libraries
import sys
import clr
clr.AddReference('ProtoGeometry')
from Autodesk.DesignScript.Geometry import *

clr.AddReference('RevitNodes')
import Revit
clr.ImportExtensions(Revit.Elements)

from DSCore import Color
clr.AddReference('GeometryColor')
from Modifiers import GeometryColor

import random
from itertools import chain

# The inputs to this node will be stored as a list in the IN variables.
dataEnteringNode = IN
지정색상 = IN[0]
산출결과세트리스트 = IN[1]
공종코드 = IN[2].split(': ')[0]


def 공종종류(산출결과세트리스트):
    result = []
    for 산출결과세트 in 산출결과세트리스트:
        for i in 산출결과세트:
            공종 = i[1].split(': ')[0]
            if not 공종 in result:
                result.append(공종)
    return result
    
공종목록 = 공종종류(산출결과세트리스트)

def 색상준비(공종목록):
    log = []
    result = {}
    for i in range(len(공종목록)):
        난수1 = random.randint(0,255)
        난수2 = random.randint(0,255)
        난수3 = random.randint(0,255)
        난수4 = random.randint(0,255)
        색상 = Color.ByARGB(난수1,난수2,난수3,난수4)
        if not 색상 in log:
            log.append(색상)
            result[공종목록[i]] = 색상
    return result
    
색상들 = 색상준비(공종목록)
# Place your code below this line
def 시각화(산출결과세트, 색상들, 공종코드):
    result = []
    for 공종결과 in 산출결과세트:
        tmp1 = []
        target = 공종결과[3][0]
        공종 = 공종결과[1].split(': ')[0]
        색상 = 지정색상
        if 공종 == 공종코드:
            if isinstance(target, Revit.Elements.FamilyInstance):
                visual = GeometryColor.ByGeometryColor(target.Geometry()[0], 색상)[0]
                tmp1.append(visual)
            elif isinstance(target, str):
                pass
            else:
                if not isinstance(target, list):
                    visual = GeometryColor.ByGeometryColor(target, 색상)
                    tmp1.append(visual)
                else:
                    for i in target:
                        tmp1.append(GeometryColor.ByGeometryColor(i, 색상))
            result.append(tmp1)
        else:
            pass
            #result.append("no output")
    return result

result = [시각화(산출결과세트, 색상들, 공종코드) for 산출결과세트 in 산출결과세트리스트]
# Assign your output to the OUT variable.
OUT = [list(chain(*result))]
# ----------------------------------------

code_block_38 = CodeBlock(i=getTargetAndValue) { i[0][0][3][0]; }
code_block_39 = CodeBlock(i=createElemDS) { i["elem"]; }
code_block_40 = CodeBlock(i=code_block_39) { [i[5],i[6],i[7],i[8],i[9]]; }
python_script = Python(IN[0]=code_block_40)  # CPython3
# ---------- python_script.python (32 lines) ----------
# Load the Python Standard and DesignScript Libraries
import sys
import clr
clr.AddReference('ProtoGeometry')
from Autodesk.DesignScript.Geometry import *

# The inputs to this node will be stored as a list in the IN variables.
dataEnteringNode = IN
elements = IN[0]
# Place your code below this line
def findJoinedPair(elements):
    result = []
    Ididx = [i.Id for i in elements]
    _log = []
    for i in elements:
        tmp1= [i]
        if i.Id not in _log:
            _log.append(i.Id)
            joinlist = i.GetJoinedElements()
            if len(joinlist):
                for j in joinlist:
                    if j.Id in Ididx:
                        idx = Ididx.index(j.Id)
                        _log.append(idx)
                        tmp1.append(j)
                        
            result.append(tmp1)
        else:
            pass
    return result
# Assign your output to the OUT variable.
OUT = findJoinedPair(elements)
# ----------------------------------------
geometry = Element.Geometry(element=python_script)
flatten_9 = List.Flatten(list=geometry)

# group: 산출타겟 검증
color_palette_3 = ColorPalette({R: 255, G: 0, B: 255, A: 169})
code_block_41 = CodeBlock(input=getTargetAndValue) { input; }
공종목록_2 = Python(IN[0]=code_block_41)  # CPython3; same code as 공종목록
watch_12 = Watch(공종목록_2)
integer_slider_2 = IntegerSlider(6, range=0..18 step 1)
code_block_42 = CodeBlock(i=watch_12, j=integer_slider_2) { i[j]; }
watch_13 = Watch(code_block_42)
산출타겟_검증_2 = Python(IN[0]=color_palette_3, IN[1]=code_block_41, IN[2]=watch_13)  # CPython3; same code as 산출타겟_검증

watch_14 = Watch(공종목록)

# group: 산출타겟 검증
color_palette_4 = ColorPalette({R: 51, G: 127, B: 80, A: 130})
code_block_43 = CodeBlock(input=getTargetAndValue) { input; }
공종목록_3 = Python(IN[0]=code_block_43)  # CPython3; same code as 공종목록
watch_15 = Watch(공종목록_3)
integer_slider_3 = IntegerSlider(0, range=0..18 step 1)
code_block_44 = CodeBlock(i=watch_15, j=integer_slider_3) { i[j]; }
watch_16 = Watch(code_block_44)
산출타겟_검증_3 = Python(IN[0]=color_palette_4, IN[1]=code_block_43, IN[2]=watch_16)  # CPython3; same code as 산출타겟_검증

code_block_45 = CodeBlock(i=code_block_39) { i[11]; }
geometry_2 = Element.Geometry(element=code_block_45)

# group: <Func 8> Sheet Memebrane
code_block_46 = CodeBlock { "TargetElements"; }
valueAtKey_11 = DesignScript.Builtin.Dictionary.ValueAtKey(dictionary=value_for_import_from_others.MainInput, key=code_block_46)
# note: <Func>
createLeanConcrete_2 = Custom[CreateLeanConcrete](Element=valueAtKey_11)
area_3 = Surface.Area(surface=createLeanConcrete_2.Surface)
code_block_47 = CodeBlock(i=area_3) { Math.Round(List.Flatten(i)/1000000, 2); }
code_block_48 = CodeBlock { "M2"; }
count_7 = List.Count(list=code_block_47)
ofRepeatedItem_4 = List.OfRepeatedItem(item=code_block_48, amount=count_7)
code_block_49 = CodeBlock(FuncValues=code_block_47, FuncValuesUnit=ofRepeatedItem_4)  # same code as code_block_8
