# Dynamo graph 0_Dynamo Practice.dyn (Dynamo 2.11.1.4675)

code_block = CodeBlock { 0..100; }
watch = Watch(code_block)
code_block_2 = CodeBlock { 0..100..#11; }
watch_2 = Watch(code_block_2)
byCoordinates = Point.ByCoordinates(x=watch_2, y=watch_2, z=watch_2, lacing=CrossProduct)
code_block_3 = CodeBlock()
# ---------- code_block_3.designscript (5 lines) ----------
[
2000,
2500,
3000
];
# ----------------------------------------
code_block_4 = CodeBlock()  # same code as code_block_3
code_block_5 = CodeBlock()
# ---------- code_block_5.designscript (5 lines) ----------
[
500,
600,
700
];
# ----------------------------------------
code_block_6 = CodeBlock()
# ---------- code_block_6.designscript (5 lines) ----------
[
"AA00232AD-00001",
"AA00232AD-00002",
"AA00232AD-00003"
];
# ----------------------------------------
byLengths = Cuboid.ByLengths(width=code_block_3, length=code_block_4, height=code_block_5)
area = Solid.Area(solid=byLengths)
volume = Solid.Volume(solid=byLengths)
code_block_7 = CodeBlock(width=code_block_3, length=code_block_4, height=code_block_5, material=code_block_6, solid=byLengths, surfaceArea=area, volume=volume)
# ---------- code_block_7.designscript (9 lines) ----------
{
"Width": width,
"Length": length,
"Height": height,
"Material": material,
"Solid": solid,
"SurfaceArea": surfaceArea/1000000,
"Volume": volume/1000000000
};
# ----------------------------------------
watch_3 = Watch(code_block_7)
components = DesignScript.Builtin.Dictionary.Components(dictionary=watch_3)
transpose = List.Transpose(lists=components.values)
code_block_8 = CodeBlock()  # same code as code_block_3
code_block_9 = CodeBlock()  # same code as code_block_3
code_block_10 = CodeBlock()
# ---------- code_block_10.designscript (5 lines) ----------
[
500,
500,
500
];
# ----------------------------------------
code_block_11 = CodeBlock()  # same code as code_block_6
byLengths_2 = Cuboid.ByLengths(width=code_block_8, length=code_block_9, height=code_block_10)
area_2 = Solid.Area(solid=byLengths_2)
volume_2 = Solid.Volume(solid=byLengths_2)
code_block_12 = CodeBlock(width=code_block_8, length=code_block_9, height=code_block_10, material=code_block_11, solid=byLengths_2, surfaceArea=area_2, volume=volume_2)  # same code as code_block_7
list_create = List.Create(item0=code_block_7, item1=code_block_12)
code_block_13 = CodeBlock(i=list_create) { i[0]; }
code_block_14 = CodeBlock { "Height"; }
valueAtKey = DesignScript.Builtin.Dictionary.ValueAtKey(dictionary=watch_3, key=code_block_14)
code_block_15 = CodeBlock(i=valueAtKey) { i==500; }
code_block_16 = CodeBlock()
# ---------- code_block_16.designscript (5 lines) ----------
[
"FT112",
"FT112",
"FT112"
];
# ----------------------------------------
code_block_17 = CodeBlock()  # same code as code_block_3
code_block_18 = CodeBlock()  # same code as code_block_3
code_block_19 = CodeBlock()  # same code as code_block_5
code_block_20 = CodeBlock()  # same code as code_block_6
code_block_21 = CodeBlock()
# ---------- code_block_21.designscript (5 lines) ----------
[
"F1",
"F2",
"F3"
];
# ----------------------------------------
byCoordinates_2 = Point.ByCoordinates()
mQ_DataStructureTest1 = Custom[mQ_DataStructureTest1](ElementType=code_block_16, Width=code_block_17, Length=code_block_18, Height=code_block_19, Material=code_block_20, MemberName=code_block_21, Origin=byCoordinates_2)  # mQ_DataStructureTest1
code_block_22 = CodeBlock { "Volume"; }
valueAtKey_2 = DesignScript.Builtin.Dictionary.ValueAtKey(dictionary=mQ_DataStructureTest1, key=code_block_22)
components_2 = DesignScript.Builtin.Dictionary.Components(dictionary=mQ_DataStructureTest1)
code_block_23 = CodeBlock { "MemberName"; }
valueAtKey_3 = DesignScript.Builtin.Dictionary.ValueAtKey(dictionary=mQ_DataStructureTest1, key=code_block_23)
code_block_24 = CodeBlock { "F1"; }
allIndicesOf = List.AllIndicesOf(list=valueAtKey_3, item=code_block_24)
firstItem = List.FirstItem(list=allIndicesOf)
getItemAtIndex = List.GetItemAtIndex(list=components_2.values@L2, index=firstItem)
