# Dynamo graph LeanCreator_rA(220109).dyn (Dynamo 2.12.0.5650)

categories = Categories("OST_StructuralFoundation")
all_elements_of_category = ElementsOfCategory(Category=categories)
categories_2 = Categories("OST_EdgeSlab")
all_elements_of_category_2 = ElementsOfCategory(Category=categories_2)
join = List.Join(list0=all_elements_of_category, list1=all_elements_of_category_2)
findJoinedPair = Python(IN[0]=join)  # CPython3
# ---------- findJoinedPair.python (34 lines) ----------
# Load the Python Standard and DesignScript Libraries
import sys
import clr
clr.AddReference('ProtoGeometry')
from Autodesk.DesignScript.Geometry import *

# The inputs to this node will be stored as a list in the IN variables.
dataEnteringNode = IN
elements = IN[0]

# Place your code below this line
def findJoinedPair(elements):
    result = []
    Ididx = [i.Id for i in elements]
    _log = []
    for i in elements:
        tmp1= [i]
        if i.Id not in _log:
            _log.append(i.Id)
            joinlist = i.GetJoinedElements()
            if len(joinlist):
                for j in joinlist:
                    if j.Id in Ididx:
                        idx = Ididx.index(j.Id)
                        _log.append(idx)
                        tmp1.append(j)
                        
            result.append(tmp1)
        else:
            pass
    return result
    
# Assign your output to the OUT variable.
OUT = findJoinedPair(elements)
# ----------------------------------------
geometry = Element.Geometry(element=findJoinedPair)
flatten = List.Flatten(list=geometry@L3)
makeUnion = Python(IN[0]=flatten)  # CPython3
# ---------- makeUnion.python (26 lines) ----------
# Load the Python Standard and DesignScript Libraries
import sys
import clr
clr.AddReference('ProtoGeometry')
from Autodesk.DesignScript.Geometry import *

# The inputs to this node will be stored as a list in the IN variables.
dataEnteringNode = IN
inputpairs = IN[0]

# Place your code below this line
def makeUnion(pair):
    result = []
    if len(pair)>1:
        acc = pair[0]
        for i in range(0, len(pair)):
            tmp = acc.Union(pair[i])
            acc = tmp
        result.append(acc)
    else:
        acc = pair[0]
        result.append(acc)
    return result
        
# Assign your output to the OUT variable.
OUT = [makeUnion(i) for i in inputpairs]
# ----------------------------------------
explode = Geometry.Explode(geometry=makeUnion)
flatten_2 = List.Flatten(list=explode@L3)
integer_slider = IntegerSlider(6, range=0..17 step 1)
code_block = CodeBlock(i=flatten_2, j=integer_slider) { i[j]; }
findBeneathSrf = Python(IN[0]=flatten_2)  # CPython3
# ---------- findBeneathSrf.python (33 lines) ----------
# Load the Python Standard and DesignScript Libraries
import sys
import clr
clr.AddReference('ProtoGeometry')
from Autodesk.DesignScript.Geometry import *

# The inputs to this node will be stored as a list in the IN variables.
dataEnteringNode = IN
srfGroups = IN[0]

# Place your code below this line
def findBeneathSrf(srfGroup):
    result = []
    upperSrfs = [i for i in srfGroup if i.NormalAtParameter(0.5,0.5).Z == 1]
    headCrvs = []
    for i in upperSrfs:
        headCrv = PolyCurve.ByJoinedCurves(i.PerimeterCurves())
        headCrvs.append(headCrv)
    
    for i in srfGroup:
        tmp=[]
        for j in headCrvs:
            if i.DoesIntersect(j):
                tmp.append(False)
            else:
                tmp.append(True)
        if all(tmp):
            result.append(i)
    
    return result

# Assign your output to the OUT variable.
OUT = [findBeneathSrf(i) for i in srfGroups]
# ----------------------------------------
byJoinedSurfaces = PolySurface.ByJoinedSurfaces(surfaces=findBeneathSrf)
code_block_2 = CodeBlock { 100; }
boolean = BoolSelector(false)
thicken = Surface.Thicken(thickness=code_block_2, both_sides=boolean)  # unwired: surface
code_block_3 = CodeBlock { 11; }
removeItemAtIndex = List.RemoveItemAtIndex(list=thicken, indices=code_block_3)
categories_3 = Categories("OST_GenericModel")
code_block_4 = CodeBlock { "LC111"; }
byGeometry = DirectShape.ByGeometry(geometry=removeItemAtIndex, category=categories_3, name=code_block_4)  # frozen
code_block_5 = CodeBlock(i=findBeneathSrf) { i[8]; }
offset = DoubleInput(200)  # graph input
thickness = DoubleInput(100)  # graph input

# group: 중요!!! 8번 인덱스에서otherSrf가 이상하게 도출됨: 해결 필요
findSrfForExtending = Python(IN[0]=findBeneathSrf, IN[1]=offset, IN[2]=thickness)  # CPython3
# ---------- findSrfForExtending.python (43 lines) ----------
# Load the Python Standard and DesignScript Libraries
import sys
import clr
clr.AddReference('ProtoGeometry')
from Autodesk.DesignScript.Geometry import *

# The inputs to this node will be stored as a list in the IN variables.
dataEnteringNode = IN
srfGroups = IN[0]
offset = IN[1]
thk = IN[2]
# Place your code below this line
def findSrfForExtending(srfGroup):
    bdBox = BoundingBox.ByGeometry(srfGroup)
    bdBoxsolid = bdBox.ToCuboid()
    btmSrf = [i for i in bdBoxsolid.Explode() if i.NormalAtParameter(0.5,0.5).Z==-1][0]
    btmCrv = PolyCurve.ByJoinedCurves(btmSrf.PerimeterCurves())
    srfForExtending = PolySurface.ByJoinedSurfaces([i for i in srfGroup if i.DoesIntersect(btmCrv)])
    #srfForExtending = PolySurface.ByJoinedSurfaces([i for i in _srfForExtending if round(i.NormalAtParameter(0.5,0.5).Z)==0])
    _otherSrf = [i for i in srfGroup if not i.DoesIntersect(btmCrv)]
    
    if len(_otherSrf)==0:
        allperiCrvs = srfForExtending.PerimeterCurves()
        crvForExtending = PolyCurve.ByJoinedCurves(allperiCrvs)
        crvExtended = crvForExtending.Offset(offset)
        loftCrv = [crvForExtending, crvExtended]
        loftSrf = Surface.ByLoft(loftCrv)
        result = PolySurface.ByJoinedSurfaces([srfForExtending, loftSrf]).Thicken(thk,False)
    else:
        otherSrf = PolySurface.ByJoinedSurfaces(_otherSrf)
        allperiCrvs = srfForExtending.PerimeterCurves()
        crvForExtending = PolyCurve.ByJoinedCurves([i for i in allperiCrvs if not i.DoesIntersect(otherSrf)])
        crvExtended = crvForExtending.Offset(offset)
        loftCrv = [crvForExtending, crvExtended]
        loftSrf = Surface.ByLoft(loftCrv)
        result = PolySurface.ByJoinedSurfaces([srfForExtending, loftSrf, otherSrf]).Thicken(thk,False)
    
    return result
    

# Assign your output to the OUT variable.
OUT = findSrfForExtending(srfGroups[6])
#OUT = [findSrfForExtending(i) for i in srfGroups]
# ----------------------------------------

code_block_6 = CodeBlock()
# ---------- code_block_6.designscript (3 lines) ----------
//서피스를 이루는 페리미터 커브 멤버들간의 결합 정보를 저장하고,
//멤버 중 일부의 위치가 변경되었을때
//연관된 다른 멤버가 결합 정보를 유지하기 위해 동시에 변하는 구조체를 만들자
# ----------------------------------------
code_block_7 = CodeBlock(i=geometry) { i[6]; }
code_block_8 = CodeBlock(i=code_block_7) { i[2]; }
code_block_9 = CodeBlock(i=makeUnion) { i[6]; }
byGeometry_2 = BoundingBox.ByGeometry(geom=code_block_9)
toCuboid = BoundingBox.ToCuboid(boundingBox=byGeometry_2)
difference = Solid.Difference(solid=toCuboid, other=code_block_9)
intersect = Geometry.Intersect(geometry=code_block_9, other=difference)
flatten_3 = List.Flatten(list=intersect)
