# Dynamo graph Steel Excel Test(0728)_final.dyn (Dynamo 2.10.1.3976)

# group: Primary Input
categories = Categories("OST_StructuralFraming")
all_elements_of_category = ElementsOfCategory(Category=categories)
file_path = Filename(".\BIM_물량집계 자동화 산출기준표_rC(20210713)_KCS.xlsx")
file_from_path = FileObject(path=file_path)
code_block = CodeBlock { "Scope_lv2(Str Framing)"; }

getFullWMCodeDescriptionPerElement = Custom[GetFullWMCodeDescriptionPerElement](InputElement=all_elements_of_category, InputFilePath=file_from_path, InputSheetName=code_block)  # GetFullWMCodeDescriptionPerElement

# group: Primary Input
categories_2 = Categories("OST_StructuralFoundation")
all_elements_of_category_2 = ElementsOfCategory(Category=categories_2)
file_path_2 = Filename(".\BIM_물량집계 자동화 산출기준표_rC(20210726).xlsx")
file_from_path_2 = FileObject(path=file_path_2)
code_block_2 = CodeBlock { "Scope_lv2(Str Foundations)"; }

getFullWMCodeDescriptionPerElement_2 = Custom[GetFullWMCodeDescriptionPerElement](InputElement=all_elements_of_category_2, InputFilePath=file_from_path_2, InputSheetName=code_block_2)
watch = Watch(getFullWMCodeDescriptionPerElement_2.FullWMCodeDescriptionPerElement)
