# Dynamo graph Str Foundation Calculator_DataStructureTest(0720).dyn (Dynamo 2.10.1.3976)

code_block = CodeBlock { 0..100; }
watch = Watch(code_block)
code_block_2 = CodeBlock { 0..100..#11; }
watch_2 = Watch(code_block_2)
byCoordinates = Point.ByCoordinates(x=watch_2, y=watch_2, z=watch_2, lacing=CrossProduct)
code_block_3 = CodeBlock()
# ---------- code_block_3.designscript (5 lines) ----------
[
2000,
2500,
3000
];
# ----------------------------------------
code_block_4 = CodeBlock()  # same code as code_block_3
code_block_5 = CodeBlock()
# ---------- code_block_5.designscript (5 lines) ----------
[
500,
600,
700
];
# ----------------------------------------
code_block_6 = CodeBlock()
# ---------- code_block_6.designscript (5 lines) ----------
[
"AA00232AD-00001",
"AA00232AD-00002",
"AA00232AD-00003"
];
# ----------------------------------------
byLengths = Cuboid.ByLengths(width=code_block_3, length=code_block_4, height=code_block_5)
area = Solid.Area(solid=byLengths)
volume = Solid.Volume(solid=byLengths)
code_block_7 = CodeBlock(width=code_block_3, length=code_block_4, height=code_block_5, material=code_block_6, solid=byLengths, surfaceArea=area, volume=volume)
# ---------- code_block_7.designscript (9 lines) ----------
{
"Width": width,
"Length": length,
"Height": height,
"Material": material,
"Solid": solid,
"SurfaceArea": surfaceArea/1000000,
"Volume": volume/1000000000
};
# ----------------------------------------
watch_3 = Watch(code_block_7)
components = DesignScript.Builtin.Dictionary.Components(dictionary=watch_3)
transpose = List.Transpose(lists=components.values)
code_block_8 = CodeBlock()  # same code as code_block_3
code_block_9 = CodeBlock()  # same code as code_block_3
code_block_10 = CodeBlock()
# ---------- code_block_10.designscript (5 lines) ----------
[
500,
500,
500
];
# ----------------------------------------
code_block_11 = CodeBlock()  # same code as code_block_6
byLengths_2 = Cuboid.ByLengths(width=code_block_8, length=code_block_9, height=code_block_10)
area_2 = Solid.Area(solid=byLengths_2)
volume_2 = Solid.Volume(solid=byLengths_2)
code_block_12 = CodeBlock(width=code_block_8, length=code_block_9, height=code_block_10, material=code_block_11, solid=byLengths_2, surfaceArea=area_2, volume=volume_2)  # same code as code_block_7
list_create = List.Create(item0=code_block_7, item1=code_block_12)
code_block_13 = CodeBlock(i=list_create) { i[0]; }
code_block_14 = CodeBlock { "Height"; }
valueAtKey = DesignScript.Builtin.Dictionary.ValueAtKey(dictionary=watch_3, key=code_block_14)
code_block_15 = CodeBlock(i=valueAtKey) { i==500; }
code_block_16 = CodeBlock()
# ---------- code_block_16.designscript (5 lines) ----------
[
"FT112",
"FT113",
"FT114"
];
# ----------------------------------------
code_block_17 = CodeBlock()  # same code as code_block_3
code_block_18 = CodeBlock()  # same code as code_block_3
code_block_19 = CodeBlock()  # same code as code_block_5
code_block_20 = CodeBlock()
# ---------- code_block_20.designscript (11 lines) ----------
[
["AA00232AD-00001",
"AA00232AD-00002",
"AA00232AD-00003"],
["AA00232AD-00004",
"AA00232AD-00005",
"AA00232AD-00006"],
["AA00232AD-00007",
"AA00232AD-00008",
"AA00232AD-00009"]
];
# ----------------------------------------
code_block_21 = CodeBlock()
# ---------- code_block_21.designscript (5 lines) ----------
[
"F1",
"F2",
"F3"
];
# ----------------------------------------
number_slider = DoubleSlider(6984.2, range=0..10000 step 0.1)
number_slider_2 = DoubleSlider(7844.2, range=0..10000 step 0.1)

# group: 위치입력부
byCoordinates_2 = Point.ByCoordinates(x=number_slider, y=number_slider_2)
code_block_22 = CodeBlock { 0; 6000; }
byCoordinates_3 = Point.ByCoordinates(x=code_block_22.out1)
byCoordinates_4 = Point.ByCoordinates(y=code_block_22.out1)
join = List.Join(list0=byCoordinates_2, list1=byCoordinates_3, list2=byCoordinates_4)

mQ_DataStructureTest1 = Custom[mQ_DataStructureTest1](ElementType=code_block_16, Width=code_block_17, Length=code_block_18, Height=code_block_19, Material=code_block_20, MemberName=code_block_21, Origin=join)  # mQ_DataStructureTest1
code_block_23 = CodeBlock { "Volume"; }
valueAtKey_2 = DesignScript.Builtin.Dictionary.ValueAtKey(dictionary=mQ_DataStructureTest1, key=code_block_23)
components_2 = DesignScript.Builtin.Dictionary.Components(dictionary=mQ_DataStructureTest1)
transpose_2 = List.Transpose(lists=components_2.values)
code_block_24 = CodeBlock { "MemberName"; }
valueAtKey_3 = DesignScript.Builtin.Dictionary.ValueAtKey(dictionary=mQ_DataStructureTest1, key=code_block_24)
code_block_25 = CodeBlock { "F2"; }
allIndicesOf = List.AllIndicesOf(list=valueAtKey_3, item=code_block_25)
firstItem = List.FirstItem(list=allIndicesOf)
getItemAtIndex = List.GetItemAtIndex(list=transpose_2, index=firstItem)
code_block_26 = CodeBlock(i=transpose_2) { i[0]; }
code_block_27 = CodeBlock()
# ---------- code_block_27.designscript (4 lines) ----------
[
"Location",
"Material"
];
# ----------------------------------------
allIndicesOf_2 = List.AllIndicesOf(list=components_2.keys, item=code_block_27)
getItemAtIndex_2 = List.GetItemAtIndex(list=code_block_26, index=allIndicesOf_2)

# group: Data structure_Example
code_block_28 = CodeBlock { _MemberName: var[]..[]; }  # unwired: MemberName
code_block_29 = CodeBlock(MemberName=code_block_28)
# ---------- code_block_29.designscript (12 lines) ----------
_MemberName;
i=[Imperative]
{
	if (_MemberName == null)
	{
		return "none";
	}
	else
	{
		return _MemberName;
	}
};
# ----------------------------------------
code_block_30 = CodeBlock { _ElementType: var[]..[]; }  # unwired: ElementType
code_block_31 = CodeBlock(ElementType=code_block_30)
# ---------- code_block_31.designscript (12 lines) ----------
_ElementType;
i=[Imperative]
{
	if (_ElementType == null)
	{
		return "none";
	}
	else
	{
		return _ElementType;
	}
};
# ----------------------------------------
code_block_32 = CodeBlock { _Width: var[]..[]; }  # unwired: Width
code_block_33 = CodeBlock(Width=code_block_32)
# ---------- code_block_33.designscript (12 lines) ----------
_Width;
i=[Imperative]
{
	if (_Width == null)
	{
		return 1;
	}
	else
	{
		return _Width;
	}
};
# ----------------------------------------
code_block_34 = CodeBlock { _Length: var[]..[]; }  # unwired: Length
code_block_35 = CodeBlock(Length=code_block_34)
# ---------- code_block_35.designscript (12 lines) ----------
_Length;
i=[Imperative]
{
	if (_Length == null)
	{
		return 1;
	}
	else
	{
		return _Length;
	}
};
# ----------------------------------------
code_block_36 = CodeBlock { _Height: var[]..[]; }  # unwired: Height
code_block_37 = CodeBlock(Height=code_block_36)
# ---------- code_block_37.designscript (12 lines) ----------
_Height;
i=[Imperative]
{
	if (_Height == null)
	{
		return 1;
	}
	else
	{
		return _Height;
	}
};
# ----------------------------------------
code_block_38 = CodeBlock { _Material: var[]..[]; }  # unwired: Material
code_block_39 = CodeBlock(Material=code_block_38) { _Material; }
code_block_40 = CodeBlock { _Origin: Autodesk.DesignScript.Geometry.Point[]..[]; }  # unwired: Origin
code_block_41 = CodeBlock(Origin=code_block_40)
# ---------- code_block_41.designscript (12 lines) ----------
_Origin;
i=[Imperative]
{
	if (_Origin == null)
	{
		return Point.Origin();
	}
	else
	{
		return _Origin;
	}
};
# ----------------------------------------
byLengths_3 = Cuboid.ByLengths(origin=code_block_41.out1, width=code_block_33.out1, length=code_block_35.out1, height=code_block_37.out1)
area_3 = Solid.Area(solid=byLengths_3)
volume_3 = Solid.Volume(solid=byLengths_3)
centroid = Solid.Centroid(solid=byLengths_3)
code_block_42 = CodeBlock(memberName=code_block_29.out1, elementType=code_block_31.out1, width=code_block_33.out1, length=code_block_35.out1, height=code_block_37.out1, material=code_block_39, cuboid=byLengths_3, surfaceArea=area_3, volume=volume_3, location=centroid)
# ---------- code_block_42.designscript (12 lines) ----------
{
"MemberName": memberName,
"ElementType": elementType,
"Width": width,
"Length": length,
"Height": height,
"Material": material,
"Cuboid": cuboid,
"SurfaceArea": surfaceArea/1000000,
"Volume": volume/1000000000,
"Location": location
};
# ----------------------------------------
code_block_43 = CodeBlock(DataStructure=code_block_42) { DataStructure; }

map = List.Map()  # unwired: list, function
valueAtKey_4 = DesignScript.Builtin.Dictionary.ValueAtKey()  # unwired: dictionary, key
categories = Categories("OST_StructuralFoundation")
all_elements_of_category = ElementsOfCategory(Category=categories)

# group: Set Up Dictionary <all Element Inform>
code_block_44 = CodeBlock(Element=all_elements_of_category) { _Element; }
name = Element.Name(element=code_block_44)
code_block_45 = CodeBlock { "_"; }
split = String.Split(str=name, separator0=code_block_45)
firstItem_2 = List.FirstItem(list=split@L2)
getLocation = Element.GetLocation()  # unwired: element
map_2 = List.Map(list=code_block_44, function=getLocation)
# note: Excel Import 로 수정 필요
getMaterials = Element.GetMaterials()  # unwired: element
map_3 = List.Map(list=code_block_44, function=getMaterials)
name_2 = Element.Name(element=map_3)
code_block_46 = CodeBlock(element=code_block_44, elementType=name, familyCode=firstItem_2, location=map_2, material=map_3, wmCode=name_2)  # unwired: surfaceArea, volume
# ---------- code_block_46.designscript (10 lines) ----------
{
"Element": element,
"ElementType": elementType,
"FamilyCode": familyCode,
"Location": location,
"Material": material,
"WMCode": wmCode ,
"SurfaceArea": surfaceArea/1000000,
"Volume": volume/1000000000
};
# ----------------------------------------

watch_4 = Watch(code_block_46)
code_block_47 = CodeBlock { "Element"; }
valueAtKey_5 = DesignScript.Builtin.Dictionary.ValueAtKey(dictionary=watch_4, key=code_block_47)
laceShortest = List.LaceShortest(combineFunction=map, list0=valueAtKey_4, list1=valueAtKey_5)
map_4 = List.Map()  # unwired: list, function
volume_4 = Solid.Volume()  # unwired: solid
code_block_48 = CodeBlock { "Element"; }
valueAtKey_6 = DesignScript.Builtin.Dictionary.ValueAtKey(dictionary=code_block_46, key=code_block_48)

# group: Select Target Family
code_block_49 = CodeBlock(DicIn=code_block_46) { _DicIn; }
code_block_50 = CodeBlock { "FamilyCode"; }
valueAtKey_7 = DesignScript.Builtin.Dictionary.ValueAtKey(dictionary=code_block_49, key=code_block_50)
targetFamily = CodeBlock()
# ---------- targetFamily.designscript (4 lines) ----------
[
"FT21",
"FT11"
];
# ----------------------------------------
contains = String.Contains(str=valueAtKey_7, searchFor=targetFamily@L1)
code_block_51 = CodeBlock { true; }
allIndicesOf_3 = List.AllIndicesOf(list=contains@L2, item=code_block_51)
code_block_52 = CodeBlock { "Element"; }
valueAtKey_8 = DesignScript.Builtin.Dictionary.ValueAtKey(dictionary=code_block_49, key=code_block_52)
getItemAtIndex_3 = List.GetItemAtIndex(list=valueAtKey_8, index=allIndicesOf_3)
name_3 = Element.Name(element=getItemAtIndex_3)
code_block_53 = CodeBlock { "WMCode"; }
valueAtKey_9 = DesignScript.Builtin.Dictionary.ValueAtKey(dictionary=code_block_49, key=code_block_53)
getItemAtIndex_4 = List.GetItemAtIndex(list=valueAtKey_9, index=allIndicesOf_3)
code_block_54 = CodeBlock(targetFamilyIndex=allIndicesOf_3, targetFamilyCode=name_3, targetElements=getItemAtIndex_3, WMforTargetElements=getItemAtIndex_4)
# ---------- code_block_54.designscript (7 lines) ----------
{
//"TargetFamily[]": targetFamily,
"TargetFamilyIndex": targetFamilyIndex,
"TargetFamilyCode": targetFamilyCode,
"TargetElements": targetElements,
"WMforTargetElements": WMforTargetElements
};
# ----------------------------------------

code_block_55 = CodeBlock { "TargetFamilyIndex"; }
valueAtKey_10 = DesignScript.Builtin.Dictionary.ValueAtKey(dictionary=code_block_54, key=code_block_55)
getItemAtIndex_5 = List.GetItemAtIndex(list=valueAtKey_6, index=valueAtKey_10)
join_2 = List.Join(list0=volume_4, list1=getItemAtIndex_5)
firstItem_3 = List.FirstItem(list=join_2)
code_block_56 = CodeBlock { 1; }
dropItems = List.DropItems(list=join_2, amount=code_block_56)
count = List.Count(list=dropItems)
ofRepeatedItem = List.OfRepeatedItem(item=firstItem_3, amount=count)
geometry = Element.Geometry(element=dropItems)
laceShortest_2 = List.LaceShortest(combineFunction=map_4, list0=ofRepeatedItem, list1=geometry)
code_block_57 = CodeBlock()  # same code as code_block_20
components_3 = DesignScript.Builtin.Dictionary.Components(dictionary=code_block_54)
transpose_3 = List.Transpose(lists=components_3.values)
watch_5 = Watch(transpose_3)

# group: Select Target WorkMasterCode_test1
code_block_58 = CodeBlock(DicIn=code_block_54) { _DicIn; }
code_block_59 = CodeBlock { "WMforTargetElements"; }
valueAtKey_11 = DesignScript.Builtin.Dictionary.ValueAtKey(dictionary=code_block_58, key=code_block_59)
targetWM = CodeBlock()
# ---------- targetWM.designscript (3 lines) ----------
[
"A03AC032"
];
# ----------------------------------------
contains_2 = String.Contains(str=valueAtKey_11, searchFor=targetWM@L1)
code_block_60 = CodeBlock { true; }
allIndicesOf_4 = List.AllIndicesOf(list=contains_2@L5, item=code_block_60@L2)
code_block_61 = CodeBlock { 1; }
flatten = List.Flatten(list=allIndicesOf_4@L3, amt=code_block_61)
getItemAtIndex_6 = List.GetItemAtIndex(list=valueAtKey_11@L3, index=flatten@L3)
code_block_62 = CodeBlock { 1; }
flatten_2 = List.Flatten(list=getItemAtIndex_6@L3, amt=code_block_62)
code_block_63 = CodeBlock { "TargetElements"; }
valueAtKey_12 = DesignScript.Builtin.Dictionary.ValueAtKey(dictionary=code_block_58, key=code_block_63)
code_block_64 = CodeBlock(targetWM=flatten_2, targetElements=valueAtKey_12)
# ---------- code_block_64.designscript (5 lines) ----------
{
"TargetWM": targetWM,
"TargetElements": targetElements
//,"UnTargetWM": unTargetWM
};
# ----------------------------------------

components_4 = DesignScript.Builtin.Dictionary.Components(dictionary=code_block_64)
transpose_4 = List.Transpose(lists=components_4.values)
watch_6 = Watch(transpose_4)
code_block_65 = CodeBlock { "TargetFamilyCode"; }
map_5 = List.Map()  # unwired: list, function

# group: func1
code_block_66 = CodeBlock { "Volume"; }
getParameterValueByName = Element.GetParameterValueByName(parameterName=code_block_66)  # unwired: element

sum = Math.Sum()  # unwired: values

# group: func2
faces = Element.Faces()  # unwired: element
area_4 = Surface.Area()  # unwired: surface
function_compose = ComposeFunctions(function0=faces, function1=area_4, function2=sum)

code_block_67 = CodeBlock { 3; }
ofRepeatedItem_2 = List.OfRepeatedItem(item=function_compose, amount=code_block_67)
join_3 = List.Join(list0=getParameterValueByName, list1=ofRepeatedItem_2)

# group: Select Target WorkMasterCode_test2
code_block_68 = CodeBlock(DicIn=code_block_54) { _DicIn; }
code_block_69 = CodeBlock { "WMforTargetElements"; }
valueAtKey_13 = DesignScript.Builtin.Dictionary.ValueAtKey(dictionary=code_block_68, key=code_block_69)
flatten_3 = List.Flatten(list=valueAtKey_13)
uniqueItems = List.UniqueItems(list=flatten_3)
code_block_70 = CodeBlock(targetWMunique=uniqueItems, targetFunctions=join_3)
# ---------- code_block_70.designscript (4 lines) ----------
{
"TargetWMunique": targetWMunique,
"TargetFunctions": targetFunctions
};
# ----------------------------------------
code_block_71 = CodeBlock { "TargetElements"; }
valueAtKey_14 = DesignScript.Builtin.Dictionary.ValueAtKey(dictionary=code_block_68, key=code_block_71)

valueAtKey_15 = DesignScript.Builtin.Dictionary.ValueAtKey(dictionary=code_block_68, key=code_block_65)
code_block_72 = CodeBlock { "TargetFunctions"; }
valueAtKey_16 = DesignScript.Builtin.Dictionary.ValueAtKey(dictionary=code_block_70, key=code_block_72)
code_block_73 = CodeBlock { "TargetWMunique"; }
valueAtKey_17 = DesignScript.Builtin.Dictionary.ValueAtKey(dictionary=code_block_70, key=code_block_73)
allIndicesOf_5 = List.AllIndicesOf(list=valueAtKey_13@L2, item=valueAtKey_17)
clean = List.Clean(list=allIndicesOf_5@L1)
count_2 = List.Count(list=valueAtKey_13@L3)
chop = List.Chop(list=clean, lengths=count_2)
getItemAtIndex_7 = List.GetItemAtIndex(list=valueAtKey_16, index=chop)
code_block_74 = CodeBlock { 1; }
flatten_4 = List.Flatten(list=getItemAtIndex_7@L3, amt=code_block_74)
ofRepeatedItem_3 = List.OfRepeatedItem()  # unwired: item, amount
flatten_5 = List.Flatten(list=valueAtKey_14)
count_3 = List.Count(list=valueAtKey_13@L2)
laceShortest_3 = List.LaceShortest(combineFunction=ofRepeatedItem_3, list0=flatten_5, list1=count_3)
flatten_6 = List.Flatten(list=laceShortest_3)
laceShortest_4 = List.LaceShortest(combineFunction=map_5, list0=flatten_4, list1=flatten_6)
flatten_7 = List.Flatten(list=flatten_4)
