# Dynamo graph Str Foundation Calculator_DataStructureTest(0724).dyn (Dynamo 2.10.1.3976)

# group: Example
code_block = CodeBlock { ["a","b","c"]; [1,2,3]; }
byKeysValues = DesignScript.Builtin.Dictionary.ByKeysValues(keys=code_block.out0, values=code_block.out1)
code_block_2 = CodeBlock { ["d","e","f"]; [4,5,6]; }
byKeysValues_2 = DesignScript.Builtin.Dictionary.ByKeysValues(keys=code_block_2.out0, values=code_block_2.out1)
code_block_3 = CodeBlock(a1=byKeysValues, b1=byKeysValues_2)
# ---------- code_block_3.designscript (4 lines) ----------
{
"a1": a1
,"b1": b1
};
# ----------------------------------------
code_block_4 = CodeBlock { "a1"; }
valueAtKey = DesignScript.Builtin.Dictionary.ValueAtKey(dictionary=code_block_3, key=code_block_4)
code_block_5 = CodeBlock { "a"; }
valueAtKey_2 = DesignScript.Builtin.Dictionary.ValueAtKey(dictionary=valueAtKey, key=code_block_5)

# group: Primary Input
categories = Categories("OST_StructuralFoundation")
all_elements_of_category = ElementsOfCategory(Category=categories)
file_path = Filename(".\BIM_물량집계 자동화 산출기준표_rC(20210722).xlsx")
file_from_path = FileObject(path=file_path)
code_block_6 = CodeBlock { "Scope_lv2(Str Foundations)"; }

getFullWMCodeDescriptionPerElement = Custom[GetFullWMCodeDescriptionPerElement](InputElement=all_elements_of_category, InputFilePath=file_from_path, InputSheetName=code_block_6)  # GetFullWMCodeDescriptionPerElement

# group: Set Up Dictionary <all Element Inform>
# note: Input Node
code_block_7 = CodeBlock(InputDic=getFullWMCodeDescriptionPerElement.Dictionary) { _InputDic; }
code_block_8 = CodeBlock { "AllElement"; }
valueAtKey_3 = DesignScript.Builtin.Dictionary.ValueAtKey(dictionary=code_block_7, key=code_block_8)
name = Element.Name(element=valueAtKey_3)
code_block_9 = CodeBlock { "_"; }
split = String.Split(str=name, separator0=code_block_9)
firstItem = List.FirstItem(list=split@L2)
code_block_10 = CodeBlock { "FullWMCodeDescriptionPerElement"; }
valueAtKey_4 = DesignScript.Builtin.Dictionary.ValueAtKey(dictionary=code_block_7, key=code_block_10)
code_block_11 = CodeBlock(Element=valueAtKey_3, ElementType=name, FamilyCode=firstItem, FullWMCodeDescriptio=valueAtKey_4)
# ---------- code_block_11.designscript (6 lines) ----------
{
"Element": _Element,
"ElementType": _ElementType,
"FamilyCode": _FamilyCode,
"FullWMCodeDescriptionPerElement": _FullWMCodeDescriptionPerElement
};
# ----------------------------------------

# group: Select Target Family + Connect Target WorkMasters per Element and it's Calculated Values
code_block_12 = CodeBlock(InputDic=code_block_11) { _InputDic; }
code_block_13 = CodeBlock { "Element"; }
valueAtKey_5 = DesignScript.Builtin.Dictionary.ValueAtKey(dictionary=code_block_12, key=code_block_13)
code_block_14 = CodeBlock { "FamilyCode"; }
valueAtKey_6 = DesignScript.Builtin.Dictionary.ValueAtKey(dictionary=code_block_12, key=code_block_14)
uniqueItems = List.UniqueItems(list=valueAtKey_6)
targetFamily = CodeBlock(i=uniqueItems) { i[0]; }
contains = String.Contains(str=valueAtKey_6, searchFor=targetFamily@L1)
code_block_15 = CodeBlock { true; }
allIndicesOf = List.AllIndicesOf(list=contains@L2, item=code_block_15)
getItemAtIndex = List.GetItemAtIndex(list=valueAtKey_5, index=allIndicesOf)
name_2 = Element.Name(element=getItemAtIndex)
code_block_16 = CodeBlock { "FullWMCodeDescriptionPerElement"; }
valueAtKey_7 = DesignScript.Builtin.Dictionary.ValueAtKey(dictionary=code_block_12, key=code_block_16)
getItemAtIndex_2 = List.GetItemAtIndex(list=valueAtKey_7, index=allIndicesOf)
code_block_17 = CodeBlock(TargetElements=getItemAtIndex, TargetFamilyIndex=allIndicesOf, TargetFamilyCode=name_2, WMforTargetElements=getItemAtIndex_2)
# ---------- code_block_17.designscript (6 lines) ----------
{
"TargetElements": _TargetElements,
"TargetFamilyIndex": _TargetFamilyIndex,
"TargetFamilyCode": _TargetFamilyCode,
"WMforTargetElements": _WMforTargetElements
};
# ----------------------------------------
code_block_18 = CodeBlock { "TargetElements"; }
valueAtKey_8 = DesignScript.Builtin.Dictionary.ValueAtKey(dictionary=code_block_17, key=code_block_18)
code_block_19 = CodeBlock { "TargetFamilyCode"; }
valueAtKey_9 = DesignScript.Builtin.Dictionary.ValueAtKey(dictionary=code_block_17, key=code_block_19)
code_block_20 = CodeBlock { "WMforTargetElements"; }
valueAtKey_10 = DesignScript.Builtin.Dictionary.ValueAtKey(dictionary=code_block_17, key=code_block_20)
flatten = List.Flatten(list=valueAtKey_10)
uniqueItems_2 = List.UniqueItems(list=flatten)
watch = Watch(uniqueItems_2)
code_block_21 = CodeBlock(TargetElements=valueAtKey_8, TargetFamilyCode=valueAtKey_9, WMforTargetElements=valueAtKey_10, TargetWMunique=watch)
# ---------- code_block_21.designscript (6 lines) ----------
{
"TargetElements": _TargetElements,
"TargetFamilyCode": _TargetFamilyCode,
"WMforTargetElements": _WMforTargetElements,
"TargetWMunique": _TargetWMunique
};
# ----------------------------------------

code_block_22 = CodeBlock { "TargetElements"; }
valueAtKey_11 = DesignScript.Builtin.Dictionary.ValueAtKey(dictionary=code_block_21, key=code_block_22)

# group: TargetElementsForFunctionTest
watch_2 = Watch(valueAtKey_11)  # "Watch@TargetElementsForFunctionTest"

code_block_23 = CodeBlock(Element=watch_2) { _Element: var[]..[]; }
code_block_24 = CodeBlock(Element=code_block_23) { _Element; }
extractUpperFacesOfElement = Custom[ExtractUpperFacesOfElement](Element=code_block_24)  # ExtractUpperFacesOfElement
flatten_2 = List.Flatten(list=extractUpperFacesOfElement.Surface)
getJoinedElements = Element.GetJoinedElements(element=code_block_24)
flatten_3 = List.Flatten(list=getJoinedElements)
extractBelowFacesOfElement = Custom[ExtractBelowFacesOfElement](Element=flatten_3)  # ExtractBelowFacesOfElement
flatten_4 = List.Flatten(list=extractBelowFacesOfElement.Surface)
doesIntersect = Geometry.DoesIntersect(geometry=flatten_4, other=flatten_2, lacing=CrossProduct)
code_block_25 = CodeBlock { true; }
allIndicesOf_2 = List.AllIndicesOf(list=doesIntersect@L2, item=code_block_25)
flatten_5 = List.Flatten(list=allIndicesOf_2)
groupByKey = List.GroupByKey(list=flatten_4, keys=flatten_5)
difference = Surface.Difference(surface=flatten_2, others=groupByKey.groups)
extractSideFacesOfElement = Custom[ExtractSideFacesOfElement](Element=code_block_24)  # ExtractSideFacesOfElement
addItemToFront = List.AddItemToFront(item=difference@L1, list=extractSideFacesOfElement.Surface@L2)
color_palette = ColorPalette({R: 30, G: 144, B: 255, A: 129})
byGeometryColor = Modifiers.GeometryColor.ByGeometryColor(geometry=addItemToFront, color=color_palette)

# group: SEE Result
code_block_26 = CodeBlock(i=byGeometryColor) { i; }

# group: func0
code_block_27 = CodeBlock { "Volume"; }
getParameterValueByName = Element.GetParameterValueByName(parameterName=code_block_27)  # unwired: element

# group: func1
createExcavationSolid = Custom[CreateExcavationSolid]()  # CreateExcavationSolidForISOFDN; unwired: Element
volume = Solid.Volume()  # unwired: solid
sum = Math.Sum()  # unwired: values
code_block_28 = CodeBlock { 1000000000; }
div = _ / code_block_28  # unwired: x
function_compose = ComposeFunctions(function0=createExcavationSolid.Solid, function1=volume, function2=sum, function3=div)

# group: func2
createBaseCourseSurfaces = Custom[CreateBaseCourseSurfaces]()  # CreateBaseCourseSurfaces; unwired: Element
area = Surface.Area()  # unwired: surface
sum_2 = Math.Sum()  # unwired: values
code_block_29 = CodeBlock { 1000000; }
div_2 = _ / code_block_29  # unwired: x
function_compose_2 = ComposeFunctions(function0=createBaseCourseSurfaces.Surface, function1=area, function2=sum_2, function3=div_2)

# group: func3
createLeanConcrete = Custom[CreateLeanConcrete]()  # CreateLeanConcreteForISOFDN; unwired: Element
volume_2 = Solid.Volume()  # unwired: solid
sum_3 = Math.Sum()  # unwired: values
code_block_30 = CodeBlock { 1000000000; }
div_3 = _ / code_block_30  # unwired: x
function_compose_3 = ComposeFunctions(function0=createLeanConcrete.Solid, function1=volume_2, function2=sum_3, function3=div_3)

# group: func4
extractSideFacesOfElement_2 = Custom[ExtractSideFacesOfElement]()  # unwired: Element
area_2 = Surface.Area()  # unwired: surface
sum_4 = Math.Sum()  # unwired: values
code_block_31 = CodeBlock { 1000000; }
div_4 = _ / code_block_31  # unwired: x
function_compose_4 = ComposeFunctions(function0=extractSideFacesOfElement_2.Surface, function1=area_2, function2=sum_4, function3=div_4)

# group: func5
code_block_32 = CodeBlock { "Volume"; }
getParameterValueByName_2 = Element.GetParameterValueByName(parameterName=code_block_32)  # unwired: element
code_block_33 = CodeBlock { 0.1; }
mul = _ * code_block_33  # unwired: x
function_compose_5 = ComposeFunctions(function0=getParameterValueByName_2, function1=mul)

# group: func6
createConcreteProtectCoatingSurfaceForFD = Custom[CreateConcreteProtectCoatingSurfaceForFDN]()  # CreateConcreteProtectCoatingSurface; unwired: Element
area_3 = Surface.Area()  # unwired: surface
sum_5 = Math.Sum()  # unwired: values
code_block_34 = CodeBlock { 1000000; }
div_5 = _ / code_block_34  # unwired: x
function_compose_6 = ComposeFunctions(function0=createConcreteProtectCoatingSurfaceForFD.Surface, function1=area_3, function2=sum_5, function3=div_5)

extractUpperFacesOfElement_2 = Custom[ExtractUpperFacesOfElement]()  # unwired: Element

# group: func7
area_4 = Surface.Area()  # unwired: surface
sum_6 = Math.Sum()  # unwired: values
code_block_35 = CodeBlock { 1000000; }
div_6 = _ / code_block_35  # unwired: x
function_compose_7 = ComposeFunctions(function0=extractUpperFacesOfElement_2.Surface, function1=area_4, function2=sum_6, function3=div_6)

join = List.Join(list0=getParameterValueByName, list1=function_compose, list2=function_compose_2, list3=function_compose_3, list4=function_compose_4, list5=function_compose_5, list6=function_compose_6, list7=function_compose_7)
code_block_36 = CodeBlock { "TargetElements"; }
valueAtKey_12 = DesignScript.Builtin.Dictionary.ValueAtKey(dictionary=code_block_21, key=code_block_36)
code_block_37 = CodeBlock { "Volume"; }
# note: <Func>
getParameterValueByName_3 = Element.GetParameterValueByName(element=valueAtKey_12, parameterName=code_block_37)
flatten_6 = List.Flatten(list=getParameterValueByName_3)
code_block_38 = CodeBlock(FuncValues=flatten_6)
# ---------- code_block_38.designscript (3 lines) ----------
{
"FuncValues": _FuncValues
};
# ----------------------------------------
code_block_39 = CodeBlock { "TargetElements"; }
valueAtKey_13 = DesignScript.Builtin.Dictionary.ValueAtKey(dictionary=code_block_21, key=code_block_39)
createExcavationSolid_2 = Custom[CreateExcavationSolid](Element=valueAtKey_13)
volume_3 = Solid.Volume(solid=createExcavationSolid_2.Solid)
code_block_40 = CodeBlock(FuncValues=volume_3)  # same code as code_block_38
join_2 = List.Join(list0=code_block_38, list1=code_block_40)

# group: about <Func Values>
code_block_41 = CodeBlock(InputDic1=code_block_21) { _InputDic1; }
code_block_42 = CodeBlock { "TargetElements"; }
valueAtKey_14 = DesignScript.Builtin.Dictionary.ValueAtKey(dictionary=code_block_41, key=code_block_42)
code_block_43 = CodeBlock { "TargetFamilyCode"; }
valueAtKey_15 = DesignScript.Builtin.Dictionary.ValueAtKey(dictionary=code_block_41, key=code_block_43)
code_block_44 = CodeBlock { "WMforTargetElements"; }
valueAtKey_16 = DesignScript.Builtin.Dictionary.ValueAtKey(dictionary=code_block_41, key=code_block_44)
code_block_45 = CodeBlock(InputDic2=join_2) { _InputDic2; }
code_block_46 = CodeBlock { "FuncValues"; }
valueAtKey_17 = DesignScript.Builtin.Dictionary.ValueAtKey(dictionary=code_block_45, key=code_block_46)
code_block_47 = CodeBlock { "TargetWMunique"; }
valueAtKey_18 = DesignScript.Builtin.Dictionary.ValueAtKey(dictionary=code_block_41, key=code_block_47)
watch_3 = Watch(valueAtKey_18)
# note: Select ReferenceWM
code_block_48 = CodeBlock()
# ---------- code_block_48.designscript (4 lines) ----------
[
0,
1
];
# ----------------------------------------
getItemAtIndex_3 = List.GetItemAtIndex(list=watch_3, index=code_block_48)
watch_4 = Watch(getItemAtIndex_3)
code_block_49 = CodeBlock(TargetElements=valueAtKey_14, TargetFamilyCode=valueAtKey_15, WMforTargetElements=valueAtKey_16, FuncValues=valueAtKey_17, ReferenceWM=watch_4)
# ---------- code_block_49.designscript (7 lines) ----------
{
"TargetElements": _TargetElements,
"TargetFamilyCode": _TargetFamilyCode,
"WMforTargetElements": _WMforTargetElements,
"FuncValues": _FuncValues,
"ReferenceWM": _ReferenceWM
};
# ----------------------------------------
code_block_50 = CodeBlock(InputDic=code_block_49) { _InputDic; }
code_block_51 = CodeBlock { "TargetElements"; }
valueAtKey_19 = DesignScript.Builtin.Dictionary.ValueAtKey(dictionary=code_block_50, key=code_block_51)
code_block_52 = CodeBlock { "WMforTargetElements"; }
valueAtKey_20 = DesignScript.Builtin.Dictionary.ValueAtKey(dictionary=code_block_50, key=code_block_52)
code_block_53 = CodeBlock { "ReferenceWM"; }
valueAtKey_21 = DesignScript.Builtin.Dictionary.ValueAtKey(dictionary=code_block_50, key=code_block_53)
code_block_54 = CodeBlock { "TargetFamilyCode"; }
valueAtKey_22 = DesignScript.Builtin.Dictionary.ValueAtKey(dictionary=code_block_50, key=code_block_54)
contains_2 = String.Contains(str=valueAtKey_20, searchFor=valueAtKey_21@L1)
code_block_55 = CodeBlock { true; }
allIndicesOf_3 = List.AllIndicesOf(list=contains_2@@L2, item=code_block_55)
getItemAtIndex_4 = List.GetItemAtIndex(list=valueAtKey_20@@L2, index=allIndicesOf_3@L3)
code_block_56 = CodeBlock { 1; }
flatten_7 = List.Flatten(list=getItemAtIndex_4@L3, amt=code_block_56)
count = List.Count(list=flatten_7@L3)
ofRepeatedItem = List.OfRepeatedItem(item=valueAtKey_22, amount=count)
code_block_57 = CodeBlock { 1; }
flatten_8 = List.Flatten(list=ofRepeatedItem@L2, amt=code_block_57)
code_block_58 = CodeBlock { "FuncValues"; }
valueAtKey_23 = DesignScript.Builtin.Dictionary.ValueAtKey(dictionary=code_block_50, key=code_block_58)
code_block_59 = CodeBlock(TargetElements=valueAtKey_19, WMforTargetElements=valueAtKey_20, ReferenceWM=valueAtKey_21, TargetFamilyCode=flatten_8, FuncValues=valueAtKey_23, WMforFuncValues=flatten_7)
# ---------- code_block_59.designscript (8 lines) ----------
{
"TargetElements": _TargetElements,
"WMforTargetElements": _WMforTargetElements,
"ReferenceWM": _ReferenceWM,
"TargetFamilyCode": _TargetFamilyCode,
"FuncValues": _FuncValues,
"WMforFuncValues": _WMforFuncValues
};
# ----------------------------------------

code_block_60 = CodeBlock { "WMforFuncValues"; }
valueAtKey_24 = DesignScript.Builtin.Dictionary.ValueAtKey(dictionary=code_block_59, key=code_block_60)
code_block_61 = CodeBlock { "FuncValues"; }
valueAtKey_25 = DesignScript.Builtin.Dictionary.ValueAtKey(dictionary=code_block_59, key=code_block_61)
