# Dynamo graph TEST_Str Foundation Calculator_ExcelZoneRevise(0722).dyn (Dynamo 2.10.1.3976)

# group: Excel Import
file_path = Filename(".\BIM_물량집계 자동화 산출기준표_rC(20210722).xlsx")
file_from_path = FileObject(path=file_path)
string_from_object = FromObject(object=file_from_path)
code_block = CodeBlock { "Scope_lv2(Str Foundations)"; }
python_script_import_excel_by = Python(IN[0]=string_from_object, IN[1]=code_block)  # "Python Script@Import Excel(By OpenpyXl)"; CPython3
# ---------- python_script_import_excel_by.python (50 lines) ----------
# Load the Python Standard and DesignScript Libraries
import sys
import os
#sys.path.append(r'C:\Users\HEC\AppData\Local\Programs\Python\Python39\Lib\site-packages')
#sys.path.append(r'C:\Users\pjmk0\AppData\Local\Programs\Python\Python39\Lib\site-packages')
sys.path.append(os.getenv('LOCALAPPDATA').replace('\\','\\\\') + r'\Programs\Python\Python39\Lib\site-packages')
import clr
clr.AddReference('ProtoGeometry')
from Autodesk.DesignScript.Geometry import *
from collections import Iterable

def iterable(obj):
    return isinstance(obj, Iterable)


# The inputs to this node will be stored as a list in the IN variables.
dataEnteringNode = IN
PathIn = IN[0]
SheetNameIn = IN[1]

# Place your code below this line
import datetime
import openpyxl

path = (PathIn)
#path = (r'C:\Users\pjmk0\Downloads\MK\mQ\BIM_물량집계 자동화 산출기준표_rC(20210607)_mk_de.xlsx')

wb_obj = openpyxl.load_workbook(path, data_only=True)
sheet_obj = wb_obj.get_sheet_by_name(SheetNameIn)

m_row = sheet_obj.max_row
m_col = sheet_obj.max_column

listOut = []



for i in range(1, m_row +1):
    listTemp = []
    for j in range(1, m_col + 1):
        cell_obj = sheet_obj.cell(row=i, column=j)
        listTemp.append(cell_obj.value)
        if len(listTemp) == m_col:
            listOut.append(listTemp)
        


# Assign your output to the OUT variable.
OUT = listOut
#OUT = os.getenv('APPDATA')
# ----------------------------------------

# group: Null값 처리
code_block_2 = CodeBlock { " "; }
isNull = Object.IsNull()  # unwired: object
replaceByCondition = Replace(item=python_script_import_excel_by, replaceWith=code_block_2, condition=isNull)

# group: Whole Data(row direction)
watch = Watch(replaceByCondition)

whole_data_row_direction = Object.Identity(object=watch)

# group: Whole Data(Column direction)
transpose = List.Transpose(lists=replaceByCondition)
watch_2 = Watch(transpose)

# group: Column Index Guide
code_block_3 = CodeBlock(i=watch) { i[3]; }
watch_3 = Watch(code_block_3)

# group: All Element
categories = Categories("OST_StructuralFoundation")
all_elements_of_category = ElementsOfCategory(Category=categories)

# group: Get Used Family Type of Modeling
code_block_4 = CodeBlock(InputElement=all_elements_of_category) { _InputElement; }
name = Element.Name(element=code_block_4)
code_block_5 = CodeBlock { "_"; }
split = String.Split(str=name, separator0=code_block_5)
firstItem = List.FirstItem(list=split@L2)
uniqueItems = List.UniqueItems(list=firstItem)

# group: 사용된 패밀리타입이 위치한 Column Index 추출
string_from_object_2 = FromObject(object=watch_3)
contains = String.Contains(searchFor=uniqueItems, lacing=CrossProduct)  # unwired: str
map = List.Map(list=string_from_object_2, function=contains)
anyTrue = List.AnyTrue(list=map@L2)
code_block_6 = CodeBlock { true; }
allIndicesOf = List.AllIndicesOf(list=anyTrue, item=code_block_6)

# group: 사용된 패밀리타입 Column Data 추출
watch_4 = Watch(allIndicesOf)
getItemAtIndex = List.GetItemAtIndex(list=watch_2, index=watch_4)
watch_5 = Watch(getItemAtIndex)
code_block_7 = CodeBlock { 4; ""; }
# note: 불필요 정보 처리
replaceItemAtIndex = List.ReplaceItemAtIndex(list=getItemAtIndex@L2, index=code_block_7.out0, item=code_block_7.out1)

# group: 사용된 패밀리 타입에서 세부코드가 기입된 Row 열 번호 추출
string_from_object_3 = FromObject(object=replaceItemAtIndex)
code_block_8 = CodeBlock { "000"; }
contains_2 = String.Contains(str=string_from_object_3@L2, searchFor=code_block_8, lacing=CrossProduct)
code_block_9 = CodeBlock { true; }
allIndicesOf_2 = List.AllIndicesOf(list=contains_2@L2, item=code_block_9)
watch_6 = Watch(allIndicesOf_2)

# group: Excel Column Data Set
code_block_10 = CodeBlock(Input=watch_2) { _Input; }
count = List.Count(list=code_block_10)
code_block_11 = CodeBlock(i=count) { 0..i-1; }
string_from_object_4 = FromObject(object=code_block_11)
byKeysValues = DesignScript.Builtin.Dictionary.ByKeysValues(keys=string_from_object_4, values=code_block_10)
code_block_12 = CodeBlock { 0; }
string_from_object_5 = FromObject(object=code_block_12)
valueAtKey = DesignScript.Builtin.Dictionary.ValueAtKey(dictionary=byKeysValues, key=string_from_object_5)

# group: Excel Row Data Set
code_block_13 = CodeBlock(Input=watch) { _Input; }
count_2 = List.Count(list=code_block_13)
code_block_14 = CodeBlock(i=count_2) { 0..i-1; }
string_from_object_6 = FromObject(object=code_block_14)
byKeysValues_2 = DesignScript.Builtin.Dictionary.ByKeysValues(keys=string_from_object_6, values=code_block_13)
code_block_15 = CodeBlock { 0; }
string_from_object_7 = FromObject(object=code_block_15)
valueAtKey_2 = DesignScript.Builtin.Dictionary.ValueAtKey(dictionary=byKeysValues_2, key=string_from_object_7)

# group: 사용된 패밀리타입이 위치한 Column Index 추출
code_block_16 = CodeBlock(InputDic=byKeysValues_2) { _InputDic; }
code_block_17 = CodeBlock { 3; }
string_from_object_8 = FromObject(object=code_block_17)
valueAtKey_3 = DesignScript.Builtin.Dictionary.ValueAtKey(dictionary=code_block_16, key=string_from_object_8)
string_from_object_9 = FromObject(object=valueAtKey_3)
code_block_18 = CodeBlock(Input=uniqueItems) { _Input; }
contains_3 = String.Contains(searchFor=code_block_18, lacing=CrossProduct)  # unwired: str
map_2 = List.Map(list=string_from_object_9, function=contains_3)
anyTrue_2 = List.AnyTrue(list=map_2@L2)
code_block_19 = CodeBlock { true; }
allIndicesOf_3 = List.AllIndicesOf(list=anyTrue_2, item=code_block_19)

# group: 사용된 패밀리타입 Column Data 추출
watch_7 = Watch(allIndicesOf_3)
getItemAtIndex_2 = List.GetItemAtIndex(list=byKeysValues, index=watch_7)
code_block_20 = CodeBlock { 4; ""; }
# note: 불필요 정보 처리
replaceItemAtIndex_2 = List.ReplaceItemAtIndex(list=getItemAtIndex_2@L2, index=code_block_20.out0, item=code_block_20.out1)
watch_8 = Watch(getItemAtIndex_2)
