# Dynamo custom node OrganizeFuncValuesAndWorkMasterAsDictionary.dyf (Dynamo 2.10.1.3976)
# category: mQTest
# Organize FuncValues and WorkMaster As Dictionary

InputDic1 = Input(_InputDic1: var[]..[])
InputDic2 = Input(_InputDic2: var[]..[])

# group: Organize FuncValues and WM As Dictionary
code_block = CodeBlock(InputDic1=InputDic1) { _InputDic1; }
code_block_2 = CodeBlock { "TargetElements"; }
valueAtKey = DesignScript.Builtin.Dictionary.ValueAtKey(dictionary=code_block, key=code_block_2)
code_block_3 = CodeBlock { "TargetFamilyCode"; }
valueAtKey_2 = DesignScript.Builtin.Dictionary.ValueAtKey(dictionary=code_block, key=code_block_3)
code_block_4 = CodeBlock { "WMforTargetElements"; }
valueAtKey_3 = DesignScript.Builtin.Dictionary.ValueAtKey(dictionary=code_block, key=code_block_4)
code_block_5 = CodeBlock { "TargetWMunique"; }
valueAtKey_4 = DesignScript.Builtin.Dictionary.ValueAtKey(dictionary=code_block, key=code_block_5)
count = List.Count(list=valueAtKey@L2)
ofRepeatedItem = List.OfRepeatedItem(item=valueAtKey_4, amount=count)
allIndicesOf = List.AllIndicesOf(list=ofRepeatedItem@L2, item=valueAtKey_3@L2)
code_block_6 = CodeBlock { 1; }
flatten = List.Flatten(list=allIndicesOf@L3, amt=code_block_6)
code_block_7 = CodeBlock(InputDic2=InputDic2) { _InputDic2; }
code_block_8 = CodeBlock { "FuncValues"; }
valueAtKey_5 = DesignScript.Builtin.Dictionary.ValueAtKey(dictionary=code_block_7, key=code_block_8)
code_block_9 = CodeBlock { "FuncValuesUnit"; }
valueAtKey_6 = DesignScript.Builtin.Dictionary.ValueAtKey(dictionary=code_block_7, key=code_block_9)
code_block_10 = CodeBlock(TargetElements=valueAtKey, TargetFamilyCode=valueAtKey_2, WMforTargetElements=valueAtKey_3, TargetFuncValuesIndex=flatten, TotalFuncValues=valueAtKey_5, TotalFuncValuesUnit=valueAtKey_6, ReferenceWM=valueAtKey_4)
# ---------- code_block_10.designscript (9 lines) ----------
{
"TargetElements": _TargetElements,
"TargetFamilyCode": _TargetFamilyCode,
"WMforTargetElements": _WMforTargetElements,
"TargetFuncValuesIndex": _TargetFuncValuesIndex,
"TotalFuncValues": _TotalFuncValues,
"TotalFuncValuesUnit": _TotalFuncValuesUnit,
"ReferenceWM": _ReferenceWM
};
# ----------------------------------------
code_block_11 = CodeBlock { "TargetElements"; }
valueAtKey_7 = DesignScript.Builtin.Dictionary.ValueAtKey(dictionary=code_block_10, key=code_block_11)
code_block_12 = CodeBlock { "TargetFuncValuesIndex"; }
valueAtKey_8 = DesignScript.Builtin.Dictionary.ValueAtKey(dictionary=code_block_10, key=code_block_12)
count_2 = List.Count(list=valueAtKey_8@L2)
ofRepeatedItem_2 = List.OfRepeatedItem(item=valueAtKey_7@L1, amount=count_2@L1)
code_block_13 = CodeBlock { "TargetFamilyCode"; }
valueAtKey_9 = DesignScript.Builtin.Dictionary.ValueAtKey(dictionary=code_block_10, key=code_block_13)
count_3 = List.Count(list=valueAtKey_8@L2)
ofRepeatedItem_3 = List.OfRepeatedItem(item=valueAtKey_9@L1, amount=count_3@L1)
code_block_14 = CodeBlock { "WMforTargetElements"; }
valueAtKey_10 = DesignScript.Builtin.Dictionary.ValueAtKey(dictionary=code_block_10, key=code_block_14)
code_block_15 = CodeBlock { "TotalFuncValues"; }
valueAtKey_11 = DesignScript.Builtin.Dictionary.ValueAtKey(dictionary=code_block_10, key=code_block_15)
transpose = List.Transpose(lists=valueAtKey_11)
getItemAtIndex = List.GetItemAtIndex(list=transpose@@L2, index=valueAtKey_8@L2)
code_block_16 = CodeBlock { "TotalFuncValuesUnit"; }
valueAtKey_12 = DesignScript.Builtin.Dictionary.ValueAtKey(dictionary=code_block_10, key=code_block_16)
transpose_2 = List.Transpose(lists=valueAtKey_12)
getItemAtIndex_2 = List.GetItemAtIndex(list=transpose_2@@L2, index=valueAtKey_8@L2)
code_block_17 = CodeBlock(TrTargetElements=ofRepeatedItem_2, TrTargetFamilyCode=ofRepeatedItem_3, WMforTargetElements=valueAtKey_10, TargetFuncValues=getItemAtIndex, TargetFuncValuesUnit=getItemAtIndex_2)
# ---------- code_block_17.designscript (7 lines) ----------
{
"TrTargetElements": _TrTargetElements,
"TrTargetFamilyCode": _TrTargetFamilyCode,
"WMforTargetElements": _WMforTargetElements,
"TargetFuncValues": _TargetFuncValues,
"TargetFuncValuesUnit": _TargetFuncValuesUnit
};
# ----------------------------------------

Dictionary = Output(code_block_17)
