# Dynamo graph Structural Member Auto Creation_Sample.dyn (Dynamo 2.10.1.3976)
# packages: Clockwork for Dynamo 2.x 2.3.0

code_block = CodeBlock { "Concrete-Rectangular-Column"; }
byName = Family.ByName(name=code_block)
types = Family.Types(family=byName)
byPointInView = Custom[FamilyInstance.ByPointInView]()  # package Clockwork for Dynamo 2.x; Places a family instance at a given point in a given view (e.g. a detail component).; unwired: point, familyType, view
categories = Categories("OST_Grids")
all_elements_of_category = ElementsOfCategory(Category=categories)
code_block_2 = CodeBlock { 3; }
chop = List.Chop(list=all_elements_of_category, lengths=code_block_2)
name = Element.Name(element=chop)
firstItem = List.FirstItem(list=chop)
geometry = Element.Geometry(element=firstItem)
lastItem = List.LastItem(list=chop)
curves = Element.Curves(element=lastItem)
geometry_2 = Element.Geometry(element=all_elements_of_category)
elementCurveReferences = Element.ElementCurveReferences(element=all_elements_of_category)
parameters = Element.Parameters(element=all_elements_of_category)
